# Grasshopper definition dataM_M1-AR_v9.gh (Grasshopper 1.0.7)
# plug-ins: ShapeDiverForGrasshopper, Urbano

sddp = ShapeDiverDocumentPayload({AbsoluteTolerance=0, AngleTolerance=0, DistanceDisplayPrecision=0, GltfVersion="Gltf2", GrasshopperVersion="1.0.0007", InputGroups="{}", OutputGroups="{}", RelativeTolerance=0, RhinoVersion="7.29.23107.3001", UnitSystem=0, VersionCreated="1.14.0.0", VersionSaved="1.14.0.0"})

# ----
# Left Bound = (-73.951184(w/e) - 0.01)
# Right Bound = (40.7128(n/s) + 0.01)
# Top Bound = (40.7128(n/s) + (0.01 / 1.5))
# Bottom Bound = (-73.951184(w/e) - (0.01 / 1.5))
# 
# Lon = Average(Top Bound and Bottom Bound)
# Lat = Average(Left Bound and Right Bound)
latitude = Panel("40.695294")
longitude = Panel("-73.959094")
latitude_2 = GetNumber(latitude, AtLeast=1, AtMost=1, Maximum=1.797693135e+308, Minimum=-1.797693135e+308, TreeAccess=False)
longitude_2 = GetNumber(longitude, AtLeast=1, AtMost=1, Maximum=1.797693135e+308, Minimum=-1.797693135e+308, TreeAccess=False)
python = GhPythonScript(lat=latitude_2, lon=longitude_2)  # -> topBound, bottomBound, rightBound, leftBound
# ---------- python: Python ----------
import rhinoscriptsyntax as rs

leftBound = lon - 0.002
rightBound = lon + 0.002
topBound = lat + (0.002 / 1.5)
bottomBound = lat - (0.002 / 1.5)
# ---------- end python ----------

# ----
# Brooklyn Housing Sales 2023
txt = Text(Tree({0}: ["Brooklyn Rolling Sales.  All Sales From February 2023 - January 2024", "For sales prior to the Final Roll, Neighborhood Name and Descriptive Data reflect the most recent Final Roll.         Sales after the Final Roll, Neighborhood Name and Descriptive Data reflect current data.", "Building Class Category is based on Building Class at Time of Sale.", "Note: Condominium and cooperative sales are on the unit level and understood to have a count of one.", "BOROUGH", "3"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], {1}: ["", "", "", "", "NEIGHBORHOOD", "BATH BEACH"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], {2}: ["", "", "", "", "BUILDING CLASS CATEGORY", "01 ONE FAMILY DWELLINGS"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], {3}: ["", "", "", "", "TAX CLASS AT PRESENT", "1"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], {4}: ["", "", "", "", "BLOCK", "6360"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], {5}: ["", "", "", "", "LOT", "56"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]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))
panel = Panel("""0
1
2
3
4""")
flip = FlipMatrix(Data=txt)
path = DataPath(panel)
branch = TreeBranch(Tree=flip, Path="4", MaintainPaths=True)
split = SplitTree(Data=flip, Masks=flatten(path))  # -> Positive, Negative

download_openstreetmap_osm = DownloadOpenStreetMapOSM(
    LeftBound=python.leftBound,
    RightBound=python.rightBound,
    TopBound=python.topBound,
    BottomBound=python.bottomBound,
    RunToggle=True)  # -> OSMQueryURL, OSMFilePath
import_osm_features = ImportOSMFeatures(OSMPathOrURL=download_openstreetmap_osm.OSMQueryURL, OSMFeatureType="amenity", Format="xml", ImportAltitude=True)  # -> Points, Metadata, UTMZone, TranslationVector
import_osm_features_2 = ImportOSMFeatures(OSMPathOrURL=download_openstreetmap_osm.OSMQueryURL, OSMFeatureType="building", Format="xml", ImportAltitude=True)  # -> Points, Metadata, UTMZone, TranslationVector
import_osm_features_3 = ImportOSMFeatures(OSMPathOrURL=download_openstreetmap_osm.OSMQueryURL, OSMFeatureType="street", Format="xml", ImportAltitude=True)  # -> Points, Metadata, UTMZone, TranslationVector

# ----
# Streets
download_openstreetmap_osm_2 = DownloadOpenStreetMapOSM(
    LeftBound=python.leftBound,
    RightBound=python.rightBound,
    TopBound=python.topBound,
    BottomBound=python.bottomBound,
    RunToggle=True)  # -> OSMQueryURL, OSMFilePath
import_osm_features_4 = ImportOSMFeatures(OSMPathOrURL=download_openstreetmap_osm_2.OSMQueryURL, OSMFeatureType="street", Format="xml", ImportAltitude=True)  # -> Points, Metadata, UTMZone, TranslationVector
project = Project(Geometry=import_osm_features_4.Points, Plane=PlaneXY(0, 0, 0))  # -> Geometry, Transform
polyline = PolyLine(Vertices=project.Geometry, Closed=False)
create_street_network = CreateStreetNetwork(
    StreetCurves=flatten(polyline),
    Metadata=flatten(import_osm_features_4.Metadata),
    SplitStreetCurves=True,
    UTMZone=import_osm_features_4.UTMZone,
    TranslationVector=import_osm_features_4.TranslationVector)  # -> StreetNetwork, StreetSegmentCurves, UTMZone, TranslationVector

# ----
# Terrain
download_dem_and_build_terrain_mesh = DownloadDEMAndBuildTerrainMesh(
    LeftBound=python.leftBound,
    RightBound=python.rightBound,
    TopBound=python.topBound,
    BottomBound=python.bottomBound,
    XCount=100,
    YCount=100)  # -> TerrainMesh, UTMZone, TranslationVector

# ---- group: Intention
txt_2 = Text("""HousingPulse
Data Analytics for Housing Accessibility Assessment: 

Analyze large datasets, including demographic data, building codes, and geographic information, to assess the accessibility of housing stock at a city or regional level. By identifying areas with inadequate accessibility infrastructure or high concentrations of inaccessible housing units, policymakers can prioritize targeted interventions and investments to improve accessibility.

Also identify possible retrofitting and abandoned lots (private or public) for possible gorilla action take over. """)

# ----
# HousingPulse
panel_2 = Panel(txt_2)

# ---- group: Build Basic Model
# Turn on build toggle
polyline_2 = PolyLine(Vertices=import_osm_features_3.Points, Closed=False)
create_amenity = CreateAmenity(PointLocationOfAmenity=import_osm_features.Points, Metadata=import_osm_features.Metadata)
polyline_3 = PolyLine(Vertices=import_osm_features_2.Points, Closed=False)
create_street_network_2 = CreateStreetNetwork(
    StreetCurves=flatten(polyline_2),
    Metadata=flatten(import_osm_features_3.Metadata),
    SplitStreetCurves=True,
    UTMZone=import_osm_features_3.UTMZone,
    TranslationVector=import_osm_features_3.TranslationVector)  # -> StreetNetwork, StreetSegmentCurves, UTMZone, TranslationVector
arrange_amenities_by_building = ArrangeAmenitiesByBuilding(Amenities=flatten(create_amenity), Buildings=flatten(polyline_3))  # -> AmenitiesByBuilding, Buildings
create_building = CreateBuilding(
    BuildingCurve=arrange_amenities_by_building.Buildings,
    Metadata=import_osm_features_2.Metadata,
    AmenitiesInBuilding=arrange_amenities_by_building.AmenitiesByBuilding)

# ----
project_2 = Project(Geometry=create_building, Plane=PlaneXY(0, 0, 0))  # -> Geometry, Transform

# ---- group: Build Basic Model (continued)
build_urbano_model = BuildUrbanoModel(Buildings=flatten(project_2.Geometry), StreetNetwork=create_street_network_2.StreetNetwork, BuildToggle=True)  # -> UrbanoModel, BuildingCurves, Activities
inspect_building = InspectBuilding(Building=project_2.Geometry, DefaultHeight=10)  # -> Geometry, Metadata, Amenity, BuildingMesh

# ----
demeta = DeconstructMetadata(Metadata=inspect_building.Metadata)  # -> simplify(Keys), simplify(Values)

context_print = ContextPrint(RollingsalesBKTitles=branch)
context_print_2 = ContextPrint(RollingsalesBK=split.Negative)
context_bake = ContextBake(Buildings=inspect_building.BuildingMesh)
context_bake_2 = ContextBake(Geometry=download_dem_and_build_terrain_mesh.TerrainMesh)
context_print_3 = ContextPrint(README=txt_2)
context_bake_3 = ContextBake(Geometry=create_street_network.StreetSegmentCurves)
context_print_4 = ContextPrint(Amenity=build_urbano_model.Activities)
context_bake_4 = ContextBake(Geometry=build_urbano_model.BuildingCurves)
context_print_5 = ContextPrint(Text=demeta.Keys)
context_print_6 = ContextPrint(Text=demeta.Values)
