# Grasshopper definition geometry_copies3.gh (Grasshopper 1.0.7)

# ---- group: Drop Downs City One
city_amenities_one = GetInteger(Slider(0, range=0..3), AtLeast=1, AtMost=1, Maximum=2147483647, Minimum=-2147483648, TreeAccess=False)
city_district_one = GetInteger(Slider(0, range=0..3), AtLeast=1, AtMost=1, Maximum=2147483647, Minimum=-2147483648, TreeAccess=False)

# ---- group: Drop Downs City Two
city_district_two = GetInteger(Slider(0, range=0..3), AtLeast=1, AtMost=1, Maximum=2147483647, Minimum=-2147483648, TreeAccess=False)
city_amenities_two = GetInteger(Slider(0, range=0..3), AtLeast=1, AtMost=1, Maximum=2147483647, Minimum=-2147483648, TreeAccess=False)

# ---- group: ZoneA
geo = Geometry(simplify(Tree({0;0}: [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], {0;1}: [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], {0;2}: [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], {0;3}: [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], {0;4}: [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])))

# ---- group: ZoneB
geo_2 = Geometry(simplify(Tree({1;0}: [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], {1;1}: [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], {1;2}: [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], {1;3}: [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], {1;4}: [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])))

# ---- group: ZoneC
geo_3 = Geometry(simplify(Tree({2;0}: [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], {2;1}: [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], {2;2}: [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], {2;3}: [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], {2;4}: [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])))

# ---- group: ZoneD
geo_4 = Geometry(simplify(Tree({0}: [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], {1}: [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], {2}: [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], {3}: [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], {4}: [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])))

# ----
bang = ExplodeTree(Data=geo)  # -> Branch0, Branch1, Branch2, Branch3, Branch4
bang_2 = ExplodeTree(Data=geo_2)  # -> Branch0, Branch1, Branch2, Branch3, Branch4
bang_3 = ExplodeTree(Data=geo_3)  # -> Branch0, Branch1, Branch2, Branch3, Branch4
bang_4 = ExplodeTree(Data=geo_4)  # -> Branch0, Branch1, Branch2, Branch3, Branch4
bang_5 = ExplodeTree(Data=geo)  # -> Branch0, Branch1, Branch2, Branch3, Branch4
bang_6 = ExplodeTree(Data=geo_2)  # -> Branch0, Branch1, Branch2, Branch3, Branch4
bang_7 = ExplodeTree(Data=geo_3)  # -> Branch0, Branch1, Branch2, Branch3, Branch4
bang_8 = ExplodeTree(Data=geo_4)  # -> Branch0, Branch1, Branch2, Branch3, Branch4

# ---- group: ZoneA-v
txt = Text(flatten(["166,166,166", "166,166,166", "166,166,166", "166,166,166", "166,166,166", "166,166,166"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]))

# ---- group: ZoneC-v
txt_2 = Text(flatten(["166,166,166", "166,166,166", "166,166,166", "166,166,166", "166,166,166", "166,166,166"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]))

# ---- group: ZoneD-v
txt_3 = Text(flatten(["166,166,166", "166,166,166", "166,166,166", "166,166,166", "166,166,166", "166,166,166", "166,166,166", "166,166,166", "166,166,166", "166,166,166"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]))

# ---- group: ZoneB-v
txt_4 = Text(flatten(["166,166,166", "166,166,166", "166,166,166", "166,166,166", "166,166,166", "166,166,166", "166,166,166", "166,166,166", "166,166,166", "166,166,166", "166,166,166", "166,166,166", "166,166,166", "166,166,166", "166,166,166", "166,166,166", "166,166,166", "166,166,166", "166,166,166", "166,166,166", "166,166,166", "166,166,166", "166,166,166", "166,166,166", "166,166,166", "166,166,166", "166,166,166", "166,166,166", "166,166,166", "166,166,166", "166,166,166", "166,166,166", "166,166,166", "166,166,166", "166,166,166", "166,166,166", "166,166,166", "166,166,166", "166,166,166", "166,166,166", "166,166,166", "166,166,166", "166,166,166", "166,166,166", "166,166,166", "166,166,166", "166,166,166", "166,166,166"]))

# ----
# add color b
panel = Panel("Color")
uservalue = Text(txt)
uservalue_2 = Text(txt_2)
uservalue_3 = Text(txt_3)
uservalue_4 = Text(txt_4)
userkey = Text(panel)
userkey_2 = Text("Color")
userkey_3 = Text("Color")
userkey_4 = Text("Color")
c_script = CSharpScript(geometry=bang_7.Branch0, userKey=userkey_2, userValue=uservalue_2)  # -> out, geoWithUserString; inputs geometry: GeometryBase, userKey: String, userValue: String
# ---------- c_script: C# ----------
    geometry.SetUserString(userKey, userValue);
   geoWithUserString = geometry;
# ---------- end c_script ----------
c_script_2 = CSharpScript(geometry=bang_8.Branch0, userKey=userkey_3, userValue=uservalue_3)  # -> out, geoWithUserString; inputs geometry: GeometryBase, userKey: String, userValue: String; same code as c_script
c_script_3 = CSharpScript(geometry=bang_5.Branch0, userKey=userkey, userValue=uservalue)  # -> out, geoWithUserString; inputs geometry: GeometryBase, userKey: String, userValue: String; same code as c_script
c_script_4 = CSharpScript(geometry=bang_6.Branch0, userKey=userkey_4, userValue=uservalue_4)  # -> out, geoWithUserString; inputs geometry: GeometryBase, userKey: String, userValue: String; same code as c_script
python = GhPythonScript(geoms=c_script_3.geoWithUserString, user_key=panel)  # -> out, user_values; inputs geoms: list of GeometryBase
# ---------- python: Python ----------
user_values = []

for g in geoms:
    user_values.append( g.GetUserString(user_key))


user_values_ = user_values
# ---------- end python ----------

# ---- group: ZoneA-v
txt_5 = Text(flatten(["166,166,166", "166,166,166", "166,166,166", "166,166,166", "166,166,166", "166,166,166"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]))

# ---- group: ZoneC-v
txt_6 = Text(flatten(["166,166,166", "166,166,166", "166,166,166", "166,166,166", "166,166,166", "166,166,166"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]))

# ---- group: ZoneD-v
txt_7 = Text(flatten(["166,166,166", "166,166,166", "166,166,166", "166,166,166", "166,166,166", "166,166,166", "166,166,166", "166,166,166", "166,166,166", "166,166,166"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]))

# ---- group: ZoneB-v
txt_8 = Text(flatten(["166,166,166", "166,166,166", "166,166,166", "166,166,166", "166,166,166", "166,166,166", "166,166,166", "166,166,166", "166,166,166", "166,166,166", "166,166,166", "166,166,166", "166,166,166", "166,166,166", "166,166,166", "166,166,166", "166,166,166", "166,166,166", "166,166,166", "166,166,166", "166,166,166", "166,166,166", "166,166,166", "166,166,166", "166,166,166", "166,166,166", "166,166,166", "166,166,166", "166,166,166", "166,166,166", "166,166,166", "166,166,166", "166,166,166", "166,166,166", "166,166,166", "166,166,166", "166,166,166", "166,166,166", "166,166,166", "166,166,166", "166,166,166", "166,166,166", "166,166,166", "166,166,166", "166,166,166", "166,166,166", "166,166,166", "166,166,166"]))

# ----
# add color b
panel_2 = Panel("Color")
uservalue_5 = Text(txt_5)
uservalue_6 = Text(txt_6)
uservalue_7 = Text(txt_7)
uservalue_8 = Text(txt_8)
userkey_5 = Text(panel_2)
userkey_6 = Text("Color")
userkey_7 = Text("Color")
userkey_8 = Text("Color")
c_script_5 = CSharpScript(geometry=bang_3.Branch0, userKey=userkey_6, userValue=uservalue_6)  # -> out, geoWithUserString; inputs geometry: GeometryBase, userKey: String, userValue: String; same code as c_script
c_script_6 = CSharpScript(geometry=bang_4.Branch0, userKey=userkey_7, userValue=uservalue_7)  # -> out, geoWithUserString; inputs geometry: GeometryBase, userKey: String, userValue: String; same code as c_script
c_script_7 = CSharpScript(geometry=bang.Branch0, userKey=userkey_5, userValue=uservalue_5)  # -> out, geoWithUserString; inputs geometry: GeometryBase, userKey: String, userValue: String; same code as c_script
c_script_8 = CSharpScript(geometry=bang_2.Branch0, userKey=userkey_8, userValue=uservalue_8)  # -> out, geoWithUserString; inputs geometry: GeometryBase, userKey: String, userValue: String; same code as c_script

# ---- group: ParksA-v
txt_9 = Text(flatten(["51,242,54", "51,242,54", "51,242,54", "51,242,54", "51,242,54", "51,242,54", "51,242,54", "51,242,54", "51,242,54", "51,242,54"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]))

# ---- group: ParksC-v
txt_10 = Text(flatten(["51,242,54", "51,242,54", "51,242,54", "51,242,54", "51,242,54", "51,242,54", "51,242,54", "51,242,54", "51,242,54", "51,242,54", "51,242,54"]))

# ---- group: ParksD-v
txt_11 = Text(flatten(["51,242,54", "51,242,54", "51,242,54", "51,242,54", "51,242,54", "51,242,54", "51,242,54", "51,242,54", "51,242,54", "51,242,54", "51,242,54", "51,242,54", "51,242,54", "51,242,54", "51,242,54", "51,242,54", "51,242,54"]))

# ---- group: ParksB-v
txt_12 = Text(flatten(["51,242,54", "51,242,54", "51,242,54", "51,242,54", "51,242,54"]))

# ---- group: EducationA-v
txt_13 = Text(flatten(["176,42,163", "176,42,163", "176,42,163", "176,42,163", "176,42,163", "176,42,163", "176,42,163", "176,42,163", "176,42,163", "176,42,163", "176,42,163", "176,42,163", "176,42,163", "176,42,163", "176,42,163", "176,42,163", "176,42,163", "176,42,163", "176,42,163", "176,42,163", "176,42,163", "176,42,163", "176,42,163", "176,42,163", "176,42,163", "176,42,163", "176,42,163", "176,42,163", "176,42,163", "176,42,163"]))

# ---- group: HospitalityA-v
txt_14 = Text(flatten(["27,134,247", "27,134,247", "27,134,247", "27,134,247", "27,134,247", "27,134,247", "27,134,247", "27,134,247", "27,134,247", "27,134,247", "27,134,247", "27,134,247", "27,134,247", "27,134,247", "27,134,247", "27,134,247", "27,134,247", "27,134,247", "27,134,247", "27,134,247", "27,134,247", "27,134,247", "27,134,247", "27,134,247", "27,134,247", "27,134,247", "27,134,247", "27,134,247", "27,134,247", "27,134,247", "27,134,247", "27,134,247"]))

# ---- group: TransportationA-v
txt_15 = Text(flatten(["240,31,31", "240,31,31", "240,31,31"]))

# ----
# add color a
panel_3 = Panel("Color")
uservalue_9 = Text(txt_9)
userkey_9 = Text(panel_3)
uservalue_10 = Text(txt_13)
uservalue_11 = Text(txt_14)
uservalue_12 = Text(txt_15)
userkey_10 = Text("Color")
userkey_11 = Text("Color")
userkey_12 = Text("Color")
c_script_9 = CSharpScript(geometry=bang_5.Branch1, userKey=userkey_9, userValue=uservalue_9)  # -> out, geoWithUserString; inputs geometry: GeometryBase, userKey: String, userValue: String; same code as c_script
c_script_10 = CSharpScript(geometry=bang_5.Branch2, userKey=userkey_10, userValue=uservalue_10)  # -> out, geoWithUserString; inputs geometry: GeometryBase, userKey: String, userValue: String; same code as c_script
c_script_11 = CSharpScript(geometry=bang_5.Branch3, userKey=userkey_11, userValue=uservalue_11)  # -> out, geoWithUserString; inputs geometry: GeometryBase, userKey: String, userValue: String; same code as c_script
c_script_12 = CSharpScript(geometry=bang_5.Branch4, userKey=userkey_12, userValue=uservalue_12)  # -> out, geoWithUserString; inputs geometry: GeometryBase, userKey: String, userValue: String; same code as c_script

# ---- group: EducationC-v
txt_16 = Text(flatten("176,42,163"))

# ---- group: HospitalityC-v
txt_17 = Text(flatten(["27,134,247", "27,134,247", "27,134,247", "27,134,247", "27,134,247", "27,134,247", "27,134,247", "27,134,247", "27,134,247", "27,134,247", "27,134,247", "27,134,247", "27,134,247", "27,134,247", "27,134,247", "27,134,247", "27,134,247", "27,134,247", "27,134,247", "27,134,247", "27,134,247", "27,134,247", "27,134,247", "27,134,247", "27,134,247", "27,134,247"]))

# ---- group: TransportationC-v
txt_18 = Text(flatten(["240,31,31", "240,31,31", "240,31,31", "240,31,31", "240,31,31", "240,31,31", "240,31,31", "240,31,31", "240,31,31", "240,31,31", "240,31,31", "240,31,31", "240,31,31", "240,31,31", "240,31,31", "240,31,31", "240,31,31", "240,31,31"]))

# ----
uservalue_13 = Text(txt_10)
userkey_13 = Text("Color")
uservalue_14 = Text(txt_16)
uservalue_15 = Text(txt_17)
userkey_14 = Text("Color")
userkey_15 = Text("Color")
uservalue_16 = Text(txt_18)
userkey_16 = Text("Color")
c_script_13 = CSharpScript(geometry=bang_7.Branch1, userKey=userkey_13, userValue=uservalue_13)  # -> out, geoWithUserString; inputs geometry: GeometryBase, userKey: String, userValue: String; same code as c_script
c_script_14 = CSharpScript(geometry=bang_7.Branch2, userKey=userkey_14, userValue=uservalue_14)  # -> out, geoWithUserString; inputs geometry: GeometryBase, userKey: String, userValue: String; same code as c_script
c_script_15 = CSharpScript(geometry=bang_7.Branch3, userKey=userkey_15, userValue=uservalue_15)  # -> out, geoWithUserString; inputs geometry: GeometryBase, userKey: String, userValue: String; same code as c_script
c_script_16 = CSharpScript(geometry=bang_7.Branch4, userKey=userkey_16, userValue=uservalue_16)  # -> out, geoWithUserString; inputs geometry: GeometryBase, userKey: String, userValue: String; same code as c_script

# ---- group: EducationD-v
txt_19 = Text(flatten("176,42,163"))

# ---- group: HospitalityD-v
txt_20 = Text(flatten(["27,134,247", "27,134,247"]))

# ---- group: TransportationD-v
txt_21 = Text(flatten("240,31,31"))

# ----
uservalue_17 = Text(txt_11)
userkey_17 = Text("Color")
uservalue_18 = Text(txt_19)
uservalue_19 = Text(txt_20)
userkey_18 = Text("Color")
userkey_19 = Text("Color")
uservalue_20 = Text(txt_21)
userkey_20 = Text("Color")
c_script_17 = CSharpScript(geometry=bang_8.Branch1, userKey=userkey_17, userValue=uservalue_17)  # -> out, geoWithUserString; inputs geometry: GeometryBase, userKey: String, userValue: String; same code as c_script
c_script_18 = CSharpScript(geometry=bang_8.Branch2, userKey=userkey_18, userValue=uservalue_18)  # -> out, geoWithUserString; inputs geometry: GeometryBase, userKey: String, userValue: String; same code as c_script
c_script_19 = CSharpScript(geometry=bang_8.Branch3, userKey=userkey_19, userValue=uservalue_19)  # -> out, geoWithUserString; inputs geometry: GeometryBase, userKey: String, userValue: String; same code as c_script
c_script_20 = CSharpScript(geometry=bang_8.Branch4, userKey=userkey_20, userValue=uservalue_20)  # -> out, geoWithUserString; inputs geometry: GeometryBase, userKey: String, userValue: String; same code as c_script

# ---- group: EducationB-v
txt_22 = Text(flatten(["176,42,163", "176,42,163"]))

# ---- group: HospitalityB-v
txt_23 = Text(flatten(["27,134,247", "27,134,247", "27,134,247", "27,134,247", "27,134,247", "27,134,247", "27,134,247", "27,134,247", "27,134,247", "27,134,247", "27,134,247", "27,134,247", "27,134,247"]))

# ---- group: TransportationB-v
txt_24 = Text(flatten(["240,31,31", "240,31,31", "240,31,31", "240,31,31", "240,31,31", "240,31,31"]))

# ----
uservalue_21 = Text(txt_12)
userkey_21 = Text("Color")
uservalue_22 = Text(txt_22)
uservalue_23 = Text(txt_23)
userkey_22 = Text("Color")
userkey_23 = Text("Color")
uservalue_24 = Text(txt_24)
userkey_24 = Text("Color")
c_script_21 = CSharpScript(geometry=bang_6.Branch1, userKey=userkey_21, userValue=uservalue_21)  # -> out, geoWithUserString; inputs geometry: GeometryBase, userKey: String, userValue: String; same code as c_script
c_script_22 = CSharpScript(geometry=bang_6.Branch2, userKey=userkey_22, userValue=uservalue_22)  # -> out, geoWithUserString; inputs geometry: GeometryBase, userKey: String, userValue: String; same code as c_script
c_script_23 = CSharpScript(geometry=bang_6.Branch3, userKey=userkey_23, userValue=uservalue_23)  # -> out, geoWithUserString; inputs geometry: GeometryBase, userKey: String, userValue: String; same code as c_script
c_script_24 = CSharpScript(geometry=bang_6.Branch4, userKey=userkey_24, userValue=uservalue_24)  # -> out, geoWithUserString; inputs geometry: GeometryBase, userKey: String, userValue: String; same code as c_script

# ---- group: ParksA-v
txt_25 = Text(flatten(["51,242,54", "51,242,54", "51,242,54", "51,242,54", "51,242,54", "51,242,54", "51,242,54", "51,242,54", "51,242,54", "51,242,54"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]))

# ---- group: ParksC-v
txt_26 = Text(flatten(["51,242,54", "51,242,54", "51,242,54", "51,242,54", "51,242,54", "51,242,54", "51,242,54", "51,242,54", "51,242,54", "51,242,54", "51,242,54"]))

# ---- group: ParksD-v
txt_27 = Text(flatten(["51,242,54", "51,242,54", "51,242,54", "51,242,54", "51,242,54", "51,242,54", "51,242,54", "51,242,54", "51,242,54", "51,242,54", "51,242,54", "51,242,54", "51,242,54", "51,242,54", "51,242,54", "51,242,54", "51,242,54"]))

# ---- group: ParksB-v
txt_28 = Text(flatten(["51,242,54", "51,242,54", "51,242,54", "51,242,54", "51,242,54"]))

# ---- group: EducationA-v
txt_29 = Text(flatten(["176,42,163", "176,42,163", "176,42,163", "176,42,163", "176,42,163", "176,42,163", "176,42,163", "176,42,163", "176,42,163", "176,42,163", "176,42,163", "176,42,163", "176,42,163", "176,42,163", "176,42,163", "176,42,163", "176,42,163", "176,42,163", "176,42,163", "176,42,163", "176,42,163", "176,42,163", "176,42,163", "176,42,163", "176,42,163", "176,42,163", "176,42,163", "176,42,163", "176,42,163", "176,42,163"]))

# ---- group: HospitalityA-v
txt_30 = Text(flatten(["27,134,247", "27,134,247", "27,134,247", "27,134,247", "27,134,247", "27,134,247", "27,134,247", "27,134,247", "27,134,247", "27,134,247", "27,134,247", "27,134,247", "27,134,247", "27,134,247", "27,134,247", "27,134,247", "27,134,247", "27,134,247", "27,134,247", "27,134,247", "27,134,247", "27,134,247", "27,134,247", "27,134,247", "27,134,247", "27,134,247", "27,134,247", "27,134,247", "27,134,247", "27,134,247", "27,134,247", "27,134,247"]))

# ---- group: TransportationA-v
txt_31 = Text(flatten(["240,31,31", "240,31,31", "240,31,31"]))

# ----
# add color a
panel_4 = Panel("Color")
uservalue_25 = Text(txt_25)
userkey_25 = Text(panel_4)
uservalue_26 = Text(txt_29)
uservalue_27 = Text(txt_30)
userkey_26 = Text("Color")
userkey_27 = Text("Color")
uservalue_28 = Text(txt_31)
userkey_28 = Text("Color")
c_script_25 = CSharpScript(geometry=bang.Branch1, userKey=userkey_25, userValue=uservalue_25)  # -> out, geoWithUserString; inputs geometry: GeometryBase, userKey: String, userValue: String; same code as c_script
c_script_26 = CSharpScript(geometry=bang.Branch2, userKey=userkey_26, userValue=uservalue_26)  # -> out, geoWithUserString; inputs geometry: GeometryBase, userKey: String, userValue: String; same code as c_script
c_script_27 = CSharpScript(geometry=bang.Branch3, userKey=userkey_27, userValue=uservalue_27)  # -> out, geoWithUserString; inputs geometry: GeometryBase, userKey: String, userValue: String; same code as c_script
c_script_28 = CSharpScript(geometry=bang.Branch4, userKey=userkey_28, userValue=uservalue_28)  # -> out, geoWithUserString; inputs geometry: GeometryBase, userKey: String, userValue: String; same code as c_script

# ---- group: EducationC-v
txt_32 = Text(flatten("176,42,163"))

# ---- group: HospitalityC-v
txt_33 = Text(flatten(["27,134,247", "27,134,247", "27,134,247", "27,134,247", "27,134,247", "27,134,247", "27,134,247", "27,134,247", "27,134,247", "27,134,247", "27,134,247", "27,134,247", "27,134,247", "27,134,247", "27,134,247", "27,134,247", "27,134,247", "27,134,247", "27,134,247", "27,134,247", "27,134,247", "27,134,247", "27,134,247", "27,134,247", "27,134,247", "27,134,247"]))

# ---- group: EducationB-v
txt_34 = Text(flatten(["176,42,163", "176,42,163"]))

# ---- group: HospitalityB-v
txt_35 = Text(flatten(["27,134,247", "27,134,247", "27,134,247", "27,134,247", "27,134,247", "27,134,247", "27,134,247", "27,134,247", "27,134,247", "27,134,247", "27,134,247", "27,134,247", "27,134,247"]))

# ---- group: TransportationC-v
txt_36 = Text(flatten(["240,31,31", "240,31,31", "240,31,31", "240,31,31", "240,31,31", "240,31,31", "240,31,31", "240,31,31", "240,31,31", "240,31,31", "240,31,31", "240,31,31", "240,31,31", "240,31,31", "240,31,31", "240,31,31", "240,31,31", "240,31,31"]))

# ----
uservalue_29 = Text(txt_26)
uservalue_30 = Text(txt_32)
uservalue_31 = Text(txt_33)
userkey_29 = Text("Color")
uservalue_32 = Text(txt_36)
userkey_30 = Text("Color")
userkey_31 = Text("Color")
userkey_32 = Text("Color")
c_script_29 = CSharpScript(geometry=bang_3.Branch1, userKey=userkey_29, userValue=uservalue_29)  # -> out, geoWithUserString; inputs geometry: GeometryBase, userKey: String, userValue: String; same code as c_script
c_script_30 = CSharpScript(geometry=bang_3.Branch2, userKey=userkey_30, userValue=uservalue_30)  # -> out, geoWithUserString; inputs geometry: GeometryBase, userKey: String, userValue: String; same code as c_script
c_script_31 = CSharpScript(geometry=bang_3.Branch3, userKey=userkey_31, userValue=uservalue_31)  # -> out, geoWithUserString; inputs geometry: GeometryBase, userKey: String, userValue: String; same code as c_script
c_script_32 = CSharpScript(geometry=bang_3.Branch4, userKey=userkey_32, userValue=uservalue_32)  # -> out, geoWithUserString; inputs geometry: GeometryBase, userKey: String, userValue: String; same code as c_script

# ---- group: EducationD-v
txt_37 = Text(flatten("176,42,163"))

# ---- group: HospitalityD-v
txt_38 = Text(flatten(["27,134,247", "27,134,247"]))

# ---- group: TransportationD-v
txt_39 = Text(flatten("240,31,31"))

# ----
uservalue_33 = Text(txt_27)
uservalue_34 = Text(txt_37)
uservalue_35 = Text(txt_38)
userkey_33 = Text("Color")
userkey_34 = Text("Color")
userkey_35 = Text("Color")
uservalue_36 = Text(txt_39)
userkey_36 = Text("Color")
c_script_33 = CSharpScript(geometry=bang_4.Branch1, userKey=userkey_33, userValue=uservalue_33)  # -> out, geoWithUserString; inputs geometry: GeometryBase, userKey: String, userValue: String; same code as c_script
c_script_34 = CSharpScript(geometry=bang_4.Branch2, userKey=userkey_34, userValue=uservalue_34)  # -> out, geoWithUserString; inputs geometry: GeometryBase, userKey: String, userValue: String; same code as c_script
c_script_35 = CSharpScript(geometry=bang_4.Branch3, userKey=userkey_35, userValue=uservalue_35)  # -> out, geoWithUserString; inputs geometry: GeometryBase, userKey: String, userValue: String; same code as c_script
c_script_36 = CSharpScript(geometry=bang_4.Branch4, userKey=userkey_36, userValue=uservalue_36)  # -> out, geoWithUserString; inputs geometry: GeometryBase, userKey: String, userValue: String; same code as c_script

# ---- group: TransportationB-v
txt_40 = Text(flatten(["240,31,31", "240,31,31", "240,31,31", "240,31,31", "240,31,31", "240,31,31"]))

# ----
uservalue_37 = Text(txt_28)
uservalue_38 = Text(txt_34)
uservalue_39 = Text(txt_35)
userkey_37 = Text("Color")
userkey_38 = Text("Color")
userkey_39 = Text("Color")
uservalue_40 = Text(txt_40)
userkey_40 = Text("Color")
c_script_37 = CSharpScript(geometry=bang_2.Branch1, userKey=userkey_37, userValue=uservalue_37)  # -> out, geoWithUserString; inputs geometry: GeometryBase, userKey: String, userValue: String; same code as c_script
c_script_38 = CSharpScript(geometry=bang_2.Branch2, userKey=userkey_38, userValue=uservalue_38)  # -> out, geoWithUserString; inputs geometry: GeometryBase, userKey: String, userValue: String; same code as c_script
c_script_39 = CSharpScript(geometry=bang_2.Branch3, userKey=userkey_39, userValue=uservalue_39)  # -> out, geoWithUserString; inputs geometry: GeometryBase, userKey: String, userValue: String; same code as c_script
c_script_40 = CSharpScript(geometry=bang_2.Branch4, userKey=userkey_40, userValue=uservalue_40)  # -> out, geoWithUserString; inputs geometry: GeometryBase, userKey: String, userValue: String; same code as c_script

stream_filter = StreamFilter(
    Gate=city_amenities_one,
    Stream0=c_script_21.geoWithUserString,
    Stream1=c_script_22.geoWithUserString,
    Stream2=c_script_23.geoWithUserString,
    Stream3=c_script_24.geoWithUserString)
stream_filter_2 = StreamFilter(
    Gate=city_amenities_one,
    Stream0=c_script_9.geoWithUserString,
    Stream1=c_script_10.geoWithUserString,
    Stream2=c_script_11.geoWithUserString,
    Stream3=c_script_12.geoWithUserString)
stream_filter_3 = StreamFilter(
    Gate=city_amenities_one,
    Stream0=c_script_13.geoWithUserString,
    Stream1=c_script_14.geoWithUserString,
    Stream2=c_script_15.geoWithUserString,
    Stream3=c_script_16.geoWithUserString)
stream_filter_4 = StreamFilter(
    Gate=city_amenities_one,
    Stream0=c_script_17.geoWithUserString,
    Stream1=c_script_18.geoWithUserString,
    Stream2=c_script_19.geoWithUserString,
    Stream3=c_script_20.geoWithUserString)
stream_filter_5 = StreamFilter(
    Gate=city_district_one,
    Stream0=c_script_3.geoWithUserString,
    Stream1=c_script_4.geoWithUserString,
    Stream2=c_script.geoWithUserString,
    Stream3=c_script_2.geoWithUserString)
stream_filter_6 = StreamFilter(Gate=city_district_one, Stream0=stream_filter_2, Stream1=stream_filter, Stream2=stream_filter_3, Stream3=stream_filter_4)

stream_filter_7 = StreamFilter(
    Gate=city_amenities_two,
    Stream0=c_script_37.geoWithUserString,
    Stream1=c_script_38.geoWithUserString,
    Stream2=c_script_39.geoWithUserString,
    Stream3=c_script_40.geoWithUserString)
stream_filter_8 = StreamFilter(
    Gate=city_amenities_two,
    Stream0=c_script_25.geoWithUserString,
    Stream1=c_script_26.geoWithUserString,
    Stream2=c_script_27.geoWithUserString,
    Stream3=c_script_28.geoWithUserString)
stream_filter_9 = StreamFilter(
    Gate=city_amenities_two,
    Stream0=c_script_29.geoWithUserString,
    Stream1=c_script_30.geoWithUserString,
    Stream2=c_script_31.geoWithUserString,
    Stream3=c_script_32.geoWithUserString)
stream_filter_10 = StreamFilter(
    Gate=city_amenities_two,
    Stream0=c_script_33.geoWithUserString,
    Stream1=c_script_34.geoWithUserString,
    Stream2=c_script_35.geoWithUserString,
    Stream3=c_script_36.geoWithUserString)
stream_filter_11 = StreamFilter(
    Gate=city_district_two,
    Stream0=c_script_7.geoWithUserString,
    Stream1=c_script_8.geoWithUserString,
    Stream2=c_script_5.geoWithUserString,
    Stream3=c_script_6.geoWithUserString)
stream_filter_12 = StreamFilter(
    Gate=city_district_two,
    Stream0=stream_filter_8,
    Stream1=stream_filter_7,
    Stream2=stream_filter_9,
    Stream3=stream_filter_10)

bbox = BoundingBox(
    Content=flatten([bang_5.Branch0, bang_6.Branch0, bang_7.Branch0, bang_8.Branch0, bang_5.Branch1, bang_6.Branch1, bang_5.Branch2, bang_8.Branch1]),
    Plane=PlaneXY(0, 0, 0),
    UnionBox=True)  # -> Box, Box_2
debrep = DeconstructBrep(Brep=bbox.Box)  # -> Faces, Edges, Vertices
area = Area(Geometry=debrep.Faces)  # -> Area, Centroid
sort = SortList(Keys=area.Area, ValuesA=debrep.Faces)  # -> Keys, reverse(ValuesA)
item = ListItem(List=sort.ValuesA, Index=0, Wrap=True)
dim = Dimensions(Surface=item)  # -> UDimension, VDimension
sqgrid = Square(Plane=PlaneXY(0, 0, 0), Size=dim.VDimension, ExtentX="2", ExtentY="2")  # -> simplify(Cells), simplify(Points)
item_2 = ListItem(List=sqgrid.Cells, Index=0, Wrap=True)  # -> Item, Item1
merge = Merge(Data1=item_2.Item, Data2=item_2.Item1)  # -> flatten(Result)
area_2 = Area(Geometry=item_2.Item)  # -> Area, Centroid
move = Move(Geometry=area_2.Centroid, Motion=Vector(0, 0, 10))  # -> Geometry, Transform
area_3 = Area(Geometry=item)  # -> Area, Centroid
ln = Line(StartPoint=area_2.Centroid, EndPoint=move.Geometry)
move_2 = Move(Geometry=area_3.Centroid, Motion=Vector(0, 0, 10))  # -> Geometry, Transform
midpt = CurveMiddle(Curve=ln)
X = UnitX(Factor=1)
ln_2 = Line(StartPoint=area_3.Centroid, EndPoint=move_2.Geometry)
move_3 = Move(Geometry=midpt, Motion=X)  # -> Geometry, Transform
midpt_2 = CurveMiddle(Curve=ln_2)
X_2 = UnitX(Factor=1)
pl_3pt = Plane3Pt(PointA=area_2.Centroid, PointB=move_3.Geometry, PointC=move.Geometry)
move_4 = Move(Geometry=midpt_2, Motion=X_2)  # -> Geometry, Transform
item_3 = ListItem(List=flatten(pl_3pt), Index=0, Wrap=True)  # -> Item, Item1
pl_3pt_2 = Plane3Pt(PointA=area_3.Centroid, PointB=move_4.Geometry, PointC=move_2.Geometry)

division = Division(A=dim.VDimension, B="2.2")
int = Integer(division)
dom = ConstructDomain(DomainStart=expr("-x", int), DomainEnd=int)
Z = UnitZ(Factor=expr("x-0.5", "20"))
rectangle = Rectangle(Plane=area_2.Centroid, XSize=dom, YSize=dom, Radius=0)  # -> Rectangle, Length
extr = Extrude(Base=rectangle.Rectangle, Direction=Z)
cap = CapHoles(Brep=extr)
mesh = Mesh(flatten(cap))

Z_2 = UnitZ(Factor=Z)
number_slider = Slider(0, range=0..1)

orient = Orient(Geometry=stream_filter_12, Source=pl_3pt_2, Target=item_3.Item1)  # -> Geometry, Transform
orient_2 = Orient(Geometry=stream_filter_11, Source=pl_3pt_2, Target=item_3.Item1)  # -> Geometry, Transform
mdif = MeshDifference(MeshesA=orient.Geometry, MeshesB=extr)  # -> simplify(Result)
mdif_2 = MeshDifference(MeshesA=orient_2.Geometry, MeshesB=extr)  # -> simplify(Result)
move_5 = Move(Geometry=mdif, Motion=Z_2)  # -> Geometry, Transform
move_6 = Move(Geometry=mdif_2, Motion=Z_2)  # -> Geometry, Transform
branch = TreeBranch(Tree=move_6.Geometry, Path=number_slider, MaintainPaths=True)
branch_2 = TreeBranch(Tree=move_5.Geometry, Path=number_slider, MaintainPaths=True)

orient_3 = Orient(Geometry=stream_filter_5, Source=pl_3pt_2, Target=item_3.Item)  # -> Geometry, Transform
orient_4 = Orient(Geometry=stream_filter_6, Source=pl_3pt_2, Target=item_3.Item)  # -> Geometry, Transform
mdif_3 = MeshDifference(MeshesA=orient_3.Geometry, MeshesB=extr)  # -> simplify(Result)
mdif_4 = MeshDifference(MeshesA=orient_4.Geometry, MeshesB=extr)  # -> simplify(Result)
move_7 = Move(Geometry=mdif_3, Motion=Z_2)  # -> Geometry, Transform
move_8 = Move(Geometry=mdif_4, Motion=Z_2)  # -> Geometry, Transform
branch_3 = TreeBranch(Tree=move_7.Geometry, Path=number_slider, MaintainPaths=True)
branch_4 = TreeBranch(Tree=move_8.Geometry, Path=number_slider, MaintainPaths=True)

txt_41 = Text(flatten(["227 Carlton Avenue", "229 Carlton Avenue", "231 Carlton Avenue", "233 Carlton Avenue", "46 South Oxford Street", "44 South Oxford Street"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]))
uaddress = ContextPrint(UAddressCityOne=txt_41)

# ----
# output geometry with k/v
context_bake = ContextBake(Buildings=branch_3)
context_bake_2 = ContextBake(Geometry=branch_4)
context_bake_3 = ContextBake(Buildings2=branch)
context_bake_4 = ContextBake(Geometry=branch_2)

# ----
# Brooklyn Housing Sales 2023 - Keys
txt_42 = Text(["ADDRESS", " SALE PRICE ", "YEAR BUILT"])
panel_5 = Panel(txt_42)

# ----
# Brooklyn Housing Sales 2023 - Values
txt_43 = Text(Tree({5}: ["30 BAY 10TH STREET", "0", "1930"], {6}: ["58 BAY 10TH STREET", "925000", "1930"], {7}: ["43 BAY 10TH STREET", "1275000", "1930"], {8}: ["43 BAY 11TH STREET", "825000", "1901"], {9}: ["1730 86TH STREET", "1505000", "1926"], {10}: ["1732 86TH STREET", "1650000", "1926"]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))

# ---- group: ZonaA-uAddress
txt_44 = Text(flatten(["227 Carlton Avenue", "229 Carlton Avenue", "231 Carlton Avenue", "233 Carlton Avenue", "46 South Oxford Street", "44 South Oxford Street"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]))

# ---- group: ZonaB-uAddress
txt_45 = Text(flatten([" ", "25 Kent Avenue", "North 12th Street North 12th Street", " ", "28 Wythe Avenue", " ", "96 Wythe Avenue", " ", " ", " ", "94 Wythe Avenue", "78 Wythe Avenue", "65 North 13th Street", "61 North 13th Street", "54A North 11th Street", "48 North 15th Street", "35 Kent Avenue", "22 North 15th Street", "17 Kent Avenue", "153 North 14th Street", "131 North 14th Street", "1 Kent Avenue", " ", " ", " ", " ", " ", " ", " ", " ", " ", " ", " ", " ", " ", " ", "94 North 13th Street", " ", "34 Berry Street", "26 Berry Street", "22 Berry Street", "21 Wythe Avenue", "208 North 14th Street", "196 North 14th Street", "195 North 14th Street", "190 North 14th Street", "105 North 13th Street", "4 Berry Street"]))

# ---- group: ZonaC-uAddress
txt_46 = Text(flatten(["311 Franklin Avenue", "157 Lexington Avenue", "315 Franklin Avenue", "385 Classon Avenue", "198 Clifton Place", "200 Clifton Place"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]))

# ---- group: ZonaD-uAddress
txt_47 = Text(flatten([" ", " ", " ", " ", "1217 East 17th Street", " ", " ", " ", " ", " "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]))

# ----
lng = ListLength(List=txt_47)

# ----
# City District One
panel_6 = Panel([txt_47, txt_46, txt_45, txt_44])

multiplication = Multiplication(A="400", B="400")
lng_2 = ListLength(List=branch_3)
series = Series(Start=0, Step=1, Count=lng_2)
