# Grasshopper definition dataM_M1-AR_v11.gh (Grasshopper 1.0.7)
# plug-ins: ShapeDiverForGrasshopper, Urbano, eleFront, Human

# ---- group: Fort Greene
latitude = Panel("40.689611")
longitude = Panel("-73.972182")

# ----
# Brooklyn Housing Sales 2023
txt = Text(Tree({0}: ["Brooklyn Rolling Sales.  All Sales From February 2023 - January 2024", "For sales prior to the Final Roll, Neighborhood Name and Descriptive Data reflect the most recent Final Roll.         Sales after the Final Roll, Neighborhood Name and Descriptive Data reflect current data.", "Building Class Category is based on Building Class at Time of Sale.", "Note: Condominium and cooperative sales are on the unit level and understood to have a count of one.", "BOROUGH", "3"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], {1}: ["", "", "", "", "NEIGHBORHOOD", "BATH BEACH"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], {2}: ["", "", "", "", "BUILDING CLASS CATEGORY", "01 ONE FAMILY DWELLINGS"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], {3}: ["", "", "", "", "TAX CLASS AT PRESENT", "1"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], {4}: ["", "", "", "", "BLOCK", "6360"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], {5}: ["", "", "", "", "LOT", "56"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]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))
panel = Panel("""0
1
2
3
4""")
flip = FlipMatrix(Data=txt)
path = DataPath(panel)
branch = TreeBranch(Tree=flip, Path="4", MaintainPaths=True)
split = SplitTree(Data=flip, Masks=flatten(path))  # -> Positive, Negative

# ---- group: Williamnsburg
latitude_2 = Panel("40.722786")
longitude_2 = Panel("-73.956761")

# ---- group: Bedstuy
latitude_3 = Panel("40.688391")
longitude_3 = Panel("-73.957656")

# ---- group: MidWood
latitude_4 = Panel("40.620731")
longitude_4 = Panel("-73.957656")

# ----
# Left Bound = (-73.951184(w/e) - 0.01)
# Right Bound = (40.7128(n/s) + 0.01)
# Top Bound = (40.7128(n/s) + (0.01 / 1.5))
# Bottom Bound = (-73.951184(w/e) - (0.01 / 1.5))
# 
# Lon = Average(Top Bound and Bottom Bound)
# Lat = Average(Left Bound and Right Bound)
lattitude = GetNumber(latitude_4, AtLeast=1, AtMost=1, Maximum=1.797693135e+308, Minimum=-1.797693135e+308, TreeAccess=False)
longitude_5 = GetNumber(longitude_4, AtLeast=1, AtMost=1, Maximum=1.797693135e+308, Minimum=-1.797693135e+308, TreeAccess=False)
python = GhPythonScript(lat=lattitude, lon=longitude_5)  # -> topBound, bottomBound, rightBound, leftBound
# ---------- python: Python ----------
import rhinoscriptsyntax as rs

leftBound = lon - 0.002
rightBound = lon + 0.002
topBound = lat + (0.002 / 1.5)
bottomBound = lat - (0.002 / 1.5)
# ---------- end python ----------

python_2 = GhPythonScript(lat=lattitude, lon=longitude_5)  # -> topBound, bottomBound, rightBound, leftBound; same code as python
text_join = TextJoin(Text=[python_2.leftBound, python_2.bottomBound, python_2.rightBound, python_2.topBound], Join=",")
data = Data(text_join)
bbox_left_bottom_right_top = Panel(data)
download_openstreetmap_osm = DownloadOpenStreetMapOSM(
    LeftBound=python.leftBound,
    RightBound=python.rightBound,
    TopBound=python.topBound,
    BottomBound=python.bottomBound,
    RunToggle=True)  # -> OSMQueryURL, OSMFilePath
sddp = ShapeDiverDocumentPayload({AbsoluteTolerance=0, AngleTolerance=0, DistanceDisplayPrecision=0, GltfVersion="Gltf2", GrasshopperVersion="1.0.0007", InputGroups="{}", OutputGroups="{}", RelativeTolerance=0, RhinoVersion="7.29.23107.3001", UnitSystem=0, VersionCreated="1.14.0.0", VersionSaved="1.14.0.0"})
data_2 = Data(bbox_left_bottom_right_top)
# Urbano Getting Amenities and Buildings
import_osm_features = ImportOSMFeatures(OSMPathOrURL=download_openstreetmap_osm.OSMQueryURL, OSMFeatureType="amenity", Format="xml", ImportAltitude=True)  # -> Points, Metadata, UTMZone, TranslationVector
import_osm_features_2 = ImportOSMFeatures(OSMPathOrURL=download_openstreetmap_osm.OSMQueryURL, OSMFeatureType="building", Format="xml", ImportAltitude=True)  # -> Points, Metadata, UTMZone, TranslationVector
import_osm_features_3 = ImportOSMFeatures(OSMPathOrURL=download_openstreetmap_osm.OSMQueryURL, OSMFeatureType="street", Format="xml", ImportAltitude=True)  # -> Points, Metadata, UTMZone, TranslationVector

# ----
# Streets
import_osm_features_4 = ImportOSMFeatures(OSMPathOrURL=download_openstreetmap_osm.OSMQueryURL, OSMFeatureType="street", Format="xml", ImportAltitude=True)  # -> Points, Metadata, UTMZone, TranslationVector
project = Project(Geometry=import_osm_features_4.Points, Plane=PlaneXY(0, 0, 0))  # -> Geometry, Transform
polyline = PolyLine(Vertices=project.Geometry, Closed=False)
create_street_network = CreateStreetNetwork(
    StreetCurves=flatten(polyline),
    Metadata=flatten(import_osm_features_4.Metadata),
    SplitStreetCurves=True,
    UTMZone=import_osm_features_4.UTMZone,
    TranslationVector=import_osm_features_4.TranslationVector)  # -> StreetNetwork, StreetSegmentCurves, UTMZone, TranslationVector

# ----
# Terrain
download_dem_and_build_terrain_mesh = DownloadDEMAndBuildTerrainMesh(
    LeftBound=python.leftBound,
    RightBound=python.rightBound,
    TopBound=python.topBound,
    BottomBound=python.bottomBound,
    XCount=100,
    YCount=100)  # -> TerrainMesh, UTMZone, TranslationVector

amenity = ValueList({"Parks": 0, "Playgrounds": 1, "Groceries": 2, "Restaurants": 3, "Public transport": 4, "Education": 5}, selected="Restaurants")
# { label: "Parks", value: 0 },
#   { label: "Education", value: 1},
#   { label: "Hospitality", value: 2 },
#   { label: "Transportation", value: 3 }
integer = Integer(amenity)
amenity_2 = GetInteger(integer, AtLeast=1, AtMost=1, Maximum=2147483647, Minimum=-2147483648, TreeAccess=False)
integer_2 = Integer(amenity_2)

panel_2 = Panel("""kindergarten
school
university
college""")
panel_3 = Panel("""supermarket
convenience""")
panel_4 = Panel("""bar
pub
cafe
restaurant""")
get_data_from_osm = GetDataFromOSM(T=data_2, txt="public_transport", txt_2="stop_position")  # -> out_2, in_2, feat_2
get_data_from_osm_2 = GetDataFromOSM(T=data_2, txt="leisure", txt_2="park")  # -> out_2, in_2, feat_2
get_data_from_osm_3 = GetDataFromOSM(T=data_2, txt="leisure", txt_2="playground")  # -> out_2, in_2, feat_2
get_data_from_osm_4 = GetDataFromOSM(T=data_2, txt="shop", txt_2=panel_3)  # -> out_2, in_2, feat_2
get_data_from_osm_5 = GetDataFromOSM(T=data_2, txt="amenity", txt_2=panel_4)  # -> out_2, in_2, feat_2
get_data_from_osm_6 = GetDataFromOSM(T=data_2, txt="amenity", txt_2=panel_2)  # -> out_2, in_2, feat_2
stream_filter = StreamFilter(
    Gate=integer_2,
    Stream0=get_data_from_osm_2.feat_2,
    Stream1=get_data_from_osm_3.feat_2,
    Stream2=get_data_from_osm_4.feat_2,
    Stream3=get_data_from_osm_5.feat_2,
    Stream4=get_data_from_osm.feat_2,
    Stream5=get_data_from_osm_6.feat_2)

import_osm_features_5 = ImportOSMFeatures(OSMPathOrURL=download_openstreetmap_osm.OSMQueryURL, OSMFeatureType=stream_filter, Format="xml", ImportAltitude=True)  # -> Points, Metadata, UTMZone, TranslationVector
point = Point(import_osm_features_5.Points)

colour_swatch = ColourSwatch(SwatchColor=RGB(27, 134, 247))
colour_swatch_2 = ColourSwatch(SwatchColor=RGB(51, 242, 54))
colour_swatch_3 = ColourSwatch(SwatchColor=RGB(176, 42, 163))

mesh_sphere = MeshSphere(Base=flatten(point), Radius="6", UCount=10, VCount=20)
lng = ListLength(List=mesh_sphere)

# ---- group: Get Park Geomtries
importosm = ImportOSMFeatures(OSMPathOrURL=download_openstreetmap_osm.OSMQueryURL, OSMFeatureType=stream_filter, Format="xml", ImportAltitude=False)  # -> Points, Metadata, UTMZone, TranslationVector
pline = PolyLine(Vertices=importosm.Points, Closed=True)
clean = CleanTree(RemoveNulls=True, RemoveInvalid=True, RemoveEmpty=True, Tree=pline)
demeta = DeconstructMetadata(Metadata=importosm.Metadata)  # -> simplify(Keys), simplify(Values)
tstat = TreeStatistics(Tree=clean)  # -> Paths, Length, Count
branch_2 = TreeBranch(Tree=importosm.Metadata, Path=tstat.Paths, MaintainPaths=True)
create_building = CreateBuilding(BuildingCurve=clean, Metadata=branch_2)
Z = UnitZ(Factor=1)
item = ListItem(List=demeta.Keys, Index="5", Wrap=True)
item_2 = ListItem(List=demeta.Values, Index="5", Wrap=True)
extr = Extrude(Base=create_building, Direction=Z)
cap = CapHoles(Brep=extr)
mesh = Mesh(cap)

# ----
geo = Geometry(graft(mesh_sphere))
dup = DuplicateData(Data=ColourSwatch(SwatchColor=RGB(240, 31, 31)), Number=lng, Order=True)  # -> simplify(graft(Data))
panel_5 = Panel(dup)
tstat_2 = TreeStatistics(Tree=mesh)  # -> Paths, Length, Count

lng_2 = ListLength(List=mesh_sphere)
dup_2 = DuplicateData(Data="education", Number=lng_2, Order=True)
dup_3 = DuplicateData(Data="college", Number=lng_2, Order=True)
dup_4 = DuplicateData(Data="transportation", Number=lng_2, Order=True)
dup_5 = DuplicateData(Data="bus-metro", Number=lng_2, Order=True)
dup_6 = DuplicateData(Data="restaurants", Number=lng_2, Order=True)
dup_7 = DuplicateData(Data="Hospitality", Number=lng_2, Order=True)

panel_6 = Panel("""8
19
16""")
item_3 = ListItem(List=split.Negative, Index=panel_6, Wrap=True)
item_4 = ListItem(List=branch, Index=panel_6, Wrap=True)
tstat_3 = TreeStatistics(Tree=item_3)  # -> Paths, Length, Count
concat = Concatenate(FragmentA="NYC-", FragmentB=item_4)  # -> flatten(Result)
dup_8 = DuplicateData(Data=concat, Number=tstat_3.Count, Order=True)  # -> simplify(Data)

# ---- group: Building All Color
colour_swatch_4 = ColourSwatch(SwatchColor=RGB(166, 166, 166))

# ----
dup_9 = DuplicateData(Data="Color", Number=lng, Order=True)  # -> simplify(graft(Data))
ef_att = EleFrontAttributes(Keys=dup_9, Values=dup)  # -> Attributes, Keys, Values, Name, Layer, ColourSource, DisplayColour, MaterialSource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
attatt = AttachAttributes(Geometry=geo, Attributes=ef_att.Attributes)
bake = BakeObjects(Geometry=attatt, Attributes=ef_att.Attributes, Bake=Button(), createGroups=False)  # -> Message, Guids
partition = PartitionList(List=dup_8, Size="3")

# ---- group: Intention
txt_2 = Text("""HousingPulse
Data Analytics for Housing Accessibility Assessment: 

Analyze large datasets, including demographic data, building codes, and geographic information, to assess the accessibility of housing stock at a city or regional level. By identifying areas with inadequate accessibility infrastructure or high concentrations of inaccessible housing units, policymakers can prioritize targeted interventions and investments to improve accessibility.

Also identify possible retrofitting and abandoned lots (private or public) for possible gorilla action take over. """)

# ----
# HousingPulse
panel_7 = Panel(txt_2)
# Add Attributes
layertable = LayerTable(Update=True, AutoUpdate=False)  # -> Layers, FullLayerPaths, LayerColors, Linetypes, MaterialNames, Visible, PrintWidth, PrintColor
cull_i = CullIndex(List=layertable.FullLayerPaths, Indices="0", Wrap=True)
partition_2 = PartitionList(List=cull_i, Size="5")  # -> simplify(Chunks)
txt_3 = Text(partition_2)
bang = ExplodeTree(Data=txt_3)  # -> Branch0, Branch1, Branch2, Branch3
reflay = ReferenceByLayer(LayerName=bang.Branch0, lightweight=False, DisableAutoUpdate=False)
reflay_2 = ReferenceByLayer(LayerName=bang.Branch1, lightweight=False, DisableAutoUpdate=False)
reflay_3 = ReferenceByLayer(LayerName=bang.Branch2, lightweight=False, DisableAutoUpdate=False)
reflay_4 = ReferenceByLayer(LayerName=bang.Branch3, lightweight=False, DisableAutoUpdate=False)
bang_2 = ExplodeTree(Data=reflay)  # -> Branch0, Branch1, Branch2, Branch3, Branch4
bang_3 = ExplodeTree(Data=reflay_2)  # -> Branch0, Branch1, Branch2, Branch3, Branch4
bang_4 = ExplodeTree(Data=reflay_3)  # -> Branch0, Branch1, Branch2, Branch3, Branch4
bang_5 = ExplodeTree(Data=reflay_4)  # -> Branch0, Branch1, Branch2, Branch3, Branch4

# ---- group: Build Basic Model
# Turn on build toggle
polyline_2 = PolyLine(Vertices=import_osm_features_3.Points, Closed=False)
create_amenity = CreateAmenity(PointLocationOfAmenity=import_osm_features.Points, Metadata=import_osm_features.Metadata)
polyline_3 = PolyLine(Vertices=import_osm_features_2.Points, Closed=False)
create_street_network_2 = CreateStreetNetwork(
    StreetCurves=flatten(polyline_2),
    Metadata=flatten(import_osm_features_3.Metadata),
    SplitStreetCurves=True,
    UTMZone=import_osm_features_3.UTMZone,
    TranslationVector=import_osm_features_3.TranslationVector)  # -> StreetNetwork, StreetSegmentCurves, UTMZone, TranslationVector
arrange_amenities_by_building = ArrangeAmenitiesByBuilding(Amenities=flatten(create_amenity), Buildings=flatten(polyline_3))  # -> AmenitiesByBuilding, Buildings
create_building_2 = CreateBuilding(
    BuildingCurve=arrange_amenities_by_building.Buildings,
    Metadata=import_osm_features_2.Metadata,
    AmenitiesInBuilding=arrange_amenities_by_building.AmenitiesByBuilding)

# ----
project_2 = Project(Geometry=create_building_2, Plane=PlaneXY(0, 0, 0))  # -> Geometry, Transform

# ---- group: Build Basic Model (continued)
build_urbano_model = BuildUrbanoModel(Buildings=project_2.Geometry, StreetNetwork=create_street_network_2.StreetNetwork, BuildToggle=True)  # -> UrbanoModel, flatten(BuildingCurves), Activities
inspect_building = InspectBuilding(Building=project_2.Geometry, DefaultHeight=10)  # -> Geometry, Metadata, Amenity, BuildingMesh

# ----
demeta_2 = DeconstructMetadata(Metadata=inspect_building.Metadata)  # -> simplify(Keys), simplify(Values)
geo_2 = Geometry(inspect_building.BuildingMesh)
merge = Merge(Data1=geo_2, Data2=demeta_2.Keys, Data3=demeta_2.Values)
lng_3 = ListLength(List=demeta_2.Keys)
split_2 = SplitList(List=merge, Index="1")  # -> ListA, ListB
split_3 = SplitList(List=split_2.ListB, Index=lng_3)  # -> ListA, ListB

txt_4 = Text(demeta_2.Keys)
txt_5 = Text(demeta_2.Keys)
expression = Expression(x=txt_4, y="addr:housenumber", Expression="Contains(x,y)")
expression_2 = Expression(x=txt_5, y="addr:street", Expression="Contains(x,y)")
cull = CullPattern(List=demeta_2.Values, CullPattern=expression)
cull_2 = CullPattern(List=demeta_2.Values, CullPattern=expression_2)
merge_2 = Merge(Data1=cull, Data2=cull_2)
item_5 = ListItem(List=merge_2, Index=0, Wrap=True)  # -> Item, Item1
tstat_4 = TreeStatistics(Tree=merge_2)  # -> Paths, Length, Count
dup_10 = DuplicateData(Data="Uaddress", Number=tstat_4.Count, Order=True)  # -> simplify(graft(Data))
concat_2 = Concatenate(FragmentA=item_5.Item, FragmentB=" ", FragmentC=item_5.Item1)

dup_11 = DuplicateData(Data="Color", Number=tstat_4.Count, Order=True)  # -> simplify(graft(Data))
dup_12 = DuplicateData(Data=colour_swatch_4, Number=tstat_4.Count, Order=True)  # -> simplify(graft(Data))
merge_3 = Merge(Data1=concat_2, Data2=dup_12)
merge_4 = Merge(Data1=dup_10, Data2=dup_11)
merge_5 = Merge(Data1=concat_2, Data2=dup_12)
ef_att_2 = EleFrontAttributes(Keys=merge_4, Values=merge_5)  # -> Attributes, Keys, Values, Name, Layer, ColourSource, DisplayColour, MaterialSource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
geo_3 = Geometry(graft(geo_2))
attatt_2 = AttachAttributes(Geometry=geo_3, Attributes=ef_att_2.Attributes)

context_print = ContextPrint(RollingsalesBKTitles=branch)
context_print_2 = ContextPrint(RollingsalesBK=split.Negative)
context_bake = ContextBake(Buildings=inspect_building.BuildingMesh)
context_print_3 = ContextPrint(README=txt_2)
context_print_4 = ContextPrint(Amenity=build_urbano_model.Activities)
context_bake_2 = ContextBake(Geometry=download_dem_and_build_terrain_mesh.TerrainMesh)
context_bake_3 = ContextBake(Geometry=create_street_network.StreetSegmentCurves)
context_bake_4 = ContextBake(Geometry=build_urbano_model.BuildingCurves)
context_print_5 = ContextPrint(Text=demeta_2.Keys)
context_print_6 = ContextPrint(Text=demeta_2.Values)

bake_2 = BakeObjects(Geometry=attatt_2, Attributes=ef_att_2.Attributes, Bake=Button(), createGroups=False)  # -> Message, Guids
panel_8 = Panel(attatt_2)

# ==== cluster GetDataFromOSM
T = ClusterInput()
txt = ClusterInput()
txt_2 = ClusterInput()
txt_3 = ClusterInput()
txt_4 = Text(txt_2)
txt_5 = Text(txt_3)
txt_6 = Text(txt)
lng = ListLength(List=txt_6)
equals = Equality(FirstNumber=lng, SecondNumber="1")  # -> Equality, Inequality
concat = Concatenate(FragmentD=" modv=\"not\"", FragmentA=" v=\"", FragmentB=txt_5, FragmentC="\"")
concat_2 = Concatenate(FragmentA=" v=\"", FragmentB=txt_4, FragmentC="\"")
null = NullItem(Item=txt_4)  # -> NullFlags, InvalidFlags, Description
null_2 = NullItem(Item=txt_5)  # -> NullFlags, InvalidFlags, Description
split = TextSplit(Text=T, Separators=",")
filter = StreamFilter(Gate=null.NullFlags, Stream0=concat_2)
filter_2 = StreamFilter(Gate=null_2.NullFlags, Stream0=concat)
item = ListItem(List=split, Index=0, Wrap=True)  # -> Item, Item1, Item2, Item3
panel = Panel("""node
way
relation""")
merge = Merge(Data1=item.Item1, Data2=item.Item, Data3=item.Item3, Data4=item.Item2)  # -> flatten(Result)
merge_2 = Merge(Data1=filter, Data2=filter_2)  # -> flatten(Result)
concat_3 = Concatenate(
    FragmentA="<query type=\"",
    FragmentB=panel,
    FragmentC="\"><has-kv k=\"",
    FragmentD=txt_6,
    FragmentE="\"",
    FragmentF=graft(merge_2),
    FragmentG="/></query>")
join = TextJoin(Text=merge, Join=",")
lng_2 = ListLength(List=merge)
equals_2 = Equality(FirstNumber="4", SecondNumber=lng_2)  # -> Equality, Inequality
join_2 = TextJoin(Text=concat_3)  # -> flatten(Result)
join_3 = TextJoin(Text=join_2)
panel_2 = Panel("""<union>
<item/>
<recurse type="down"/>
</union>
<print mode="body"/>
</osm-script>""")
concat_4 = Concatenate(FragmentA="<union>", FragmentB=join_3, FragmentC="</union>")
concat_5 = Concatenate(FragmentA="<osm-script output=\"xml\" timeout=\"100\" bbox=\"", FragmentB=join, FragmentC="\">")
concat_6 = Concatenate(FragmentA=concat_5, FragmentD=concat_4, FragmentC=panel_2)
p_n_c = PickNChoose(Pattern=equals.Equality, Stream0="insert one and only key", Stream1=concat_6)
filter_3 = StreamFilter(Gate=equals_2.Equality, Stream1=p_n_c)
concat_7 = Concatenate(FragmentA="http://overpass-api.de/api/interpreter?data=", FragmentB=filter_3)
key = Text(txt)
out = Text(filter_3)
feat = Text(key)
in = Text(concat_7)
in_2 = ClusterOutput(in)
out_2 = ClusterOutput(out)
feat_2 = ClusterOutput(feat)
