# Grasshopper definition geometry_copies2.gh (Grasshopper 1.0.7)
# plug-ins: eleFront, Human

# ---- group: Drop Downs City One
city_amenities_one = GetInteger(Slider(0, range=0..3), AtLeast=1, AtMost=1, Maximum=2147483647, Minimum=-2147483648, TreeAccess=False)
city_district_one = GetInteger(Slider(0, range=0..3), AtLeast=1, AtMost=1, Maximum=2147483647, Minimum=-2147483648, TreeAccess=False)

# ---- group: Drop Downs City Two
city_district_two = GetInteger(Slider(2, range=0..3), AtLeast=1, AtMost=1, Maximum=2147483647, Minimum=-2147483648, TreeAccess=False)
city_amenities_two = GetInteger(Slider(3, range=0..3), AtLeast=1, AtMost=1, Maximum=2147483647, Minimum=-2147483648, TreeAccess=False)

# ---- group: just to test
path = FilePath("C:\Users\ARoncal\OneDrive - Thornton Tomasetti, Inc\__License Resources\Desktop\datamgnt\bimsc24-final-project\src\submissions\andresroncal\assets\Programs massing.3dm")  # disabled

# ----
python = GhPythonScript(FP=path)  # -> out, geom, layerIndex, layers, layerColor; disabled
# ---------- python: Python ----------
import System
import Rhino

#load Rhino file from string, or from local path
try:
    b64 = System.Convert.FromBase64String(data)
    _dmfile = Rhino.FileIO.File3dm.FromByteArray(b64)
except:
    _dmfile = Rhino.FileIO.File3dm.Read(FP)
    print _dmfile



objtable = _dmfile.Objects
geom = []
geomLayerIndexList = []

#get objects from document
for obj in objtable:
    
    if not isinstance(obj.Geometry,Rhino.Geometry.InstanceReferenceGeometry):
        #get user strings from document and assign to geometry
        for k in obj.Attributes.GetUserStrings().AllKeys:
            value =  obj.Attributes.GetUserString(k)
            obj.Geometry.SetUserString(k, value)
       
        geom.append(obj.Geometry)
        geomLayerIndexList.append(obj.Attributes.LayerIndex)
        

geom_= geom
layerIndex_ = geomLayerIndexList

#get layer information
layers = []
layerColor = []
for l in _dmfile.Layers:
    layerColor.append(l.Color)
    layers.append(l)
    
    
layers_ = layers
layerColor_  = layerColor
# ---------- end python ----------
cset = CreateSet(List=python.layerIndex)  # -> Set, Map; disabled
cset_2 = CreateSet(List=cset.Map)  # -> Set, Map; disabled
mindex = MemberIndex(Set=cset.Map, Member=cset_2.Set)  # -> Index, Count; disabled
item = ListItem(List=python.geom, Index=mindex.Index, Wrap=True)  # -> simplify(Item); disabled

# ---- group: ZoneA
geo = Geometry(simplify(Tree({0;0}: [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], {0;1}: [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], {0;2}: [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], {0;3}: [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], {0;4}: [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])))

# ---- group: ZoneB
geo_2 = Geometry(simplify(Tree({1;0}: [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], {1;1}: [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], {1;2}: [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], {1;3}: [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], {1;4}: [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])))

# ---- group: ZoneC
geo_3 = Geometry(simplify(Tree({2;0}: [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], {2;1}: [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], {2;2}: [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], {2;3}: [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], {2;4}: [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])))

# ---- group: ZoneD
geo_4 = Geometry(simplify(Tree({0}: [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], {1}: [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], {2}: [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], {3}: [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], {4}: [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])))

# ----
layertable = LayerTable(Update=True, AutoUpdate=False)  # -> Layers, FullLayerPaths, LayerColors, Linetypes, MaterialNames, Visible, PrintWidth, PrintColor; disabled
panel = Panel("0")  # disabled
cull_i = CullIndex(List=layertable.FullLayerPaths, Indices=panel, Wrap=True)  # disabled
panel_2 = Panel("5")  # disabled
partition = PartitionList(List=cull_i, Size=panel_2)  # -> simplify(Chunks); disabled
txt = Text(partition)  # disabled
bang = ExplodeTree(Data=txt)  # -> Branch0, Branch1, Branch2, Branch3, Branch4; disabled
reflay = ReferenceByLayer(LayerName=bang.Branch2, lightweight=False, DisableAutoUpdate=False)  # -> simplify(Geometry); disabled
reflay_2 = ReferenceByLayer(LayerName=bang.Branch3, lightweight=False, DisableAutoUpdate=False)  # -> simplify(Geometry); disabled
reflay_3 = ReferenceByLayer(LayerName=bang.Branch0, lightweight=False, DisableAutoUpdate=False)  # -> simplify(Geometry); disabled
reflay_4 = ReferenceByLayer(LayerName=bang.Branch1, lightweight=False, DisableAutoUpdate=False)  # -> simplify(Geometry); disabled
bang_2 = ExplodeTree(Data=reflay)  # -> Branch0, Branch1, Branch2, Branch3, Branch4; disabled
bang_3 = ExplodeTree(Data=reflay_2)  # -> Branch0, Branch1, Branch2, Branch3, Branch4; disabled
bang_4 = ExplodeTree(Data=reflay_4)  # -> Branch0, Branch1, Branch2, Branch3, Branch4; disabled
bang_5 = ExplodeTree(Data=reflay_3)  # -> Branch0, Branch1, Branch2, Branch3, Branch4; disabled
getkv = GetAllKeysValues(AttributesOrAttributedGeometry=bang_3.Branch4)  # -> Keys, Values, BakeName; disabled
mesh = Mesh(bang_3.Branch4)  # disabled
panel_3 = Panel("Color")  # disabled
txt_2 = Text(getkv.Keys)  # disabled
expression = Expression(x=txt_2, y=panel_3, Expression="Contains(x,y)")  # disabled
cull = CullPattern(List=getkv.Values, CullPattern=expression)  # -> simplify(List); disabled
cull_2 = CullPattern(List=getkv.Keys, CullPattern=expression)  # -> simplify(List); disabled

bang_6 = ExplodeTree(Data=geo)  # -> Branch0, Branch1, Branch2, Branch3, Branch4
bang_7 = ExplodeTree(Data=geo_2)  # -> Branch0, Branch1, Branch2, Branch3, Branch4
bang_8 = ExplodeTree(Data=geo_3)  # -> Branch0, Branch1, Branch2, Branch3, Branch4
bang_9 = ExplodeTree(Data=geo_4)  # -> Branch0, Branch1, Branch2, Branch3, Branch4
bang_10 = ExplodeTree(Data=geo)  # -> Branch0, Branch1, Branch2, Branch3, Branch4
bang_11 = ExplodeTree(Data=geo_2)  # -> Branch0, Branch1, Branch2, Branch3, Branch4
bang_12 = ExplodeTree(Data=geo_3)  # -> Branch0, Branch1, Branch2, Branch3, Branch4
bang_13 = ExplodeTree(Data=geo_4)  # -> Branch0, Branch1, Branch2, Branch3, Branch4

# ---- group: ZoneA-v
txt_3 = Text(flatten(["166,166,166", "166,166,166", "166,166,166", "166,166,166", "166,166,166", "166,166,166"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]))

# ---- group: ZoneC-v
txt_4 = Text(flatten(["166,166,166", "166,166,166", "166,166,166", "166,166,166", "166,166,166", "166,166,166"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]))

# ---- group: ZoneD-v
txt_5 = Text(flatten(["166,166,166", "166,166,166", "166,166,166", "166,166,166", "166,166,166", "166,166,166", "166,166,166", "166,166,166", "166,166,166", "166,166,166"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]))

# ---- group: ZoneB-v
txt_6 = Text(flatten(["166,166,166", "166,166,166", "166,166,166", "166,166,166", "166,166,166", "166,166,166", "166,166,166", "166,166,166", "166,166,166", "166,166,166", "166,166,166", "166,166,166", "166,166,166", "166,166,166", "166,166,166", "166,166,166", "166,166,166", "166,166,166", "166,166,166", "166,166,166", "166,166,166", "166,166,166", "166,166,166", "166,166,166", "166,166,166", "166,166,166", "166,166,166", "166,166,166", "166,166,166", "166,166,166", "166,166,166", "166,166,166", "166,166,166", "166,166,166", "166,166,166", "166,166,166", "166,166,166", "166,166,166", "166,166,166", "166,166,166", "166,166,166", "166,166,166", "166,166,166", "166,166,166", "166,166,166", "166,166,166", "166,166,166", "166,166,166"]))

# ----
# add color b
panel_4 = Panel("Color")
uservalue = Text(txt_3)
uservalue_2 = Text(txt_4)
uservalue_3 = Text(txt_5)
uservalue_4 = Text(txt_6)
userkey = Text(panel_4)
userkey_2 = Text("Color")
userkey_3 = Text("Color")
userkey_4 = Text("Color")
c_script = CSharpScript(geometry=bang_12.Branch0, userKey=userkey_2, userValue=uservalue_2)  # -> out, geoWithUserString; inputs geometry: GeometryBase, userKey: String, userValue: String
# ---------- c_script: C# ----------
    geometry.SetUserString(userKey, userValue);
   geoWithUserString = geometry;
# ---------- end c_script ----------
c_script_2 = CSharpScript(geometry=bang_13.Branch0, userKey=userkey_3, userValue=uservalue_3)  # -> out, geoWithUserString; inputs geometry: GeometryBase, userKey: String, userValue: String; same code as c_script
c_script_3 = CSharpScript(geometry=bang_10.Branch0, userKey=userkey, userValue=uservalue)  # -> out, geoWithUserString; inputs geometry: GeometryBase, userKey: String, userValue: String; same code as c_script
c_script_4 = CSharpScript(geometry=bang_11.Branch0, userKey=userkey_4, userValue=uservalue_4)  # -> out, geoWithUserString; inputs geometry: GeometryBase, userKey: String, userValue: String; same code as c_script
python_2 = GhPythonScript(geoms=c_script.geoWithUserString, user_key="Color")  # -> out, user_values; inputs geoms: list of GeometryBase
# ---------- python_2: Python ----------
user_values = []

for g in geoms:
    user_values.append( g.GetUserString(user_key))


user_values_ = user_values
# ---------- end python_2 ----------
python_3 = GhPythonScript(geoms=c_script_2.geoWithUserString, user_key="Color")  # -> out, user_values; inputs geoms: list of GeometryBase; same code as python_2
python_4 = GhPythonScript(geoms=c_script_3.geoWithUserString, user_key=panel_4)  # -> out, user_values; inputs geoms: list of GeometryBase; same code as python_2
python_5 = GhPythonScript(geoms=c_script_4.geoWithUserString, user_key="Color")  # -> out, user_values; inputs geoms: list of GeometryBase; same code as python_2

# ---- group: ZoneA-v
txt_7 = Text(flatten(["166,166,166", "166,166,166", "166,166,166", "166,166,166", "166,166,166", "166,166,166"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]))

# ---- group: ZoneC-v
txt_8 = Text(flatten(["166,166,166", "166,166,166", "166,166,166", "166,166,166", "166,166,166", "166,166,166"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]))

# ---- group: ZoneD-v
txt_9 = Text(flatten(["166,166,166", "166,166,166", "166,166,166", "166,166,166", "166,166,166", "166,166,166", "166,166,166", "166,166,166", "166,166,166", "166,166,166"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]))

# ---- group: ZoneB-v
txt_10 = Text(flatten(["166,166,166", "166,166,166", "166,166,166", "166,166,166", "166,166,166", "166,166,166", "166,166,166", "166,166,166", "166,166,166", "166,166,166", "166,166,166", "166,166,166", "166,166,166", "166,166,166", "166,166,166", "166,166,166", "166,166,166", "166,166,166", "166,166,166", "166,166,166", "166,166,166", "166,166,166", "166,166,166", "166,166,166", "166,166,166", "166,166,166", "166,166,166", "166,166,166", "166,166,166", "166,166,166", "166,166,166", "166,166,166", "166,166,166", "166,166,166", "166,166,166", "166,166,166", "166,166,166", "166,166,166", "166,166,166", "166,166,166", "166,166,166", "166,166,166", "166,166,166", "166,166,166", "166,166,166", "166,166,166", "166,166,166", "166,166,166"]))

# ----
# add color b
panel_5 = Panel("Color")
uservalue_5 = Text(txt_7)
uservalue_6 = Text(txt_8)
uservalue_7 = Text(txt_9)
uservalue_8 = Text(txt_10)
userkey_5 = Text(panel_5)
userkey_6 = Text("Color")
userkey_7 = Text("Color")
userkey_8 = Text("Color")
c_script_5 = CSharpScript(geometry=bang_8.Branch0, userKey=userkey_6, userValue=uservalue_6)  # -> out, geoWithUserString; inputs geometry: GeometryBase, userKey: String, userValue: String; same code as c_script
c_script_6 = CSharpScript(geometry=bang_9.Branch0, userKey=userkey_7, userValue=uservalue_7)  # -> out, geoWithUserString; inputs geometry: GeometryBase, userKey: String, userValue: String; same code as c_script
c_script_7 = CSharpScript(geometry=bang_6.Branch0, userKey=userkey_5, userValue=uservalue_5)  # -> out, geoWithUserString; inputs geometry: GeometryBase, userKey: String, userValue: String; same code as c_script
c_script_8 = CSharpScript(geometry=bang_7.Branch0, userKey=userkey_8, userValue=uservalue_8)  # -> out, geoWithUserString; inputs geometry: GeometryBase, userKey: String, userValue: String; same code as c_script
python_6 = GhPythonScript(geoms=c_script_5.geoWithUserString, user_key="Color")  # -> out, user_values; inputs geoms: list of GeometryBase; same code as python_2
python_7 = GhPythonScript(geoms=c_script_6.geoWithUserString, user_key="Color")  # -> out, user_values; inputs geoms: list of GeometryBase; same code as python_2
python_8 = GhPythonScript(geoms=c_script_7.geoWithUserString, user_key=panel_5)  # -> out, user_values; inputs geoms: list of GeometryBase; same code as python_2
python_9 = GhPythonScript(geoms=c_script_8.geoWithUserString, user_key="Color")  # -> out, user_values; inputs geoms: list of GeometryBase; same code as python_2

bang_14 = ExplodeTree(Data=item)  # -> Branch0, Branch1, Branch2, Branch3, Branch4, Branch5, Branch6, Branch7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; disabled
bang_15 = ExplodeTree(Data=item)  # -> Branch0, Branch1, Branch2, Branch3, Branch4, Branch5, Branch6, Branch7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; disabled
mesh_2 = Mesh(bang_14.Branch19)  # disabled
stream_filter = StreamFilter(
    Gate=city_amenities_two,
    Stream0=bang_14.Branch6,
    Stream1=bang_14.Branch7,
    Stream2=bang_14.Branch8,
    Stream3=bang_14.Branch9)  # disabled
stream_filter_2 = StreamFilter(
    Gate=city_amenities_two,
    Stream0=bang_14.Branch1,
    Stream1=bang_14.Branch2,
    Stream2=bang_14.Branch3,
    Stream3=bang_14.Branch4)  # disabled
stream_filter_3 = StreamFilter(
    Gate=city_amenities_two,
    Stream0=bang_14.Branch11,
    Stream1=bang_14.Branch12,
    Stream2=bang_14.Branch13,
    Stream3=bang_14.Branch14)  # disabled
stream_filter_4 = StreamFilter(
    Gate=city_amenities_two,
    Stream0=bang_14.Branch16,
    Stream1=bang_14.Branch18,
    Stream2=bang_14.Branch17,
    Stream3=bang_14.Branch18)  # disabled
stream_filter_5 = StreamFilter(
    Gate=city_district_two,
    Stream0=bang_14.Branch0,
    Stream1=bang_14.Branch5,
    Stream2=bang_14.Branch10,
    Stream3=bang_14.Branch15)  # disabled
stream_filter_6 = StreamFilter(Gate=city_district_two, Stream0=stream_filter_2, Stream1=stream_filter, Stream2=stream_filter_3, Stream3=stream_filter_4)  # disabled

# ---- group: ParksA-v
txt_11 = Text(flatten(["51,242,54", "51,242,54", "51,242,54", "51,242,54", "51,242,54", "51,242,54", "51,242,54", "51,242,54", "51,242,54", "51,242,54"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]))

# ---- group: ParksC-v
txt_12 = Text(flatten(["51,242,54", "51,242,54", "51,242,54", "51,242,54", "51,242,54", "51,242,54", "51,242,54", "51,242,54", "51,242,54", "51,242,54", "51,242,54"]))

# ---- group: ParksD-v
txt_13 = Text(flatten(["51,242,54", "51,242,54", "51,242,54", "51,242,54", "51,242,54", "51,242,54", "51,242,54", "51,242,54", "51,242,54", "51,242,54", "51,242,54", "51,242,54", "51,242,54", "51,242,54", "51,242,54", "51,242,54", "51,242,54"]))

# ---- group: ParksB-v
txt_14 = Text(flatten(["51,242,54", "51,242,54", "51,242,54", "51,242,54", "51,242,54"]))

# ---- group: EducationA-v
txt_15 = Text(flatten(["176,42,163", "176,42,163", "176,42,163", "176,42,163", "176,42,163", "176,42,163", "176,42,163", "176,42,163", "176,42,163", "176,42,163", "176,42,163", "176,42,163", "176,42,163", "176,42,163", "176,42,163", "176,42,163", "176,42,163", "176,42,163", "176,42,163", "176,42,163", "176,42,163", "176,42,163", "176,42,163", "176,42,163", "176,42,163", "176,42,163", "176,42,163", "176,42,163", "176,42,163", "176,42,163"]))

# ---- group: HospitalityA-v
txt_16 = Text(flatten(["27,134,247", "27,134,247", "27,134,247", "27,134,247", "27,134,247", "27,134,247", "27,134,247", "27,134,247", "27,134,247", "27,134,247", "27,134,247", "27,134,247", "27,134,247", "27,134,247", "27,134,247", "27,134,247", "27,134,247", "27,134,247", "27,134,247", "27,134,247", "27,134,247", "27,134,247", "27,134,247", "27,134,247", "27,134,247", "27,134,247", "27,134,247", "27,134,247", "27,134,247", "27,134,247", "27,134,247", "27,134,247"]))

# ---- group: TransportationA-v
txt_17 = Text(flatten(["240,31,31", "240,31,31", "240,31,31"]))

# ----
# add color a
panel_6 = Panel("Color")
uservalue_9 = Text(txt_11)
userkey_9 = Text(panel_6)
uservalue_10 = Text(txt_15)
uservalue_11 = Text(txt_16)
uservalue_12 = Text(txt_17)
userkey_10 = Text("Color")
userkey_11 = Text("Color")
userkey_12 = Text("Color")
c_script_9 = CSharpScript(geometry=bang_10.Branch1, userKey=userkey_9, userValue=uservalue_9)  # -> out, geoWithUserString; inputs geometry: GeometryBase, userKey: String, userValue: String; same code as c_script
c_script_10 = CSharpScript(geometry=bang_10.Branch2, userKey=userkey_10, userValue=uservalue_10)  # -> out, geoWithUserString; inputs geometry: GeometryBase, userKey: String, userValue: String; same code as c_script
c_script_11 = CSharpScript(geometry=bang_10.Branch3, userKey=userkey_11, userValue=uservalue_11)  # -> out, geoWithUserString; inputs geometry: GeometryBase, userKey: String, userValue: String; same code as c_script
c_script_12 = CSharpScript(geometry=bang_10.Branch4, userKey=userkey_12, userValue=uservalue_12)  # -> out, geoWithUserString; inputs geometry: GeometryBase, userKey: String, userValue: String; same code as c_script
python_10 = GhPythonScript(geoms=c_script_9.geoWithUserString, user_key=panel_6)  # -> out, user_values; inputs geoms: list of GeometryBase; same code as python_2
python_11 = GhPythonScript(geoms=c_script_10.geoWithUserString, user_key="Color")  # -> out, user_values; inputs geoms: list of GeometryBase; same code as python_2
python_12 = GhPythonScript(geoms=c_script_11.geoWithUserString, user_key="Color")  # -> out, user_values; inputs geoms: list of GeometryBase; same code as python_2
python_13 = GhPythonScript(geoms=c_script_12.geoWithUserString, user_key="Color")  # -> out, user_values; inputs geoms: list of GeometryBase; same code as python_2

# ---- group: EducationC-v
txt_18 = Text(flatten("176,42,163"))

# ---- group: HospitalityC-v
txt_19 = Text(flatten(["27,134,247", "27,134,247", "27,134,247", "27,134,247", "27,134,247", "27,134,247", "27,134,247", "27,134,247", "27,134,247", "27,134,247", "27,134,247", "27,134,247", "27,134,247", "27,134,247", "27,134,247", "27,134,247", "27,134,247", "27,134,247", "27,134,247", "27,134,247", "27,134,247", "27,134,247", "27,134,247", "27,134,247", "27,134,247", "27,134,247"]))

# ---- group: TransportationC-v
txt_20 = Text(flatten(["240,31,31", "240,31,31", "240,31,31", "240,31,31", "240,31,31", "240,31,31", "240,31,31", "240,31,31", "240,31,31", "240,31,31", "240,31,31", "240,31,31", "240,31,31", "240,31,31", "240,31,31", "240,31,31", "240,31,31", "240,31,31"]))

# ----
uservalue_13 = Text(txt_12)
userkey_13 = Text("Color")
uservalue_14 = Text(txt_18)
uservalue_15 = Text(txt_19)
userkey_14 = Text("Color")
userkey_15 = Text("Color")
uservalue_16 = Text(txt_20)
userkey_16 = Text("Color")
c_script_13 = CSharpScript(geometry=bang_12.Branch1, userKey=userkey_13, userValue=uservalue_13)  # -> out, geoWithUserString; inputs geometry: GeometryBase, userKey: String, userValue: String; same code as c_script
c_script_14 = CSharpScript(geometry=bang_12.Branch2, userKey=userkey_14, userValue=uservalue_14)  # -> out, geoWithUserString; inputs geometry: GeometryBase, userKey: String, userValue: String; same code as c_script
c_script_15 = CSharpScript(geometry=bang_12.Branch3, userKey=userkey_15, userValue=uservalue_15)  # -> out, geoWithUserString; inputs geometry: GeometryBase, userKey: String, userValue: String; same code as c_script
c_script_16 = CSharpScript(geometry=bang_12.Branch4, userKey=userkey_16, userValue=uservalue_16)  # -> out, geoWithUserString; inputs geometry: GeometryBase, userKey: String, userValue: String; same code as c_script
python_14 = GhPythonScript(geoms=c_script_13.geoWithUserString, user_key="Color")  # -> out, user_values; inputs geoms: list of GeometryBase; same code as python_2
python_15 = GhPythonScript(geoms=c_script_14.geoWithUserString, user_key="Color")  # -> out, user_values; inputs geoms: list of GeometryBase; same code as python_2
python_16 = GhPythonScript(geoms=c_script_15.geoWithUserString, user_key="Color")  # -> out, user_values; inputs geoms: list of GeometryBase; same code as python_2
python_17 = GhPythonScript(geoms=c_script_16.geoWithUserString, user_key="Color")  # -> out, user_values; inputs geoms: list of GeometryBase; same code as python_2

# ---- group: EducationD-v
txt_21 = Text(flatten("176,42,163"))

# ---- group: HospitalityD-v
txt_22 = Text(flatten(["27,134,247", "27,134,247"]))

# ---- group: TransportationD-v
txt_23 = Text(flatten("240,31,31"))

# ----
uservalue_17 = Text(txt_13)
userkey_17 = Text("Color")
uservalue_18 = Text(txt_21)
uservalue_19 = Text(txt_22)
userkey_18 = Text("Color")
userkey_19 = Text("Color")
uservalue_20 = Text(txt_23)
userkey_20 = Text("Color")
c_script_17 = CSharpScript(geometry=bang_13.Branch1, userKey=userkey_17, userValue=uservalue_17)  # -> out, geoWithUserString; inputs geometry: GeometryBase, userKey: String, userValue: String; same code as c_script
c_script_18 = CSharpScript(geometry=bang_13.Branch2, userKey=userkey_18, userValue=uservalue_18)  # -> out, geoWithUserString; inputs geometry: GeometryBase, userKey: String, userValue: String; same code as c_script
c_script_19 = CSharpScript(geometry=bang_13.Branch3, userKey=userkey_19, userValue=uservalue_19)  # -> out, geoWithUserString; inputs geometry: GeometryBase, userKey: String, userValue: String; same code as c_script
c_script_20 = CSharpScript(geometry=bang_13.Branch4, userKey=userkey_20, userValue=uservalue_20)  # -> out, geoWithUserString; inputs geometry: GeometryBase, userKey: String, userValue: String; same code as c_script
python_18 = GhPythonScript(geoms=c_script_17.geoWithUserString, user_key="Color")  # -> out, user_values; inputs geoms: list of GeometryBase; same code as python_2
python_19 = GhPythonScript(geoms=c_script_18.geoWithUserString, user_key="Color")  # -> out, user_values; inputs geoms: list of GeometryBase; same code as python_2
python_20 = GhPythonScript(geoms=c_script_19.geoWithUserString, user_key="Color")  # -> out, user_values; inputs geoms: list of GeometryBase; same code as python_2
python_21 = GhPythonScript(geoms=c_script_20.geoWithUserString, user_key="Color")  # -> out, user_values; inputs geoms: list of GeometryBase; same code as python_2

# ---- group: EducationB-v
txt_24 = Text(flatten(["176,42,163", "176,42,163"]))

# ---- group: HospitalityB-v
txt_25 = Text(flatten(["27,134,247", "27,134,247", "27,134,247", "27,134,247", "27,134,247", "27,134,247", "27,134,247", "27,134,247", "27,134,247", "27,134,247", "27,134,247", "27,134,247", "27,134,247"]))

# ---- group: TransportationB-v
txt_26 = Text(flatten(["240,31,31", "240,31,31", "240,31,31", "240,31,31", "240,31,31", "240,31,31"]))

# ----
uservalue_21 = Text(txt_14)
userkey_21 = Text("Color")
uservalue_22 = Text(txt_24)
uservalue_23 = Text(txt_25)
userkey_22 = Text("Color")
userkey_23 = Text("Color")
uservalue_24 = Text(txt_26)
userkey_24 = Text("Color")
c_script_21 = CSharpScript(geometry=bang_11.Branch1, userKey=userkey_21, userValue=uservalue_21)  # -> out, geoWithUserString; inputs geometry: GeometryBase, userKey: String, userValue: String; same code as c_script
c_script_22 = CSharpScript(geometry=bang_11.Branch2, userKey=userkey_22, userValue=uservalue_22)  # -> out, geoWithUserString; inputs geometry: GeometryBase, userKey: String, userValue: String; same code as c_script
c_script_23 = CSharpScript(geometry=bang_11.Branch3, userKey=userkey_23, userValue=uservalue_23)  # -> out, geoWithUserString; inputs geometry: GeometryBase, userKey: String, userValue: String; same code as c_script
c_script_24 = CSharpScript(geometry=bang_11.Branch4, userKey=userkey_24, userValue=uservalue_24)  # -> out, geoWithUserString; inputs geometry: GeometryBase, userKey: String, userValue: String; same code as c_script
python_22 = GhPythonScript(geoms=c_script_21.geoWithUserString, user_key="Color")  # -> out, user_values; inputs geoms: list of GeometryBase; same code as python_2
python_23 = GhPythonScript(geoms=c_script_22.geoWithUserString, user_key="Color")  # -> out, user_values; inputs geoms: list of GeometryBase; same code as python_2
python_24 = GhPythonScript(geoms=c_script_23.geoWithUserString, user_key="Color")  # -> out, user_values; inputs geoms: list of GeometryBase; same code as python_2
python_25 = GhPythonScript(geoms=c_script_24.geoWithUserString, user_key="Color")  # -> out, user_values; inputs geoms: list of GeometryBase; same code as python_2

# ---- group: ParksA-v
txt_27 = Text(flatten(["51,242,54", "51,242,54", "51,242,54", "51,242,54", "51,242,54", "51,242,54", "51,242,54", "51,242,54", "51,242,54", "51,242,54"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]))

# ---- group: ParksC-v
txt_28 = Text(flatten(["51,242,54", "51,242,54", "51,242,54", "51,242,54", "51,242,54", "51,242,54", "51,242,54", "51,242,54", "51,242,54", "51,242,54", "51,242,54"]))

# ---- group: ParksD-v
txt_29 = Text(flatten(["51,242,54", "51,242,54", "51,242,54", "51,242,54", "51,242,54", "51,242,54", "51,242,54", "51,242,54", "51,242,54", "51,242,54", "51,242,54", "51,242,54", "51,242,54", "51,242,54", "51,242,54", "51,242,54", "51,242,54"]))

# ---- group: ParksB-v
txt_30 = Text(flatten(["51,242,54", "51,242,54", "51,242,54", "51,242,54", "51,242,54"]))

# ---- group: EducationA-v
txt_31 = Text(flatten(["176,42,163", "176,42,163", "176,42,163", "176,42,163", "176,42,163", "176,42,163", "176,42,163", "176,42,163", "176,42,163", "176,42,163", "176,42,163", "176,42,163", "176,42,163", "176,42,163", "176,42,163", "176,42,163", "176,42,163", "176,42,163", "176,42,163", "176,42,163", "176,42,163", "176,42,163", "176,42,163", "176,42,163", "176,42,163", "176,42,163", "176,42,163", "176,42,163", "176,42,163", "176,42,163"]))

# ---- group: HospitalityA-v
txt_32 = Text(flatten(["27,134,247", "27,134,247", "27,134,247", "27,134,247", "27,134,247", "27,134,247", "27,134,247", "27,134,247", "27,134,247", "27,134,247", "27,134,247", "27,134,247", "27,134,247", "27,134,247", "27,134,247", "27,134,247", "27,134,247", "27,134,247", "27,134,247", "27,134,247", "27,134,247", "27,134,247", "27,134,247", "27,134,247", "27,134,247", "27,134,247", "27,134,247", "27,134,247", "27,134,247", "27,134,247", "27,134,247", "27,134,247"]))

# ---- group: TransportationA-v
txt_33 = Text(flatten(["240,31,31", "240,31,31", "240,31,31"]))

# ----
# add color a
panel_7 = Panel("Color")
uservalue_25 = Text(txt_27)
userkey_25 = Text(panel_7)
uservalue_26 = Text(txt_31)
uservalue_27 = Text(txt_32)
userkey_26 = Text("Color")
userkey_27 = Text("Color")
uservalue_28 = Text(txt_33)
userkey_28 = Text("Color")
c_script_25 = CSharpScript(geometry=bang_6.Branch1, userKey=userkey_25, userValue=uservalue_25)  # -> out, geoWithUserString; inputs geometry: GeometryBase, userKey: String, userValue: String; same code as c_script
c_script_26 = CSharpScript(geometry=bang_6.Branch2, userKey=userkey_26, userValue=uservalue_26)  # -> out, geoWithUserString; inputs geometry: GeometryBase, userKey: String, userValue: String; same code as c_script
c_script_27 = CSharpScript(geometry=bang_6.Branch3, userKey=userkey_27, userValue=uservalue_27)  # -> out, geoWithUserString; inputs geometry: GeometryBase, userKey: String, userValue: String; same code as c_script
c_script_28 = CSharpScript(geometry=bang_6.Branch4, userKey=userkey_28, userValue=uservalue_28)  # -> out, geoWithUserString; inputs geometry: GeometryBase, userKey: String, userValue: String; same code as c_script
python_26 = GhPythonScript(geoms=c_script_25.geoWithUserString, user_key=panel_7)  # -> out, user_values; inputs geoms: list of GeometryBase; same code as python_2
python_27 = GhPythonScript(geoms=c_script_26.geoWithUserString, user_key="Color")  # -> out, user_values; inputs geoms: list of GeometryBase; same code as python_2
python_28 = GhPythonScript(geoms=c_script_27.geoWithUserString, user_key="Color")  # -> out, user_values; inputs geoms: list of GeometryBase; same code as python_2
python_29 = GhPythonScript(geoms=c_script_28.geoWithUserString, user_key="Color")  # -> out, user_values; inputs geoms: list of GeometryBase; same code as python_2

# ---- group: EducationC-v
txt_34 = Text(flatten("176,42,163"))

# ---- group: HospitalityC-v
txt_35 = Text(flatten(["27,134,247", "27,134,247", "27,134,247", "27,134,247", "27,134,247", "27,134,247", "27,134,247", "27,134,247", "27,134,247", "27,134,247", "27,134,247", "27,134,247", "27,134,247", "27,134,247", "27,134,247", "27,134,247", "27,134,247", "27,134,247", "27,134,247", "27,134,247", "27,134,247", "27,134,247", "27,134,247", "27,134,247", "27,134,247", "27,134,247"]))

# ---- group: EducationB-v
txt_36 = Text(flatten(["176,42,163", "176,42,163"]))

# ---- group: HospitalityB-v
txt_37 = Text(flatten(["27,134,247", "27,134,247", "27,134,247", "27,134,247", "27,134,247", "27,134,247", "27,134,247", "27,134,247", "27,134,247", "27,134,247", "27,134,247", "27,134,247", "27,134,247"]))

# ---- group: TransportationC-v
txt_38 = Text(flatten(["240,31,31", "240,31,31", "240,31,31", "240,31,31", "240,31,31", "240,31,31", "240,31,31", "240,31,31", "240,31,31", "240,31,31", "240,31,31", "240,31,31", "240,31,31", "240,31,31", "240,31,31", "240,31,31", "240,31,31", "240,31,31"]))

# ----
uservalue_29 = Text(txt_28)
uservalue_30 = Text(txt_34)
uservalue_31 = Text(txt_35)
userkey_29 = Text("Color")
uservalue_32 = Text(txt_38)
userkey_30 = Text("Color")
userkey_31 = Text("Color")
userkey_32 = Text("Color")
c_script_29 = CSharpScript(geometry=bang_8.Branch1, userKey=userkey_29, userValue=uservalue_29)  # -> out, geoWithUserString; inputs geometry: GeometryBase, userKey: String, userValue: String; same code as c_script
c_script_30 = CSharpScript(geometry=bang_8.Branch2, userKey=userkey_30, userValue=uservalue_30)  # -> out, geoWithUserString; inputs geometry: GeometryBase, userKey: String, userValue: String; same code as c_script
c_script_31 = CSharpScript(geometry=bang_8.Branch3, userKey=userkey_31, userValue=uservalue_31)  # -> out, geoWithUserString; inputs geometry: GeometryBase, userKey: String, userValue: String; same code as c_script
c_script_32 = CSharpScript(geometry=bang_8.Branch4, userKey=userkey_32, userValue=uservalue_32)  # -> out, geoWithUserString; inputs geometry: GeometryBase, userKey: String, userValue: String; same code as c_script
python_30 = GhPythonScript(geoms=c_script_29.geoWithUserString, user_key="Color")  # -> out, user_values; inputs geoms: list of GeometryBase; same code as python_2
python_31 = GhPythonScript(geoms=c_script_30.geoWithUserString, user_key="Color")  # -> out, user_values; inputs geoms: list of GeometryBase; same code as python_2
python_32 = GhPythonScript(geoms=c_script_31.geoWithUserString, user_key="Color")  # -> out, user_values; inputs geoms: list of GeometryBase; same code as python_2
python_33 = GhPythonScript(geoms=c_script_32.geoWithUserString, user_key="Color")  # -> out, user_values; inputs geoms: list of GeometryBase; same code as python_2

# ---- group: EducationD-v
txt_39 = Text(flatten("176,42,163"))

# ---- group: HospitalityD-v
txt_40 = Text(flatten(["27,134,247", "27,134,247"]))

# ---- group: TransportationD-v
txt_41 = Text(flatten("240,31,31"))

# ----
uservalue_33 = Text(txt_29)
uservalue_34 = Text(txt_39)
uservalue_35 = Text(txt_40)
userkey_33 = Text("Color")
userkey_34 = Text("Color")
userkey_35 = Text("Color")
uservalue_36 = Text(txt_41)
userkey_36 = Text("Color")
c_script_33 = CSharpScript(geometry=bang_9.Branch1, userKey=userkey_33, userValue=uservalue_33)  # -> out, geoWithUserString; inputs geometry: GeometryBase, userKey: String, userValue: String; same code as c_script
c_script_34 = CSharpScript(geometry=bang_9.Branch2, userKey=userkey_34, userValue=uservalue_34)  # -> out, geoWithUserString; inputs geometry: GeometryBase, userKey: String, userValue: String; same code as c_script
c_script_35 = CSharpScript(geometry=bang_9.Branch3, userKey=userkey_35, userValue=uservalue_35)  # -> out, geoWithUserString; inputs geometry: GeometryBase, userKey: String, userValue: String; same code as c_script
c_script_36 = CSharpScript(geometry=bang_9.Branch4, userKey=userkey_36, userValue=uservalue_36)  # -> out, geoWithUserString; inputs geometry: GeometryBase, userKey: String, userValue: String; same code as c_script
python_34 = GhPythonScript(geoms=c_script_33.geoWithUserString, user_key="Color")  # -> out, user_values; inputs geoms: list of GeometryBase; same code as python_2
python_35 = GhPythonScript(geoms=c_script_34.geoWithUserString, user_key="Color")  # -> out, user_values; inputs geoms: list of GeometryBase; same code as python_2
python_36 = GhPythonScript(geoms=c_script_35.geoWithUserString, user_key="Color")  # -> out, user_values; inputs geoms: list of GeometryBase; same code as python_2
python_37 = GhPythonScript(geoms=c_script_36.geoWithUserString, user_key="Color")  # -> out, user_values; inputs geoms: list of GeometryBase; same code as python_2

# ---- group: TransportationB-v
txt_42 = Text(flatten(["240,31,31", "240,31,31", "240,31,31", "240,31,31", "240,31,31", "240,31,31"]))

# ----
uservalue_37 = Text(txt_30)
uservalue_38 = Text(txt_36)
uservalue_39 = Text(txt_37)
userkey_37 = Text("Color")
userkey_38 = Text("Color")
userkey_39 = Text("Color")
uservalue_40 = Text(txt_42)
userkey_40 = Text("Color")
c_script_37 = CSharpScript(geometry=bang_7.Branch1, userKey=userkey_37, userValue=uservalue_37)  # -> out, geoWithUserString; inputs geometry: GeometryBase, userKey: String, userValue: String; same code as c_script
c_script_38 = CSharpScript(geometry=bang_7.Branch2, userKey=userkey_38, userValue=uservalue_38)  # -> out, geoWithUserString; inputs geometry: GeometryBase, userKey: String, userValue: String; same code as c_script
c_script_39 = CSharpScript(geometry=bang_7.Branch3, userKey=userkey_39, userValue=uservalue_39)  # -> out, geoWithUserString; inputs geometry: GeometryBase, userKey: String, userValue: String; same code as c_script
c_script_40 = CSharpScript(geometry=bang_7.Branch4, userKey=userkey_40, userValue=uservalue_40)  # -> out, geoWithUserString; inputs geometry: GeometryBase, userKey: String, userValue: String; same code as c_script
python_38 = GhPythonScript(geoms=c_script_37.geoWithUserString, user_key="Color")  # -> out, user_values; inputs geoms: list of GeometryBase; same code as python_2
python_39 = GhPythonScript(geoms=c_script_38.geoWithUserString, user_key="Color")  # -> out, user_values; inputs geoms: list of GeometryBase; same code as python_2
python_40 = GhPythonScript(geoms=c_script_39.geoWithUserString, user_key="Color")  # -> out, user_values; inputs geoms: list of GeometryBase; same code as python_2
python_41 = GhPythonScript(geoms=c_script_40.geoWithUserString, user_key="Color")  # -> out, user_values; inputs geoms: list of GeometryBase; same code as python_2

stream_filter_7 = StreamFilter(
    Gate=city_amenities_one,
    Stream0=c_script_21.geoWithUserString,
    Stream1=c_script_22.geoWithUserString,
    Stream2=c_script_23.geoWithUserString,
    Stream3=c_script_24.geoWithUserString)
stream_filter_8 = StreamFilter(
    Gate=city_amenities_one,
    Stream0=c_script_9.geoWithUserString,
    Stream1=c_script_10.geoWithUserString,
    Stream2=c_script_11.geoWithUserString,
    Stream3=c_script_12.geoWithUserString)
stream_filter_9 = StreamFilter(
    Gate=city_amenities_one,
    Stream0=c_script_13.geoWithUserString,
    Stream1=c_script_14.geoWithUserString,
    Stream2=c_script_15.geoWithUserString,
    Stream3=c_script_16.geoWithUserString)
stream_filter_10 = StreamFilter(
    Gate=city_amenities_one,
    Stream0=c_script_17.geoWithUserString,
    Stream1=c_script_18.geoWithUserString,
    Stream2=c_script_19.geoWithUserString,
    Stream3=c_script_20.geoWithUserString)
stream_filter_11 = StreamFilter(
    Gate=city_district_one,
    Stream0=c_script_3.geoWithUserString,
    Stream1=c_script_4.geoWithUserString,
    Stream2=c_script.geoWithUserString,
    Stream3=c_script_2.geoWithUserString)
stream_filter_12 = StreamFilter(
    Gate=city_district_one,
    Stream0=stream_filter_8,
    Stream1=stream_filter_7,
    Stream2=stream_filter_9,
    Stream3=stream_filter_10)

stream_filter_13 = StreamFilter(
    Gate=city_amenities_two,
    Stream0=c_script_37.geoWithUserString,
    Stream1=c_script_38.geoWithUserString,
    Stream2=c_script_39.geoWithUserString,
    Stream3=c_script_40.geoWithUserString)
stream_filter_14 = StreamFilter(
    Gate=city_amenities_two,
    Stream0=c_script_25.geoWithUserString,
    Stream1=c_script_26.geoWithUserString,
    Stream2=c_script_27.geoWithUserString,
    Stream3=c_script_28.geoWithUserString)
stream_filter_15 = StreamFilter(
    Gate=city_amenities_two,
    Stream0=c_script_29.geoWithUserString,
    Stream1=c_script_30.geoWithUserString,
    Stream2=c_script_31.geoWithUserString,
    Stream3=c_script_32.geoWithUserString)
stream_filter_16 = StreamFilter(
    Gate=city_amenities_two,
    Stream0=c_script_33.geoWithUserString,
    Stream1=c_script_34.geoWithUserString,
    Stream2=c_script_35.geoWithUserString,
    Stream3=c_script_36.geoWithUserString)
stream_filter_17 = StreamFilter(
    Gate=city_district_two,
    Stream0=c_script_7.geoWithUserString,
    Stream1=c_script_8.geoWithUserString,
    Stream2=c_script_5.geoWithUserString,
    Stream3=c_script_6.geoWithUserString)
stream_filter_18 = StreamFilter(
    Gate=city_district_two,
    Stream0=stream_filter_14,
    Stream1=stream_filter_13,
    Stream2=stream_filter_15,
    Stream3=stream_filter_16)

bbox = BoundingBox(
    Content=flatten([bang_10.Branch0, bang_11.Branch0, bang_12.Branch0, bang_13.Branch0]),
    Plane=PlaneXY(0, 0, 0),
    UnionBox=True)  # -> Box, Box_2
debrep = DeconstructBrep(Brep=bbox.Box)  # -> Faces, Edges, Vertices
area = Area(Geometry=debrep.Faces)  # -> Area, Centroid
sort = SortList(Keys=area.Area, ValuesA=debrep.Faces)  # -> Keys, reverse(ValuesA)
item_2 = ListItem(List=sort.ValuesA, Index=0, Wrap=True)
dim = Dimensions(Surface=item_2)  # -> UDimension, VDimension
sqgrid = Square(Plane=PlaneXY(0, 0, 0), Size=dim.VDimension, ExtentX="2", ExtentY="2")  # -> simplify(Cells), simplify(Points)
item_3 = ListItem(List=sqgrid.Cells, Index=0, Wrap=True)  # -> Item, Item1
merge = Merge(Data1=item_3.Item, Data2=item_3.Item1)  # -> flatten(Result)
area_2 = Area(Geometry=item_3.Item)  # -> Area, Centroid
move = Move(Geometry=area_2.Centroid, Motion=Vector(0, 0, 10))  # -> Geometry, Transform
area_3 = Area(Geometry=item_2)  # -> Area, Centroid
ln = Line(StartPoint=area_2.Centroid, EndPoint=move.Geometry)
move_2 = Move(Geometry=area_3.Centroid, Motion=Vector(0, 0, 10))  # -> Geometry, Transform
midpt = CurveMiddle(Curve=ln)
X = UnitX(Factor=1)
ln_2 = Line(StartPoint=area_3.Centroid, EndPoint=move_2.Geometry)
move_3 = Move(Geometry=midpt, Motion=X)  # -> Geometry, Transform
midpt_2 = CurveMiddle(Curve=ln_2)
X_2 = UnitX(Factor=1)
pl_3pt = Plane3Pt(PointA=area_2.Centroid, PointB=move_3.Geometry, PointC=move.Geometry)
move_4 = Move(Geometry=midpt_2, Motion=X_2)  # -> Geometry, Transform
item_4 = ListItem(List=flatten(pl_3pt), Index=0, Wrap=True)  # -> Item, Item1
pl_3pt_2 = Plane3Pt(PointA=area_3.Centroid, PointB=move_4.Geometry, PointC=move_2.Geometry)

# ---- group: just to test
path_2 = FilePath("C:\Users\ARoncal\OneDrive - Thornton Tomasetti, Inc\__License Resources\Desktop\datamgnt\bimsc24-final-project\src\submissions\andresroncal\assets\Programs massing.3dm")

# ----
python_42 = GhPythonScript(FP=path_2)  # -> out, geom, layerIndex, layers, layerColor; same code as python
cset_3 = CreateSet(List=python_42.layerIndex)  # -> Set, Map
cset_4 = CreateSet(List=cset_3.Map)  # -> Set, Map
mindex_2 = MemberIndex(Set=cset_3.Map, Member=cset_4.Set)  # -> Index, Count
item_5 = ListItem(List=python_42.geom, Index=mindex_2.Index, Wrap=True)  # -> simplify(Item)

layertable_2 = LayerTable(Update=True, AutoUpdate=False)  # -> Layers, FullLayerPaths, LayerColors, Linetypes, MaterialNames, Visible, PrintWidth, PrintColor
cull_i_2 = CullIndex(List=layertable_2.FullLayerPaths, Indices="0", Wrap=True)
partition_2 = PartitionList(List=cull_i_2, Size="5")  # -> simplify(Chunks)
txt_43 = Text(partition_2)
bang_16 = ExplodeTree(Data=txt_43)  # -> Branch0, Branch1, Branch2, Branch3, Branch4
reflay_5 = ReferenceByLayer(LayerName=bang_16.Branch2, lightweight=False, DisableAutoUpdate=False)  # -> simplify(Geometry)
reflay_6 = ReferenceByLayer(LayerName=bang_16.Branch3, lightweight=False, DisableAutoUpdate=False)  # -> simplify(Geometry)
reflay_7 = ReferenceByLayer(LayerName=bang_16.Branch0, lightweight=False, DisableAutoUpdate=False)  # -> simplify(Geometry)
reflay_8 = ReferenceByLayer(LayerName=bang_16.Branch1, lightweight=False, DisableAutoUpdate=False)  # -> simplify(Geometry)
bang_17 = ExplodeTree(Data=reflay_5)  # -> Branch0, Branch1, Branch2, Branch3, Branch4
bang_18 = ExplodeTree(Data=reflay_6)  # -> Branch0, Branch1, Branch2, Branch3, Branch4
bang_19 = ExplodeTree(Data=reflay_8)  # -> Branch0, Branch1, Branch2, Branch3, Branch4
bang_20 = ExplodeTree(Data=reflay_7)  # -> Branch0, Branch1, Branch2, Branch3, Branch4
getkv_2 = GetAllKeysValues(AttributesOrAttributedGeometry=bang_20.Branch0)  # -> Keys, Values, BakeName
mesh_3 = Mesh(bang_20.Branch0)
txt_44 = Text(getkv_2.Keys)
expression_2 = Expression(x=txt_44, y="Uaddress", Expression="Contains(x,y)")
# add color a
cull_3 = CullPattern(List=getkv_2.Values, CullPattern=expression_2)  # -> simplify(List)
cull_4 = CullPattern(List=getkv_2.Keys, CullPattern=expression_2)  # -> simplify(List)

division = Division(A=dim.VDimension, B="2.2")
int = Integer(division)
dom = ConstructDomain(DomainStart=expr("-x", int), DomainEnd=int)
Z = UnitZ(Factor=expr("x-0.5", "20"))
rectangle = Rectangle(Plane=area_2.Centroid, XSize=dom, YSize=dom, Radius=0)  # -> Rectangle, Length
extr = Extrude(Base=rectangle.Rectangle, Direction=Z)
cap = CapHoles(Brep=extr)
mesh_4 = Mesh(flatten(cap))

bang_21 = ExplodeTree(Data=item_5)  # -> Branch0, Branch1, Branch2, Branch3, Branch4, Branch5, Branch6, Branch7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
bang_22 = ExplodeTree(Data=item_5)  # -> Branch0, Branch1, Branch2, Branch3, Branch4, Branch5, Branch6, Branch7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; disabled
mesh_5 = Mesh(bang_21.Branch19)
stream_filter_19 = StreamFilter(
    Gate=city_amenities_two,
    Stream0=bang_21.Branch6,
    Stream1=bang_21.Branch7,
    Stream2=bang_21.Branch8,
    Stream3=bang_21.Branch9)
stream_filter_20 = StreamFilter(
    Gate=city_amenities_two,
    Stream0=bang_21.Branch1,
    Stream1=bang_21.Branch2,
    Stream2=bang_21.Branch3,
    Stream3=bang_21.Branch4)
stream_filter_21 = StreamFilter(
    Gate=city_amenities_two,
    Stream0=bang_21.Branch11,
    Stream1=bang_21.Branch12,
    Stream2=bang_21.Branch13,
    Stream3=bang_21.Branch14)
stream_filter_22 = StreamFilter(
    Gate=city_amenities_two,
    Stream0=bang_21.Branch16,
    Stream1=bang_21.Branch18,
    Stream2=bang_21.Branch17,
    Stream3=bang_21.Branch18)

Z_2 = UnitZ(Factor=Z)
number_slider = Slider(0, range=0..1)

stream_filter_23 = StreamFilter(
    Gate=city_district_two,
    Stream0=bang_21.Branch0,
    Stream1=bang_21.Branch5,
    Stream2=bang_21.Branch10,
    Stream3=bang_21.Branch15)
stream_filter_24 = StreamFilter(
    Gate=city_district_two,
    Stream0=stream_filter_20,
    Stream1=stream_filter_19,
    Stream2=stream_filter_21,
    Stream3=stream_filter_22)

orient = Orient(Geometry=stream_filter_18, Source=pl_3pt_2, Target=item_4.Item1)  # -> Geometry, Transform
orient_2 = Orient(Geometry=stream_filter_17, Source=pl_3pt_2, Target=item_4.Item1)  # -> Geometry, Transform
mdif = MeshDifference(MeshesA=orient.Geometry, MeshesB=extr)  # -> simplify(Result)
mdif_2 = MeshDifference(MeshesA=orient_2.Geometry, MeshesB=extr)  # -> simplify(Result)
move_5 = Move(Geometry=mdif, Motion=Z_2)  # -> Geometry, Transform
move_6 = Move(Geometry=mdif_2, Motion=Z_2)  # -> Geometry, Transform
branch = TreeBranch(Tree=move_6.Geometry, Path=number_slider, MaintainPaths=True)
branch_2 = TreeBranch(Tree=move_5.Geometry, Path=number_slider, MaintainPaths=True)

orient_3 = Orient(Geometry=stream_filter_11, Source=pl_3pt_2, Target=item_4.Item)  # -> Geometry, Transform
orient_4 = Orient(Geometry=stream_filter_12, Source=pl_3pt_2, Target=item_4.Item)  # -> Geometry, Transform
mdif_3 = MeshDifference(MeshesA=orient_3.Geometry, MeshesB=extr)  # -> simplify(Result)
mdif_4 = MeshDifference(MeshesA=orient_4.Geometry, MeshesB=extr)  # -> simplify(Result)
move_7 = Move(Geometry=mdif_3, Motion=Z_2)  # -> Geometry, Transform
move_8 = Move(Geometry=mdif_4, Motion=Z_2)  # -> Geometry, Transform
branch_3 = TreeBranch(Tree=move_7.Geometry, Path=number_slider, MaintainPaths=True)
branch_4 = TreeBranch(Tree=move_8.Geometry, Path=number_slider, MaintainPaths=True)

panel_8 = Panel(cull_3)

# ----
# output geometry with k/v
context_bake = ContextBake(Buildings=branch_3)
context_bake_2 = ContextBake(Geometry=branch_4)
context_bake_3 = ContextBake(Buildings2=branch)
# output metadata
context_bake_4 = ContextBake(Geometry=branch_2)
