# Grasshopper definition dataM_M1-AR_v11.gh (Grasshopper 1.0.7)
# plug-ins: ShapeDiverForGrasshopper, Urbano, eleFront

sddp = ShapeDiverDocumentPayload({AbsoluteTolerance=0, AngleTolerance=0, DistanceDisplayPrecision=0, GltfVersion="Gltf2", GrasshopperVersion="1.0.0007", InputGroups="{}", OutputGroups="{}", RelativeTolerance=0, RhinoVersion="7.29.23107.3001", UnitSystem=0, VersionCreated="1.14.0.0", VersionSaved="1.14.0.0"})

# ----
# Left Bound = (-73.951184(w/e) - 0.01)
# Right Bound = (40.7128(n/s) + 0.01)
# Top Bound = (40.7128(n/s) + (0.01 / 1.5))
# Bottom Bound = (-73.951184(w/e) - (0.01 / 1.5))
# 
# Lon = Average(Top Bound and Bottom Bound)
# Lat = Average(Left Bound and Right Bound)
latitude = Panel("40.695294")
longitude = Panel("-73.959094")
lattitude = GetNumber(latitude, AtLeast=1, AtMost=1, Maximum=1.797693135e+308, Minimum=-1.797693135e+308, TreeAccess=False)
longitude_2 = GetNumber(longitude, AtLeast=1, AtMost=1, Maximum=1.797693135e+308, Minimum=-1.797693135e+308, TreeAccess=False)
python = GhPythonScript(lat=lattitude, lon=longitude_2)  # -> topBound, bottomBound, rightBound, leftBound
# ---------- python: Python ----------
import rhinoscriptsyntax as rs

leftBound = lon - 0.002
rightBound = lon + 0.002
topBound = lat + (0.002 / 1.5)
bottomBound = lat - (0.002 / 1.5)
# ---------- end python ----------

# ----
# Brooklyn Housing Sales 2023
txt = Text(Tree({0}: ["Brooklyn Rolling Sales.  All Sales From February 2023 - January 2024", "For sales prior to the Final Roll, Neighborhood Name and Descriptive Data reflect the most recent Final Roll.         Sales after the Final Roll, Neighborhood Name and Descriptive Data reflect current data.", "Building Class Category is based on Building Class at Time of Sale.", "Note: Condominium and cooperative sales are on the unit level and understood to have a count of one.", "BOROUGH", "3"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], {1}: ["", "", "", "", "NEIGHBORHOOD", "BATH BEACH"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], {2}: ["", "", "", "", "BUILDING CLASS CATEGORY", "01 ONE FAMILY DWELLINGS"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], {3}: ["", "", "", "", "TAX CLASS AT PRESENT", "1"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], {4}: ["", "", "", "", "BLOCK", "6360"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], {5}: ["", "", "", "", "LOT", "56"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]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))
panel = Panel("""0
1
2
3
4""")
flip = FlipMatrix(Data=txt)
path = DataPath(panel)
branch = TreeBranch(Tree=flip, Path="4", MaintainPaths=True)
split = SplitTree(Data=flip, Masks=flatten(path))  # -> Positive, Negative

latitude_2 = Panel("40.689613")
longitude_3 = Panel("-73.945950")
lattitude_2 = GetNumber(latitude_2, AtLeast=1, AtMost=1, Maximum=1.797693135e+308, Minimum=-1.797693135e+308, TreeAccess=False)
longitude_4 = GetNumber(longitude_3, AtLeast=1, AtMost=1, Maximum=1.797693135e+308, Minimum=-1.797693135e+308, TreeAccess=False)
python_2 = GhPythonScript(lat=lattitude_2, lon=longitude_4)  # -> topBound, bottomBound, rightBound, leftBound; same code as python

longitude_5 = Panel("-73.954211")

# ----
# Brooklyn Housing Sales 2023
txt_2 = Text(Tree({0}: ["Brooklyn Rolling Sales.  All Sales From February 2023 - January 2024", "For sales prior to the Final Roll, Neighborhood Name and Descriptive Data reflect the most recent Final Roll.         Sales after the Final Roll, Neighborhood Name and Descriptive Data reflect current data.", "Building Class Category is based on Building Class at Time of Sale.", "Note: Condominium and cooperative sales are on the unit level and understood to have a count of one.", "BOROUGH", "3"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], {1}: ["", "", "", "", "NEIGHBORHOOD", "BATH BEACH"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], {2}: ["", "", "", "", "BUILDING CLASS CATEGORY", "01 ONE FAMILY DWELLINGS"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], {3}: ["", "", "", "", "TAX CLASS AT PRESENT", "1"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], {4}: ["", "", "", "", "BLOCK", "6360"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], {5}: ["", "", "", "", "LOT", "56"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]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))
panel_2 = Panel("""0
1
2
3
4""")
flip_2 = FlipMatrix(Data=txt_2)
path_2 = DataPath(panel_2)
branch_2 = TreeBranch(Tree=flip_2, Path="4", MaintainPaths=True)
split_2 = SplitTree(Data=flip_2, Masks=flatten(path_2))  # -> Positive, Negative

download_openstreetmap_osm = DownloadOpenStreetMapOSM(
    LeftBound=python.leftBound,
    RightBound=python.rightBound,
    TopBound=python.topBound,
    BottomBound=python.bottomBound,
    RunToggle=True)  # -> OSMQueryURL, OSMFilePath
import_osm_features = ImportOSMFeatures(OSMPathOrURL=download_openstreetmap_osm.OSMQueryURL, OSMFeatureType="amenity", Format="xml", ImportAltitude=True)  # -> Points, Metadata, UTMZone, TranslationVector
import_osm_features_2 = ImportOSMFeatures(OSMPathOrURL=download_openstreetmap_osm.OSMQueryURL, OSMFeatureType="building", Format="xml", ImportAltitude=True)  # -> Points, Metadata, UTMZone, TranslationVector
import_osm_features_3 = ImportOSMFeatures(OSMPathOrURL=download_openstreetmap_osm.OSMQueryURL, OSMFeatureType="street", Format="xml", ImportAltitude=True)  # -> Points, Metadata, UTMZone, TranslationVector

# ----
# Streets
import_osm_features_4 = ImportOSMFeatures(OSMPathOrURL=download_openstreetmap_osm.OSMQueryURL, OSMFeatureType="street", Format="xml", ImportAltitude=True)  # -> Points, Metadata, UTMZone, TranslationVector
project = Project(Geometry=import_osm_features_4.Points, Plane=PlaneXY(0, 0, 0))  # -> Geometry, Transform
polyline = PolyLine(Vertices=project.Geometry, Closed=False)
create_street_network = CreateStreetNetwork(
    StreetCurves=flatten(polyline),
    Metadata=flatten(import_osm_features_4.Metadata),
    SplitStreetCurves=True,
    UTMZone=import_osm_features_4.UTMZone,
    TranslationVector=import_osm_features_4.TranslationVector)  # -> StreetNetwork, StreetSegmentCurves, UTMZone, TranslationVector

# ----
# Terrain
download_dem_and_build_terrain_mesh = DownloadDEMAndBuildTerrainMesh(
    LeftBound=python.leftBound,
    RightBound=python.rightBound,
    TopBound=python.topBound,
    BottomBound=python.bottomBound,
    XCount=100,
    YCount=100)  # -> TerrainMesh, UTMZone, TranslationVector

download_openstreetmap_osm_2 = DownloadOpenStreetMapOSM(
    LeftBound=python_2.leftBound,
    RightBound=python_2.rightBound,
    TopBound=python_2.topBound,
    BottomBound=python_2.bottomBound,
    RunToggle=True)  # -> OSMQueryURL, OSMFilePath
sddp_2 = ShapeDiverDocumentPayload({AbsoluteTolerance=0, AngleTolerance=0, DistanceDisplayPrecision=0, GltfVersion="Gltf2", GrasshopperVersion="1.0.0007", InputGroups="{}", OutputGroups="{}", RelativeTolerance=0, RhinoVersion="7.29.23107.3001", UnitSystem=0, VersionCreated="1.14.0.0", VersionSaved="1.14.0.0"})
import_osm_features_5 = ImportOSMFeatures(OSMPathOrURL=download_openstreetmap_osm_2.OSMQueryURL, OSMFeatureType="amenity", Format="xml", ImportAltitude=True)  # -> Points, Metadata, UTMZone, TranslationVector
import_osm_features_6 = ImportOSMFeatures(OSMPathOrURL=download_openstreetmap_osm_2.OSMQueryURL, OSMFeatureType="building", Format="xml", ImportAltitude=True)  # -> Points, Metadata, UTMZone, TranslationVector
import_osm_features_7 = ImportOSMFeatures(OSMPathOrURL=download_openstreetmap_osm_2.OSMQueryURL, OSMFeatureType="street", Format="xml", ImportAltitude=True)  # -> Points, Metadata, UTMZone, TranslationVector

# ----
# Streets
import_osm_features_8 = ImportOSMFeatures(OSMPathOrURL=download_openstreetmap_osm_2.OSMQueryURL, OSMFeatureType="street", Format="xml", ImportAltitude=True)  # -> Points, Metadata, UTMZone, TranslationVector
project_2 = Project(Geometry=import_osm_features_8.Points, Plane=PlaneXY(0, 0, 0))  # -> Geometry, Transform
polyline_2 = PolyLine(Vertices=project_2.Geometry, Closed=False)
create_street_network_2 = CreateStreetNetwork(
    StreetCurves=flatten(polyline_2),
    Metadata=flatten(import_osm_features_8.Metadata),
    SplitStreetCurves=True,
    UTMZone=import_osm_features_8.UTMZone,
    TranslationVector=import_osm_features_8.TranslationVector)  # -> StreetNetwork, StreetSegmentCurves, UTMZone, TranslationVector

# ----
# Terrain
download_dem_and_build_terrain_mesh_2 = DownloadDEMAndBuildTerrainMesh(
    LeftBound=python_2.leftBound,
    RightBound=python_2.rightBound,
    TopBound=python_2.topBound,
    BottomBound=python_2.bottomBound,
    XCount=100,
    YCount=100)  # -> TerrainMesh, UTMZone, TranslationVector

# ---- group: Intention
txt_3 = Text("""HousingPulse
Data Analytics for Housing Accessibility Assessment: 

Analyze large datasets, including demographic data, building codes, and geographic information, to assess the accessibility of housing stock at a city or regional level. By identifying areas with inadequate accessibility infrastructure or high concentrations of inaccessible housing units, policymakers can prioritize targeted interventions and investments to improve accessibility.

Also identify possible retrofitting and abandoned lots (private or public) for possible gorilla action take over. """)

# ----
# HousingPulse
panel_3 = Panel(txt_3)

# ---- group: Intention
txt_4 = Text("""HousingPulse
Data Analytics for Housing Accessibility Assessment: 

Analyze large datasets, including demographic data, building codes, and geographic information, to assess the accessibility of housing stock at a city or regional level. By identifying areas with inadequate accessibility infrastructure or high concentrations of inaccessible housing units, policymakers can prioritize targeted interventions and investments to improve accessibility.

Also identify possible retrofitting and abandoned lots (private or public) for possible gorilla action take over. """)

# ----
# HousingPulse
panel_4 = Panel(txt_4)

# ---- group: Build Basic Model
# Turn on build toggle
polyline_3 = PolyLine(Vertices=import_osm_features_3.Points, Closed=False)
create_amenity = CreateAmenity(PointLocationOfAmenity=import_osm_features.Points, Metadata=import_osm_features.Metadata)
polyline_4 = PolyLine(Vertices=import_osm_features_2.Points, Closed=False)
create_street_network_3 = CreateStreetNetwork(
    StreetCurves=flatten(polyline_3),
    Metadata=flatten(import_osm_features_3.Metadata),
    SplitStreetCurves=True,
    UTMZone=import_osm_features_3.UTMZone,
    TranslationVector=import_osm_features_3.TranslationVector)  # -> StreetNetwork, StreetSegmentCurves, UTMZone, TranslationVector
arrange_amenities_by_building = ArrangeAmenitiesByBuilding(Amenities=flatten(create_amenity), Buildings=flatten(polyline_4))  # -> AmenitiesByBuilding, Buildings
create_building = CreateBuilding(
    BuildingCurve=arrange_amenities_by_building.Buildings,
    Metadata=import_osm_features_2.Metadata,
    AmenitiesInBuilding=arrange_amenities_by_building.AmenitiesByBuilding)

# ----
project_3 = Project(Geometry=create_building, Plane=PlaneXY(0, 0, 0))  # -> Geometry, Transform

# ---- group: Build Basic Model (continued)
build_urbano_model = BuildUrbanoModel(Buildings=project_3.Geometry, StreetNetwork=create_street_network_3.StreetNetwork, BuildToggle=True)  # -> UrbanoModel, flatten(BuildingCurves), Activities
inspect_building = InspectBuilding(Building=project_3.Geometry, DefaultHeight=10)  # -> Geometry, Metadata, Amenity, BuildingMesh

# ----
demeta = DeconstructMetadata(Metadata=inspect_building.Metadata)  # -> simplify(Keys), simplify(Values)

context_print = ContextPrint(RollingsalesBKTitles=branch)
context_print_2 = ContextPrint(RollingsalesBK=split.Negative)
context_bake = ContextBake(Buildings=inspect_building.BuildingMesh)
context_bake_2 = ContextBake(Geometry=download_dem_and_build_terrain_mesh.TerrainMesh)
context_print_3 = ContextPrint(README=txt_3)
context_bake_3 = ContextBake(Geometry=create_street_network.StreetSegmentCurves)
context_print_4 = ContextPrint(Amenity=build_urbano_model.Activities)
context_bake_4 = ContextBake(Geometry=build_urbano_model.BuildingCurves)
context_print_5 = ContextPrint(Text=demeta.Keys)
context_print_6 = ContextPrint(Text=demeta.Values)

# ---- group: Build Basic Model
# Turn on build toggle
polyline_5 = PolyLine(Vertices=import_osm_features_7.Points, Closed=False)
create_amenity_2 = CreateAmenity(PointLocationOfAmenity=import_osm_features_5.Points, Metadata=import_osm_features_5.Metadata)
polyline_6 = PolyLine(Vertices=import_osm_features_6.Points, Closed=False)
create_street_network_4 = CreateStreetNetwork(
    StreetCurves=flatten(polyline_5),
    Metadata=flatten(import_osm_features_7.Metadata),
    SplitStreetCurves=True,
    UTMZone=import_osm_features_7.UTMZone,
    TranslationVector=import_osm_features_7.TranslationVector)  # -> StreetNetwork, StreetSegmentCurves, UTMZone, TranslationVector
arrange_amenities_by_building_2 = ArrangeAmenitiesByBuilding(Amenities=flatten(create_amenity_2), Buildings=flatten(polyline_6))  # -> AmenitiesByBuilding, Buildings
create_building_2 = CreateBuilding(
    BuildingCurve=arrange_amenities_by_building_2.Buildings,
    Metadata=import_osm_features_6.Metadata,
    AmenitiesInBuilding=arrange_amenities_by_building_2.AmenitiesByBuilding)

# ----
project_4 = Project(Geometry=create_building_2, Plane=PlaneXY(0, 0, 0))  # -> Geometry, Transform

# ---- group: Build Basic Model (continued)
build_urbano_model_2 = BuildUrbanoModel(Buildings=project_4.Geometry, StreetNetwork=create_street_network_4.StreetNetwork, BuildToggle=True)  # -> UrbanoModel, flatten(BuildingCurves), Activities
inspect_building_2 = InspectBuilding(Building=project_4.Geometry, DefaultHeight=10)  # -> Geometry, Metadata, Amenity, BuildingMesh

# ----
demeta_2 = DeconstructMetadata(Metadata=inspect_building_2.Metadata)  # -> simplify(Keys), simplify(Values)
geo = Geometry(inspect_building_2.BuildingMesh)
merge = Merge(Data1=geo, Data2=demeta_2.Keys, Data3=demeta_2.Values)
lng = ListLength(List=demeta_2.Keys)
geo_2 = Geometry(geo)
split_3 = SplitList(List=merge, Index="1")  # -> ListA, ListB
split_4 = SplitList(List=split_3.ListB, Index=lng)  # -> ListA, ListB
item = ListItem(List=split_4.ListA, Index=0, Wrap=True)
item_2 = ListItem(List=split_4.ListB, Index=0, Wrap=True)
ef_att = EleFrontAttributes(Keys=item, Values=item_2)  # -> simplify(Attributes), Keys, Values, Name, Layer, ColourSource, DisplayColour, MaterialSource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
attatt = AttachAttributes(Geometry=geo_2, Attributes=simplify(ef_att.Attributes))
geo_3 = Geometry(split_3.ListA)
data = Data(split_4.ListA)
data_2 = Data(split_4.ListB)
bake = BakeObjects(Geometry=attatt, Attributes=simplify(ef_att.Attributes), Bake=False, createGroups=False)  # -> Message, Guids
panel_5 = Panel(bake.Guids)

context_print_7 = ContextPrint(RollingsalesBKTitles=branch_2)
context_print_8 = ContextPrint(RollingsalesBK=split_2.Negative)
context_bake_5 = ContextBake(Buildings=inspect_building_2.BuildingMesh)
context_bake_6 = ContextBake(Geometry=download_dem_and_build_terrain_mesh_2.TerrainMesh)
context_print_9 = ContextPrint(README=txt_4)
context_bake_7 = ContextBake(Geometry=create_street_network_2.StreetSegmentCurves)
context_print_10 = ContextPrint(Amenity=build_urbano_model_2.Activities)
context_bake_8 = ContextBake(Geometry=build_urbano_model_2.BuildingCurves)
context_print_11 = ContextPrint(Text=demeta_2.Keys)
context_print_12 = ContextPrint(Text=demeta_2.Values)
