# Grasshopper definition dataM_M1-AR_v2_WIP-TESTWEBSCRAPING.gh (Grasshopper 1.0.7)
# plug-ins: Wombat, Pufferfish, ShapeDiverForGrasshopper, Human, Urbano

# HousingPulse
sddp = ShapeDiverDocumentPayload({AbsoluteTolerance=0, AngleTolerance=0, DistanceDisplayPrecision=0, GltfVersion="Gltf2", GrasshopperVersion="1.0.0007", InputGroups="{}", OutputGroups="{}", RelativeTolerance=0, RhinoVersion="7.29.23107.3001", UnitSystem=0, VersionCreated="1.14.0.0", VersionSaved="1.14.0.0"})

# ---- group: NYC Map Before Urbano
# GRAPHICS
txt = Text(["Referenced TextEntity", "Referenced TextEntity", "Referenced TextEntity", "Referenced TextEntity", "Referenced TextEntity", "Referenced TextEntity", "Referenced TextEntity", "Referenced TextEntity", "Referenced TextEntity", "Referenced TextEntity", "Referenced TextEntity", "Referenced TextEntity", "Referenced TextEntity", "Referenced TextEntity", "Referenced TextEntity", "Referenced TextEntity", "Referenced TextEntity", "Referenced TextEntity", "Referenced TextEntity", "Referenced TextEntity", "Referenced TextEntity", "Referenced TextEntity", "Referenced TextEntity", "Referenced TextEntity", "Referenced TextEntity", "Referenced TextEntity", "Referenced TextEntity", "Referenced TextEntity", "Referenced TextEntity", "Referenced TextEntity", "Referenced TextEntity", "Referenced TextEntity", "Referenced TextEntity", "Referenced TextEntity", "Referenced TextEntity", "Referenced TextEntity", "Referenced TextEntity", "Referenced TextEntity", "Referenced TextEntity", "Referenced TextEntity", "Referenced TextEntity", "Referenced TextEntity", "Referenced TextEntity", "Referenced TextEntity", "Referenced TextEntity", "Referenced TextEntity", "Referenced TextEntity", "Referenced TextEntity", "Referenced TextEntity", "Referenced TextEntity", "Referenced TextEntity", "Referenced TextEntity", "Referenced TextEntity", "Referenced TextEntity", "Referenced TextEntity", "Referenced TextEntity", "Referenced TextEntity", "Referenced TextEntity", "Referenced TextEntity", "Referenced TextEntity"])
geo = Geometry([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])

# ----
# GET TOPO
# Lat Lon Bound
panel = Panel("-122.415930")
_3 = GetInteger(Slider(36, range=10..100), AtLeast=1, AtMost=1, Maximum=2147483647, Minimum=-2147483648, TreeAccess=False)
_2 = GetInteger(Slider(10, range=10..100), AtLeast=1, AtMost=1, Maximum=2147483647, Minimum=-2147483648, Prompt="1", TreeAccess=False)
_4 = GetInteger(Slider(36, range=10..100), AtLeast=1, AtMost=1, Maximum=2147483647, Minimum=-2147483648, TreeAccess=False)
get_string = GetString(AtLeast=1, AtMost=1, TreeAccess=False)
_5 = GetInteger(Slider(64, range=10..100), AtLeast=1, AtMost=1, Maximum=2147483647, Minimum=-2147483648, TreeAccess=False)
download_openstreetmap_osm = DownloadOpenStreetMapOSM(LeftBound=panel, RightBound="-122.411595", TopBound="37.799896", BottomBound="37.796666", RunToggle=True)  # -> OSMQueryURL, OSMFilePath
pt = ConstructPoint(XCoordinate=0, YCoordinate=0, ZCoordinate=0)
import_osm_features = ImportOSMFeatures(OSMPathOrURL=download_openstreetmap_osm.OSMQueryURL, OSMFeatureType="amenity", Format="xml", ImportAltitude=True)  # -> Points, Metadata, UTMZone, TranslationVector
import_osm_features_2 = ImportOSMFeatures(OSMPathOrURL=download_openstreetmap_osm.OSMQueryURL, OSMFeatureType="building", Format="xml", ImportAltitude=True)  # -> Points, Metadata, UTMZone, TranslationVector
import_osm_features_3 = ImportOSMFeatures(OSMPathOrURL=download_openstreetmap_osm.OSMQueryURL, OSMFeatureType="street", Format="xml", ImportAltitude=True)  # -> Points, Metadata, UTMZone, TranslationVector
# Terrain
download_dem_and_build_terrain_mesh = DownloadDEMAndBuildTerrainMesh(LeftBound=panel, RightBound="-122.411595", TopBound="37.799896", BottomBound="37.796666", XCount=100, YCount=100)  # -> TerrainMesh, UTMZone, TranslationVector

# ---- group: Embodied Carbon
merge = Merge(Data1=flatten(_2), Data2=flatten(_3), Data3=flatten(_4), Data4=flatten(_5))

# ----
cir = Circle(Plane=pt, Radius=expr("x/2", "20"))
area = Area(Geometry=cir)  # -> Area, Centroid
scale = Scale(Geometry=cir, Center=area.Centroid, Factor=1.5)  # -> Geometry, Transform
darc = DeconstructArc(Arc=scale.Geometry)  # -> BasePlane, Radius, Angle
ma = MassAddition(Input=merge)  # -> Result, PartialResults
expression = Expression(x=darc.Radius, Expression="x/1.5")
division = Division(A=merge, B=ma.Result)
cir_2 = Circle(Plane=area.Centroid, Radius=darc.Radius)
cir_3 = Circle(Plane=area.Centroid, Radius=expression)
ma_2 = MassAddition(Input=division)  # -> Result, PartialResults
eval = EvaluateCurve(Curve=reparameterize(cir_2), Parameter=ma_2.PartialResults)  # -> Point, Tangent, Angle
area_2 = Area(Geometry=cir_2)  # -> Area, Centroid
planar = PlanarSrf(Edges=cir_2)
graft = GraftTree(Tree=cir_2, IncludeEmptyLists=True, IncludeNullItems=True)
graft_2 = GraftTree(Tree=cir_3, IncludeEmptyLists=True, IncludeNullItems=True)
shatter = Shatter(Curve=reparameterize([graft, graft_2]), Parameters=ma_2.PartialResults)
ln = Line(StartPoint=area_2.Centroid, EndPoint=eval.Point)
midpt = CurveMiddle(Curve=shatter)
srfsplit = SurfaceSplit(Surface=planar, Curves=ln)
tstat = TreeStatistics(Tree=simplify(midpt))  # -> Paths, Length, Count
srfsplit_2 = SurfaceSplit(Surface=srfsplit, Curves=cir_3)
item = ListItem(List=tstat.Paths, Index=0, Wrap=True)  # -> Item, Item1
item_2 = ListItem(List=srfsplit_2, Index="1", Wrap=True)
branch = TreeBranch(Tree=simplify(midpt), Path=item.Item, MaintainPaths=True)  # -> flatten(Branch)
branch_2 = TreeBranch(Tree=simplify(midpt), Path=item.Item1, MaintainPaths=True)  # -> flatten(Branch)
area_3 = Area(Geometry=flatten(item_2))  # -> Area, Centroid
ln_2 = Line(StartPoint=flatten(branch), EndPoint=flatten(branch_2))
sort = SortList(Keys=area_3.Area, ValuesA=flatten(item_2))  # -> Keys, ValuesA
wires = BrepWireframe(Brep=item_2, Density=-1)
midpt_2 = CurveMiddle(Curve=ln_2)
mesh = Mesh(sort.ValuesA)

# ---- group: Diagrams Tittles
ma_3 = MassAddition(Input=flatten([_2, _3, _4, _5]))  # -> Result, PartialResults
keys = Panel("Empty lots numbers")
keys_2 = Panel("units")
keys_3 = Panel("Housing")
merge_2 = Merge(Data2=keys_2)
cir_4 = Circle(Plane=area.Centroid, Radius=expression)
concat = Concatenate(FragmentA=keys_3, FragmentB=" ")
merge_3 = Merge(Data1=keys, Data2=ma_3.Result)
darc_2 = DeconstructArc(Arc=cir_4)  # -> BasePlane, Radius, Angle
expression_2 = Expression(x=darc_2.Radius, Expression="x/1.7")
concat_2 = Concatenate(FragmentA=merge_3, FragmentB=merge_2)
cir_5 = Circle(Plane=area.Centroid, Radius=expression_2)
rep = ReplaceText(Text=concat, Find="\"", RecursiveReplace=False)
area_4 = Area(Geometry=cir_5)  # -> Area, Centroid
rep_2 = ReplaceText(Text=rep, Find="{", RecursiveReplace=False)
rep_3 = ReplaceText(Text=concat_2, Find="\"", RecursiveReplace=False)
rep_4 = ReplaceText(Text=rep_2, Find="}", RecursiveReplace=False)
rep_5 = ReplaceText(Text=rep_3, Find="{", RecursiveReplace=False)
rep_6 = ReplaceText(Text=rep_4, Find=":", RecursiveReplace=False)
rep_7 = ReplaceText(Text=rep_5, Find="}", RecursiveReplace=False)
rep_8 = ReplaceText(Text=rep_6, Find=",", RecursiveReplace=False)
rep_9 = ReplaceText(Text=rep_7, Find=":", RecursiveReplace=False)
design_input = Text(rep_8)
rep_10 = ReplaceText(Text=rep_9, Find=",", RecursiveReplace=False)
text2crv = TextOutlines(TextContent=design_input, Plane=area_4.Centroid, Face="Arial", Size="1.5", Bold=False, Italics=True)  # -> TextCurves, TextBoundingBox
design_input_2 = Text(rep_10)
panel_2 = Panel("1")
boundary = BoundarySurfaces(Edges=text2crv.TextCurves)
text2crv_2 = TextOutlines(TextContent=design_input_2, Plane=area_4.Centroid, Face="Arial", Size=panel_2, Bold=False, Italics=True)  # -> TextCurves, TextBoundingBox
pt_2 = Point(Point(-3.50029393, 20.52164189, 0))
area_5 = Area(Geometry=boundary)  # -> Area, Centroid
boundary_2 = BoundarySurfaces(Edges=text2crv_2.TextCurves)
avr = Average(Input=area_5.Centroid)
area_6 = Area(Geometry=boundary_2)  # -> Area, Centroid
move2pt = MoveToPoint(Geometry=boundary, PointA=avr, PointB=pt_2)  # -> Moved, Vector, Transform
avr_2 = Average(Input=area_6.Centroid)
move2pt_2 = MoveToPoint(Geometry=boundary_2, PointA=avr_2, PointB=area_4.Centroid)  # -> Moved, Vector, Transform
mesh_2 = Mesh(move2pt_2.Moved)
mesh_3 = Mesh(move2pt.Moved)
merge_4 = Merge(Data1=mesh_2, Data2=mesh_3, Data5=wires)  # -> flatten(Result)

# ----
polyline = PolyLine(Vertices=import_osm_features_2.Points, Closed=False)
# Streets
polyline_2 = PolyLine(Vertices=import_osm_features_3.Points, Closed=False)
create_building = CreateBuilding(BuildingCurve=polyline, Metadata=import_osm_features_2.Metadata)
create_street_network = CreateStreetNetwork(
    StreetCurves=flatten(polyline_2),
    Metadata=flatten(import_osm_features_3.Metadata),
    SplitStreetCurves=True,
    UTMZone=import_osm_features_3.UTMZone,
    TranslationVector=import_osm_features_3.TranslationVector)  # -> StreetNetwork, StreetSegmentCurves, UTMZone, TranslationVector
# Buildings
inspect_building = InspectBuilding(Building=create_building, DefaultHeight=10)  # -> Geometry, Metadata, Amenity, BuildingMesh
point = Point(<point referenced from the Rhino model>)
point_2 = Point(<point referenced from the Rhino model>)
router = Router(RouterUrbanoModelOrStreetNetwork=create_street_network.StreetNetwork, Origin=point_2, Destination=point, TimeLimit=-1)  # -> Trip, Route, Time, Distance

# ---- group: Download OSM
download_openstreetmap_osm_2 = DownloadOpenStreetMapOSM(LeftBound="-73.985", RightBound="-73.98", TopBound="40.725", BottomBound="40.72", RunToggle=True)  # -> OSMQueryURL, OSMFilePath

# ---- group: Alternative Way to Import Network
# (Shortcut if you don't want to
# modify any street network data.
# Does not offer altitude info in the current version)
import_osm_street_network = ImportOSMStreetNetwork(OSMPathOrURL=download_openstreetmap_osm_2.OSMQueryURL)  # -> StreetNetwork, StreetSegmentCurves, UTMZone, TranslationVector
street_network = StreetNetwork(import_osm_street_network.StreetNetwork)

# ---- group: Import Geometries
import_osm_features_4 = ImportOSMFeatures(OSMPathOrURL=download_openstreetmap_osm_2.OSMQueryURL, OSMFeatureType="amenity", Format="xml", ImportAltitude=False)  # -> Points, Metadata, UTMZone, TranslationVector
import_osm_features_5 = ImportOSMFeatures(OSMPathOrURL=download_openstreetmap_osm_2.OSMQueryURL, OSMFeatureType="building", Format="xml", ImportAltitude=False)  # -> Points, Metadata, UTMZone, TranslationVector
import_osm_features_6 = ImportOSMFeatures(OSMPathOrURL=download_openstreetmap_osm_2.OSMQueryURL, OSMFeatureType="street", Format="xml", ImportAltitude=False)  # -> Points, Metadata, UTMZone, TranslationVector

# ---- group: Build Basic Model
# Turn on build toggle
polyline_3 = PolyLine(Vertices=import_osm_features_5.Points, Closed=False)
create_amenity = CreateAmenity(PointLocationOfAmenity=import_osm_features_4.Points, Metadata=import_osm_features_4.Metadata)
polyline_4 = PolyLine(Vertices=import_osm_features_6.Points, Closed=False)
create_street_network_2 = CreateStreetNetwork(
    StreetCurves=flatten(polyline_4),
    Metadata=flatten(import_osm_features_6.Metadata),
    SplitStreetCurves=True,
    UTMZone=import_osm_features_6.UTMZone,
    TranslationVector=import_osm_features_6.TranslationVector)  # -> StreetNetwork, StreetSegmentCurves, UTMZone, TranslationVector
arrange_amenities_by_building = ArrangeAmenitiesByBuilding(Amenities=flatten(create_amenity), Buildings=flatten(polyline_3))  # -> AmenitiesByBuilding, Buildings
create_building_2 = CreateBuilding(
    BuildingCurve=arrange_amenities_by_building.Buildings,
    Metadata=import_osm_features_5.Metadata,
    AmenitiesInBuilding=arrange_amenities_by_building.AmenitiesByBuilding)
build_urbano_model = BuildUrbanoModel(Buildings=flatten(create_building_2), StreetNetwork=create_street_network_2.StreetNetwork, BuildToggle=True)  # -> UrbanoModel, BuildingCurves, Activities
inspect_building_2 = InspectBuilding(Building=create_building_2, DefaultHeight=10)  # -> Geometry, Metadata, Amenity, BuildingMesh

# ----
demeta = DeconstructMetadata(Metadata=import_osm_features_4.Metadata)  # -> Keys, Values
panel_3 = Panel(demeta.Values)
panel_4 = Panel(demeta.Keys)

# ---- group: Carbon Values - Schedule
Z = UnitZ(Factor=".05")
move = Move(Geometry=midpt_2, Motion=Z)  # -> Geometry, Transform
item_3 = ListItem(List=move.Geometry, Index=0, Wrap=True)  # -> Item, Item1, Item2, Item3
panel_5 = Panel("#")
panel_6 = Panel(".6")

pt_3 = Point(Point(-8.744513178, -25.27510419, 0))
merge_5 = Merge(Data1=flatten(_2), Data2=flatten(_3), Data3=flatten(_4), Data4=flatten(_5))
concat_3 = Concatenate(FragmentB=merge_5, FragmentD=panel_5)
panel_7 = Panel(""" 
 
 
 """)
panel_8 = Panel("""Concrete EC:      
MetalDeck EC:    
Steel EC:            
Rebar EC:      """)
concat_4 = Concatenate(FragmentA=concat_3, FragmentB=panel_7)
concat_5 = Concatenate(FragmentA=_2, FragmentB=panel_5)
concat_6 = Concatenate(FragmentA=panel_8, FragmentB=panel_7)
concat_7 = Concatenate(FragmentA=_3, FragmentB=panel_5)
concat_8 = Concatenate(FragmentA=_4, FragmentB=panel_5)
concat_9 = Concatenate(FragmentA=_5, FragmentB=panel_5)
rep_11 = ReplaceText(Text=concat_4, Find="\"", RecursiveReplace=False)
rep_12 = ReplaceText(Text=concat_6, Find="\"", RecursiveReplace=False)
rep_13 = ReplaceText(Text=rep_11, Find="{", RecursiveReplace=False)
rep_14 = ReplaceText(Text=rep_12, Find="{", RecursiveReplace=False)
rep_15 = ReplaceText(Text=rep_13, Find="}", RecursiveReplace=False)
rep_16 = ReplaceText(Text=rep_14, Find="}", RecursiveReplace=False)
rep_17 = ReplaceText(Text=rep_15, Find=":", RecursiveReplace=False)
rep_18 = ReplaceText(Text=rep_16, Find=":", RecursiveReplace=False)
rep_19 = ReplaceText(Text=rep_17, Find=",", RecursiveReplace=False)
rep_20 = ReplaceText(Text=rep_18, Find=",", RecursiveReplace=False)
design_input_3 = Text(rep_19)
design_input_4 = Text(rep_20)
text2crv_3 = TextOutlines(TextContent=concat_5, Plane=item_3.Item, Face="Arial", Size=panel_6, Bold=False, Italics=True)  # -> TextCurves, TextBoundingBox
text2crv_4 = TextOutlines(TextContent=concat_7, Plane=item_3.Item1, Face="Arial", Size=panel_6, Bold=False, Italics=True)  # -> TextCurves, TextBoundingBox
text2crv_5 = TextOutlines(TextContent=design_input_4, Plane=pt_3, Face="Arial", Size=panel_2, Bold=False, Italics=True)  # -> TextCurves, TextBoundingBox
text2crv_6 = TextOutlines(TextContent=concat_8, Plane=item_3.Item2, Face="Arial", Size=panel_6, Bold=False, Italics=True)  # -> TextCurves, TextBoundingBox
text2crv_7 = TextOutlines(TextContent=design_input_3, Plane=pt_3, Face="Arial", Size=panel_2, Bold=False, Italics=True)  # -> TextCurves, TextBoundingBox
text2crv_8 = TextOutlines(TextContent=concat_9, Plane=item_3.Item3, Face="Arial", Size=panel_6, Bold=False, Italics=True)  # -> TextCurves, TextBoundingBox
boundary_3 = BoundarySurfaces(Edges=text2crv_3.TextCurves)
boundary_4 = BoundarySurfaces(Edges=text2crv_7.TextCurves)
boundary_5 = BoundarySurfaces(Edges=text2crv_6.TextCurves)
boundary_6 = BoundarySurfaces(Edges=text2crv_4.TextCurves)
boundary_7 = BoundarySurfaces(Edges=text2crv_8.TextCurves)
boundary_8 = BoundarySurfaces(Edges=text2crv_5.TextCurves)
area_7 = Area(Geometry=boundary_7)  # -> Area, Centroid
area_8 = Area(Geometry=boundary_6)  # -> Area, Centroid
area_9 = Area(Geometry=boundary_3)  # -> Area, Centroid
area_10 = Area(Geometry=boundary_5)  # -> Area, Centroid
pdecon = Deconstruct(Point=pt_3)  # -> XComponent, YComponent, ZComponent
avr_3 = Average(Input=area_7.Centroid)
avr_4 = Average(Input=area_8.Centroid)
avr_5 = Average(Input=area_10.Centroid)
avr_6 = Average(Input=area_9.Centroid)
area_11 = Area(Geometry=boundary_8)  # -> Area, Centroid
area_12 = Area(Geometry=boundary_4)  # -> Area, Centroid
addition = Addition(A=pdecon.XComponent, B=11)
move2pt_3 = MoveToPoint(Geometry=boundary_7, PointA=avr_3, PointB=item_3.Item3)  # -> Moved, Vector, Transform
move2pt_4 = MoveToPoint(Geometry=boundary_5, PointA=avr_5, PointB=item_3.Item2)  # -> Moved, Vector, Transform
pt_4 = ConstructPoint(XCoordinate=addition, YCoordinate=pdecon.YComponent, ZCoordinate=pdecon.ZComponent)
move2pt_5 = MoveToPoint(Geometry=boundary_3, PointA=avr_6, PointB=item_3.Item)  # -> Moved, Vector, Transform
avr_7 = Average(Input=area_11.Centroid)
avr_8 = Average(Input=area_12.Centroid)
move2pt_6 = MoveToPoint(Geometry=boundary_6, PointA=avr_4, PointB=item_3.Item1)  # -> Moved, Vector, Transform
move2pt_7 = MoveToPoint(Geometry=boundary_4, PointA=avr_8, PointB=pt_4)  # -> Moved, Vector, Transform
move2pt_8 = MoveToPoint(Geometry=boundary_8, PointA=avr_7, PointB=pt_3)  # -> Moved, Vector, Transform
mesh_4 = Mesh(move2pt_5.Moved)
mesh_5 = Mesh(move2pt_6.Moved)
mesh_6 = Mesh(move2pt_8.Moved)
mesh_7 = Mesh(move2pt_7.Moved)
mesh_8 = Mesh(move2pt_4.Moved)
mesh_9 = Mesh(move2pt_3.Moved)

# ---- group: Carbon Values - Schedule / Text ScaleF
panel_9 = Panel("0.2")

# ----
panel_10 = Panel(build_urbano_model.UrbanoModel)
panel_11 = Panel(inspect_building_2.BuildingMesh)
merge_6 = Merge(Data1=mesh_6, Data2=mesh_7, Data3=mesh_4, Data4=mesh_5, Data5=mesh_8, Data6=mesh_9)
_2_2 = ContextBake(Geometry=merge_6)
_3_2 = ContextBake(Geometry=mesh)
_1 = ContextBake(Geometry=merge_4)
item_4 = ListItem(List=mesh, Index=0, Wrap=True)  # -> Item, Item1, Item2, Item3
swatch = ColourSwatch(SwatchColor=RGB(0, 0, 0))
previewlw = CustomPreviewLineweights(Geometry=geo, Shader=swatch, Absolute=False)
preview = CustomPreview(Geometry=[merge_4, merge_6], Material=swatch)
preview_2 = CustomPreview(Geometry=item_4.Item, Material=ColourSwatch(SwatchColor=RGB(38, 147, 255)))
preview_3 = CustomPreview(Geometry=item_4.Item1, Material=ColourSwatch(SwatchColor=RGB(194, 83, 157)))
preview_4 = CustomPreview(Geometry=item_4.Item2, Material=ColourSwatch(SwatchColor=RGB(128, 234, 255)))
preview_5 = CustomPreview(Geometry=item_4.Item3, Material=ColourSwatch(SwatchColor=RGB(126, 84, 158)))
