# Grasshopper definition dataM_M1-AR_v3.gh (Grasshopper 1.0.7)
# plug-ins: Wombat, Pufferfish, ShapeDiverForGrasshopper, Urbano, Human, eleFront, MeshEdit Components

# HousingPulse
sddp = ShapeDiverDocumentPayload({AbsoluteTolerance=0, AngleTolerance=0, DistanceDisplayPrecision=0, GltfVersion="Gltf2", GrasshopperVersion="1.0.0007", InputGroups="{}", OutputGroups="{}", RelativeTolerance=0, RhinoVersion="7.29.23107.3001", UnitSystem=0, VersionCreated="1.14.0.0", VersionSaved="1.14.0.0"})
# GRAPHICS
number_slider = Slider(10, range=10..100)
_6k_areas = GetInteger(Slider(36, range=10..100), AtLeast=1, AtMost=1, Maximum=2147483647, Minimum=-2147483648, TreeAccess=False)
_10k_and_above = GetInteger(Slider(64, range=10..100), AtLeast=1, AtMost=1, Maximum=2147483647, Minimum=-2147483648, TreeAccess=False)
empty_lots = GetInteger(number_slider, AtLeast=1, AtMost=1, Maximum=2147483647, Minimum=-2147483648, TreeAccess=False)
_3k_areas = GetInteger(Slider(36, range=10..100), AtLeast=1, AtMost=1, Maximum=2147483647, Minimum=-2147483648, TreeAccess=False)
pt = ConstructPoint(XCoordinate=0, YCoordinate=0, ZCoordinate=0)

# ---- group: Embodied Carbon
merge = Merge(Data1=flatten(empty_lots), Data2=flatten(_3k_areas), Data3=flatten(_6k_areas), Data4=flatten(_10k_and_above))

# ----
cir = Circle(Plane=pt, Radius=expr("x/2", "20"))
area = Area(Geometry=cir)  # -> Area, Centroid
scale = Scale(Geometry=cir, Center=area.Centroid, Factor=1.5)  # -> Geometry, Transform
darc = DeconstructArc(Arc=scale.Geometry)  # -> BasePlane, Radius, Angle
ma = MassAddition(Input=merge)  # -> Result, PartialResults
expression = Expression(x=darc.Radius, Expression="x/1.5")
division = Division(A=merge, B=ma.Result)
cir_2 = Circle(Plane=area.Centroid, Radius=darc.Radius)
cir_3 = Circle(Plane=area.Centroid, Radius=expression)
ma_2 = MassAddition(Input=division)  # -> Result, PartialResults
eval = EvaluateCurve(Curve=reparameterize(cir_2), Parameter=ma_2.PartialResults)  # -> Point, Tangent, Angle
area_2 = Area(Geometry=cir_2)  # -> Area, Centroid
planar = PlanarSrf(Edges=cir_2)
graft = GraftTree(Tree=cir_2, IncludeEmptyLists=True, IncludeNullItems=True)
graft_2 = GraftTree(Tree=cir_3, IncludeEmptyLists=True, IncludeNullItems=True)
shatter = Shatter(Curve=reparameterize([graft, graft_2]), Parameters=ma_2.PartialResults)
ln = Line(StartPoint=area_2.Centroid, EndPoint=eval.Point)
midpt = CurveMiddle(Curve=shatter)
srfsplit = SurfaceSplit(Surface=planar, Curves=ln)
tstat = TreeStatistics(Tree=simplify(midpt))  # -> Paths, Length, Count
srfsplit_2 = SurfaceSplit(Surface=srfsplit, Curves=cir_3)
item = ListItem(List=tstat.Paths, Index=0, Wrap=True)  # -> Item, Item1
item_2 = ListItem(List=srfsplit_2, Index="1", Wrap=True)
branch = TreeBranch(Tree=simplify(midpt), Path=item.Item, MaintainPaths=True)  # -> flatten(Branch)
branch_2 = TreeBranch(Tree=simplify(midpt), Path=item.Item1, MaintainPaths=True)  # -> flatten(Branch)
area_3 = Area(Geometry=flatten(item_2))  # -> Area, Centroid
ln_2 = Line(StartPoint=flatten(branch), EndPoint=flatten(branch_2))
sort = SortList(Keys=area_3.Area, ValuesA=flatten(item_2))  # -> Keys, ValuesA
wires = BrepWireframe(Brep=item_2, Density=-1)
midpt_2 = CurveMiddle(Curve=ln_2)
mesh = Mesh(sort.ValuesA)

# ---- group: Diagrams Tittles
keys = Panel("Embodied Carbon Chart")
ma_3 = MassAddition(Input=flatten([empty_lots, _3k_areas, _6k_areas, _10k_and_above]))  # -> Result, PartialResults
keys_2 = Panel(" Total Project EC")
keys_3 = Panel("kgsm/CO2")
merge_2 = Merge(Data2=keys_3)
cir_4 = Circle(Plane=area.Centroid, Radius=expression)
concat = Concatenate(FragmentA=keys, FragmentB=" ")
merge_3 = Merge(Data1=keys_2, Data2=ma_3.Result)
darc_2 = DeconstructArc(Arc=cir_4)  # -> BasePlane, Radius, Angle
expression_2 = Expression(x=darc_2.Radius, Expression="x/1.7")
concat_2 = Concatenate(FragmentA=merge_3, FragmentB=merge_2)
cir_5 = Circle(Plane=area.Centroid, Radius=expression_2)
rep = ReplaceText(Text=concat, Find="\"", RecursiveReplace=False)
area_4 = Area(Geometry=cir_5)  # -> Area, Centroid
rep_2 = ReplaceText(Text=rep, Find="{", RecursiveReplace=False)
rep_3 = ReplaceText(Text=concat_2, Find="\"", RecursiveReplace=False)
rep_4 = ReplaceText(Text=rep_2, Find="}", RecursiveReplace=False)
rep_5 = ReplaceText(Text=rep_3, Find="{", RecursiveReplace=False)
rep_6 = ReplaceText(Text=rep_4, Find=":", RecursiveReplace=False)
rep_7 = ReplaceText(Text=rep_5, Find="}", RecursiveReplace=False)
rep_8 = ReplaceText(Text=rep_6, Find=",", RecursiveReplace=False)
rep_9 = ReplaceText(Text=rep_7, Find=":", RecursiveReplace=False)
design_input = Text(rep_8)
rep_10 = ReplaceText(Text=rep_9, Find=",", RecursiveReplace=False)
text2crv = TextOutlines(TextContent=design_input, Plane=area_4.Centroid, Face="Arial", Size="1.5", Bold=False, Italics=True)  # -> TextCurves, TextBoundingBox
design_input_2 = Text(rep_10)
panel = Panel("1")
boundary = BoundarySurfaces(Edges=text2crv.TextCurves)
text2crv_2 = TextOutlines(TextContent=design_input_2, Plane=area_4.Centroid, Face="Arial", Size=panel, Bold=False, Italics=True)  # -> TextCurves, TextBoundingBox
pt_2 = Point(Point(-3.50029393, 20.52164189, 0))
area_5 = Area(Geometry=boundary)  # -> Area, Centroid
boundary_2 = BoundarySurfaces(Edges=text2crv_2.TextCurves)
avr = Average(Input=area_5.Centroid)
area_6 = Area(Geometry=boundary_2)  # -> Area, Centroid
move2pt = MoveToPoint(Geometry=boundary, PointA=avr, PointB=pt_2)  # -> Moved, Vector, Transform
avr_2 = Average(Input=area_6.Centroid)
move2pt_2 = MoveToPoint(Geometry=boundary_2, PointA=avr_2, PointB=area_4.Centroid)  # -> Moved, Vector, Transform
mesh_2 = Mesh(move2pt_2.Moved)
mesh_3 = Mesh(move2pt.Moved)
merge_4 = Merge(Data1=concat_2, Data2=mesh_3, Data5=wires)  # -> flatten(Result)

# ----
context_bake = ContextBake()
objatts = ObjectAttributes()  # -> Name, LayerName, LayerFullPath, Color, MaterialName, LinetypeName, GroupIndices, PlotWeight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

# ---- group: Carbon Values - Schedule
Z = UnitZ(Factor=".05")
move = Move(Geometry=midpt_2, Motion=Z)  # -> Geometry, Transform
item_3 = ListItem(List=move.Geometry, Index=0, Wrap=True)  # -> Item, Item1, Item2, Item3
panel_2 = Panel(" kgsm")
panel_3 = Panel(".6")

pt_3 = Point(Point(-8.744513178, -25.27510419, 0))
merge_5 = Merge(Data1=flatten(empty_lots), Data2=flatten(_3k_areas), Data3=flatten(_6k_areas), Data4=flatten(_10k_and_above))
concat_3 = Concatenate(FragmentB=merge_5, FragmentD=panel_2)
panel_4 = Panel(""" 
 
 
 """)
panel_5 = Panel("""Concrete EC:      
MetalDeck EC:    
Steel EC:            
Rebar EC:      """)
concat_4 = Concatenate(FragmentA=concat_3, FragmentB=panel_4)
concat_5 = Concatenate(FragmentA=empty_lots, FragmentB=panel_2)
concat_6 = Concatenate(FragmentA=panel_5, FragmentB=panel_4)
concat_7 = Concatenate(FragmentA=_3k_areas, FragmentB=panel_2)
concat_8 = Concatenate(FragmentA=_6k_areas, FragmentB=panel_2)
concat_9 = Concatenate(FragmentA=_10k_and_above, FragmentB=panel_2)
rep_11 = ReplaceText(Text=concat_4, Find="\"", RecursiveReplace=False)
rep_12 = ReplaceText(Text=concat_6, Find="\"", RecursiveReplace=False)
rep_13 = ReplaceText(Text=rep_11, Find="{", RecursiveReplace=False)
rep_14 = ReplaceText(Text=rep_12, Find="{", RecursiveReplace=False)
rep_15 = ReplaceText(Text=rep_13, Find="}", RecursiveReplace=False)
rep_16 = ReplaceText(Text=rep_14, Find="}", RecursiveReplace=False)
rep_17 = ReplaceText(Text=rep_15, Find=":", RecursiveReplace=False)
rep_18 = ReplaceText(Text=rep_16, Find=":", RecursiveReplace=False)
rep_19 = ReplaceText(Text=rep_17, Find=",", RecursiveReplace=False)
rep_20 = ReplaceText(Text=rep_18, Find=",", RecursiveReplace=False)
design_input_3 = Text(rep_19)
design_input_4 = Text(rep_20)
text2crv_3 = TextOutlines(TextContent=concat_5, Plane=item_3.Item, Face="Arial", Size=panel_3, Bold=False, Italics=True)  # -> TextCurves, TextBoundingBox
text2crv_4 = TextOutlines(TextContent=concat_7, Plane=item_3.Item1, Face="Arial", Size=panel_3, Bold=False, Italics=True)  # -> TextCurves, TextBoundingBox
text2crv_5 = TextOutlines(TextContent=design_input_4, Plane=pt_3, Face="Arial", Size=panel, Bold=False, Italics=True)  # -> TextCurves, TextBoundingBox
text2crv_6 = TextOutlines(TextContent=concat_8, Plane=item_3.Item2, Face="Arial", Size=panel_3, Bold=False, Italics=True)  # -> TextCurves, TextBoundingBox
text2crv_7 = TextOutlines(TextContent=design_input_3, Plane=pt_3, Face="Arial", Size=panel, Bold=False, Italics=True)  # -> TextCurves, TextBoundingBox
text2crv_8 = TextOutlines(TextContent=concat_9, Plane=item_3.Item3, Face="Arial", Size=panel_3, Bold=False, Italics=True)  # -> TextCurves, TextBoundingBox
boundary_3 = BoundarySurfaces(Edges=text2crv_3.TextCurves)
boundary_4 = BoundarySurfaces(Edges=text2crv_7.TextCurves)
boundary_5 = BoundarySurfaces(Edges=text2crv_6.TextCurves)
boundary_6 = BoundarySurfaces(Edges=text2crv_4.TextCurves)
boundary_7 = BoundarySurfaces(Edges=text2crv_8.TextCurves)
boundary_8 = BoundarySurfaces(Edges=text2crv_5.TextCurves)
area_7 = Area(Geometry=boundary_7)  # -> Area, Centroid
area_8 = Area(Geometry=boundary_6)  # -> Area, Centroid
area_9 = Area(Geometry=boundary_3)  # -> Area, Centroid
area_10 = Area(Geometry=boundary_5)  # -> Area, Centroid
pdecon = Deconstruct(Point=pt_3)  # -> XComponent, YComponent, ZComponent
avr_3 = Average(Input=area_7.Centroid)
avr_4 = Average(Input=area_8.Centroid)
avr_5 = Average(Input=area_10.Centroid)
avr_6 = Average(Input=area_9.Centroid)
area_11 = Area(Geometry=boundary_8)  # -> Area, Centroid
area_12 = Area(Geometry=boundary_4)  # -> Area, Centroid
addition = Addition(A=pdecon.XComponent, B=11)
move2pt_3 = MoveToPoint(Geometry=boundary_7, PointA=avr_3, PointB=item_3.Item3)  # -> Moved, Vector, Transform
move2pt_4 = MoveToPoint(Geometry=boundary_5, PointA=avr_5, PointB=item_3.Item2)  # -> Moved, Vector, Transform
pt_4 = ConstructPoint(XCoordinate=addition, YCoordinate=pdecon.YComponent, ZCoordinate=pdecon.ZComponent)
move2pt_5 = MoveToPoint(Geometry=boundary_3, PointA=avr_6, PointB=item_3.Item)  # -> Moved, Vector, Transform
avr_7 = Average(Input=area_11.Centroid)
avr_8 = Average(Input=area_12.Centroid)
move2pt_6 = MoveToPoint(Geometry=boundary_6, PointA=avr_4, PointB=item_3.Item1)  # -> Moved, Vector, Transform
move2pt_7 = MoveToPoint(Geometry=boundary_4, PointA=avr_8, PointB=pt_4)  # -> Moved, Vector, Transform
move2pt_8 = MoveToPoint(Geometry=boundary_8, PointA=avr_7, PointB=pt_3)  # -> Moved, Vector, Transform
mesh_4 = Mesh(move2pt_5.Moved)
mesh_5 = Mesh(move2pt_6.Moved)
mesh_6 = Mesh(move2pt_8.Moved)
mesh_7 = Mesh(move2pt_7.Moved)
mesh_8 = Mesh(move2pt_4.Moved)
mesh_9 = Mesh(move2pt_3.Moved)

# ----
number_slider_2 = Slider(1, range=0..10)

# ---- group: Carbon Values - Schedule / Text ScaleF
panel_6 = Panel("0.2")

# ----
encodedfile = GetString(AtLeast=1, AtMost=1, TreeAccess=False)

# ---- group: just to test
path = FilePath("C:\Users\ARoncal\OneDrive - Thornton Tomasetti, Inc\__License Resources\Desktop\datamgnt\bimsc24-datamgmt-session06\src\assets\rhino_input.3dm")

# ----
Y = GetNumber(number_slider_2, AtLeast=1, AtMost=1, Maximum=1.797693135e+308, Minimum=-1.797693135e+308, TreeAccess=False)
Z_2 = GetNumber(number_slider_2, AtLeast=1, AtMost=1, Maximum=1.797693135e+308, Minimum=-1.797693135e+308, TreeAccess=False)
X = GetNumber(number_slider_2, AtLeast=1, AtMost=1, Maximum=1.797693135e+308, Minimum=-1.797693135e+308, TreeAccess=False)
# no points allowed in 3dm!
python = GhPythonScript(data=encodedfile, FP=path)  # -> out, geom, layerIndex, layers, layerColor
# ---------- python: Python ----------
import System
import Rhino

#load Rhino file from string, or from local path
try:
    b64 = System.Convert.FromBase64String(data)
    _dmfile = Rhino.FileIO.File3dm.FromByteArray(b64)
except:
    _dmfile = Rhino.FileIO.File3dm.Read(FP)
    print _dmfile



objtable = _dmfile.Objects
geom = []
geomLayerIndexList = []

#get objects from document
for obj in objtable:
    
    if not isinstance(obj.Geometry,Rhino.Geometry.InstanceReferenceGeometry):
        #get user strings from document and assign to geometry
        for k in obj.Attributes.GetUserStrings().AllKeys:
            value =  obj.Attributes.GetUserString(k)
            obj.Geometry.SetUserString(k, value)
       
        geom.append(obj.Geometry)
        geomLayerIndexList.append(obj.Attributes.LayerIndex)
        

geom_= geom
layerIndex_ = geomLayerIndexList

#get layer information
layers = []
layerColor = []
for l in _dmfile.Layers:
    layerColor.append(l.Color)
    layers.append(l)
    
    
layers_ = layers
layerColor_  = layerColor
# ---------- end python ----------
list = ValueList({"Mesh": 0, "Brep": 1, "SubD": 2, "Curve": 3}, selected="Mesh")
type = GetString(list, AtLeast=1, AtMost=1, TreeAccess=False)

# ---- group: filter by type
python_2 = GhPythonScript(type=type, geo=python.geom)  # -> out, filter_geo, unfiltered; inputs type: Int32, geo: list of GeometryBase
# ---------- python_2: Python ----------
import Rhino.Geometry as rg
import rhinoscriptsyntax as rs

filter_geo= []
unfiltered = []
geo_types = ["Mesh", "Brep", "SubD", "NurbsCurve" ]

for g in geo:
    
    g = rs.coercegeometry(g)
    
    if type(g).__name__ == geo_types[_type]:

        filter_geo.append(g)
    else:
        unfiltered.append(g)
        
filter_geo_ = filter_geo
unfiltered_ = unfiltered
# ---------- end python_2 ----------

# ----
python_3 = GhPythonScript(geoms=python.geom, user_key="name")  # -> out, user_values; inputs geoms: list of GeometryBase
# ---------- python_3: Python ----------
user_values = []

for g in geoms:
    user_values.append( g.GetUserString(user_key))


user_values_ = user_values
# ---------- end python_3 ----------
panel_7 = Panel(python.geom)
scale_nu = ScaleNU(Geometry=python_2.filter_geo, Plane=PlaneXY(0, 0, 0), ScaleX=X, ScaleY=Y, ScaleZ=Z_2)  # -> Geometry, Transform
panel_8 = Panel(python_3.user_values)
mesh_10 = Mesh(scale_nu.Geometry)

# ---- group: convert breps to meshes
python_4 = GhPythonScript(geo=scale_nu.Geometry)  # -> out, converted; inputs geo: list of GeometryBase
# ---------- python_4: Python ----------
import Rhino.Geometry as rg

def convertBrepToMesh(brep):

    mp = rg.MeshingParameters.Coarse
    g = rg.Mesh.CreateFromBrep(brep, mp)
    newm = rg.Mesh()
    for meshes in g:
        newm.Append(meshes)
    return newm
    
converted = []

for g in geo:
    if type(g).__name__ == "Brep":
        try:
            mesh =convertBrepToMesh(g)
            
            converted.append(mesh)
        except:
            continue
    else:
        converted.append(g)

converted_ = converted
# ---------- end python_4 ----------

# ----
null = NullItem(Item=mesh_10)  # -> NullFlags, InvalidFlags, Description
ma_4 = MassAddition(Input=null.NullFlags)  # -> Result, PartialResults
larger = LargerThan(FirstNumber=ma_4.Result, SecondNumber=0)  # -> LargerThan, OrEqualTo
filter = StreamFilter(Gate=larger.LargerThan, Stream0="All good!", Stream1="Wrong input geometry!")
context_bake_2 = ContextBake(ScaledGeo=python_4.converted)
panel_9 = Panel(filter)
context_print = ContextPrint(Errors=filter)
merge_6 = Merge(Data1=mesh_6, Data2=mesh_7, Data3=mesh_4, Data4=mesh_5, Data5=mesh_8, Data6=mesh_9)
panel_10 = Panel(merge_6)
context_bake_3 = ContextBake(Geometry2=merge_6)
context_bake_4 = ContextBake(Geometry3=mesh)
context_bake_5 = ContextBake(Geometry1=merge_4)

# ---- group: Download OSM
panel_11 = Panel("40.725")
panel_12 = Panel("40.72")
panel_13 = Panel("-73.98")
panel_14 = Panel("-73.985")

# ----
top_bound = GetString(panel_11, AtLeast=1, AtMost=1, TreeAccess=False)
bottom_bound = GetString(panel_12, AtLeast=1, AtMost=1, TreeAccess=False)
right_bound = GetString(panel_13, AtLeast=1, AtMost=1, TreeAccess=False)
left_bound = GetString(panel_14, AtLeast=1, AtMost=1, TreeAccess=False)

# ---- group: Download OSM (continued)
download_openstreetmap_osm = DownloadOpenStreetMapOSM(LeftBound=left_bound, RightBound=right_bound, TopBound=top_bound, BottomBound=bottom_bound, RunToggle=True)  # -> OSMQueryURL, OSMFilePath

# ---- group: Alternative Way to Import Network
# (Shortcut if you don't want to
# modify any street network data.
# Does not offer altitude info in the current version)
import_osm_street_network = ImportOSMStreetNetwork(OSMPathOrURL=download_openstreetmap_osm.OSMQueryURL)  # -> StreetNetwork, StreetSegmentCurves, UTMZone, TranslationVector
street_network = StreetNetwork(import_osm_street_network.StreetNetwork)

# ---- group: Import Geometries
import_osm_features = ImportOSMFeatures(OSMPathOrURL=download_openstreetmap_osm.OSMQueryURL, OSMFeatureType="amenity", Format="xml", ImportAltitude=False)  # -> Points, Metadata, UTMZone, TranslationVector
import_osm_features_2 = ImportOSMFeatures(OSMPathOrURL=download_openstreetmap_osm.OSMQueryURL, OSMFeatureType="building", Format="xml", ImportAltitude=False)  # -> Points, Metadata, UTMZone, TranslationVector
import_osm_features_3 = ImportOSMFeatures(OSMPathOrURL=download_openstreetmap_osm.OSMQueryURL, OSMFeatureType="street", Format="xml", ImportAltitude=False)  # -> Points, Metadata, UTMZone, TranslationVector

# ---- group: Build Basic Model
# Turn on build toggle
polyline = PolyLine(Vertices=import_osm_features_2.Points, Closed=False)
create_amenity = CreateAmenity(PointLocationOfAmenity=import_osm_features.Points, Metadata=import_osm_features.Metadata)
polyline_2 = PolyLine(Vertices=import_osm_features_3.Points, Closed=False)
create_street_network = CreateStreetNetwork(
    StreetCurves=flatten(polyline_2),
    Metadata=flatten(import_osm_features_3.Metadata),
    SplitStreetCurves=True,
    UTMZone=import_osm_features_3.UTMZone,
    TranslationVector=import_osm_features_3.TranslationVector)  # -> StreetNetwork, StreetSegmentCurves, UTMZone, TranslationVector
arrange_amenities_by_building = ArrangeAmenitiesByBuilding(Amenities=flatten(create_amenity), Buildings=flatten(polyline))  # -> AmenitiesByBuilding, Buildings
create_building = CreateBuilding(
    BuildingCurve=arrange_amenities_by_building.Buildings,
    Metadata=import_osm_features_2.Metadata,
    AmenitiesInBuilding=arrange_amenities_by_building.AmenitiesByBuilding)
build_urbano_model = BuildUrbanoModel(Buildings=flatten(create_building), StreetNetwork=create_street_network.StreetNetwork, BuildToggle=True)  # -> UrbanoModel, BuildingCurves, Activities
inspect_building = InspectBuilding(Building=create_building, DefaultHeight=10)  # -> Geometry, Metadata, Amenity, BuildingMesh

# ----
demeta = DeconstructMetadata(Metadata=import_osm_features.Metadata)  # -> Keys, Values
panel_15 = Panel(demeta.Values)
panel_16 = Panel(demeta.Keys)
createatts = CreateAttributes(UserDataKeys=demeta.Keys, UserDataValues=demeta.Values, enableFullPath=False)
geo = Geometry(inspect_building.BuildingMesh)
volume = MeshVolume(Mesh=geo)  # -> Volume, Centroid
panel_17 = Panel(build_urbano_model.UrbanoModel)
panel_18 = Panel(inspect_building.BuildingMesh)
panel_19 = Panel(createatts)
ef_att = EleFrontAttributes(Keys="vol", Values=graft(volume.Volume))  # -> flatten(Attributes), Keys, Values, Name, Layer, ColourSource, DisplayColour, MaterialSource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
getkv = GetAllKeysValues(AttributesOrAttributedGeometry=geo)  # -> Keys, Values, BakeName
attatt = AttachAttributes(Geometry=geo, Attributes=ef_att.Attributes)
panel_20 = Panel(getkv.Keys)
bake = BakeObjects(Geometry=attatt, Bake=False, createGroups=False)  # -> Message, Guids
panel_21 = Panel(bake.Message)
