# Grasshopper definition dataM_M1-AR_v7.gh (Grasshopper 1.0.7)
# plug-ins: ShapeDiverForGrasshopper, Urbano, LunchBox

# HousingPulse
sddp = ShapeDiverDocumentPayload({AbsoluteTolerance=0, AngleTolerance=0, DistanceDisplayPrecision=0, GltfVersion="Gltf2", GrasshopperVersion="1.0.0007", InputGroups="{}", OutputGroups="{}", RelativeTolerance=0, RhinoVersion="7.29.23107.3001", UnitSystem=0, VersionCreated="1.14.0.0", VersionSaved="1.14.0.0"})

panel = Panel("C:\Users\ARoncal\OneDrive - Thornton Tomasetti, Inc\__License Resources\Desktop\datamgnt\bimsc24-final-project\src\submissions\andresroncal\assets\rollingsales_brooklyn.csv")  # disabled
toggle = BooleanToggle(False)  # disabled
excelread = ExcelReader(ReadExcelData=toggle, WorkbookPath=panel, WorksheetName="rollingsales_brooklyn")  # -> Exceptions, ExcelData; disabled
txt = Text(Tree({0}: ["Brooklyn Rolling Sales.  All Sales From February 2023 - January 2024", "For sales prior to the Final Roll, Neighborhood Name and Descriptive Data reflect the most recent Final Roll.         Sales after the Final Roll, Neighborhood Name and Descriptive Data reflect current data.", "Building Class Category is based on Building Class at Time of Sale.", "Note: Condominium and cooperative sales are on the unit level and understood to have a count of one.", "BOROUGH", "3"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], {1}: ["", "", "", "", "NEIGHBORHOOD", "BATH BEACH"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], {2}: ["", "", "", "", "BUILDING CLASS CATEGORY", "01 ONE FAMILY DWELLINGS"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], {3}: ["", "", "", "", "TAX CLASS AT PRESENT", "1"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], {4}: ["", "", "", "", "BLOCK", "6360"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], {5}: ["", "", "", "", "LOT", "56"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]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))
panel_2 = Panel("""0
1
2
3
4""")
flip = FlipMatrix(Data=txt)
path = DataPath(panel_2)
branch = TreeBranch(Tree=flip, Path="4", MaintainPaths=True)
split = SplitTree(Data=flip, Masks=flatten(path))  # -> Positive, Negative

# ---- group: Intention
txt_2 = Text("""HousingPulse
Data Analytics for Housing Accessibility Assessment: 

Analyze large datasets, including demographic data, building codes, and geographic information, to assess the accessibility of housing stock at a city or regional level. By identifying areas with inadequate accessibility infrastructure or high concentrations of inaccessible housing units, policymakers can prioritize targeted interventions and investments to improve accessibility.

Also identify possible retrofitting and abandoned lots (private or public) for possible gorilla action take over. """)

# ---- group: Download OSM
panel_3 = Panel("40.72")
panel_4 = Panel("40.725")
panel_5 = Panel("-73.98")
panel_6 = Panel("-73.985")

# ----
top_bound = GetString(panel_4, AtLeast=1, AtMost=1, TreeAccess=False)
bottom_bound = GetString(panel_3, AtLeast=1, AtMost=1, TreeAccess=False)
right_bound = GetString(panel_5, AtLeast=1, AtMost=1, TreeAccess=False)
left_bound = GetString(panel_6, AtLeast=1, AtMost=1, TreeAccess=False)

# ---- group: Download OSM (continued)
download_openstreetmap_osm = DownloadOpenStreetMapOSM(LeftBound=left_bound, RightBound=right_bound, TopBound=top_bound, BottomBound=bottom_bound, RunToggle=True)  # -> OSMQueryURL, OSMFilePath

# ----
download_openstreetmap_osm_2 = DownloadOpenStreetMapOSM(LeftBound=left_bound, RightBound=right_bound, TopBound=top_bound, BottomBound=bottom_bound, RunToggle=True)  # -> OSMQueryURL, OSMFilePath

# ---- group: Import Geometries
import_osm_features = ImportOSMFeatures(OSMPathOrURL=download_openstreetmap_osm.OSMQueryURL, OSMFeatureType="amenity", Format="xml", ImportAltitude=False)  # -> Points, Metadata, UTMZone, TranslationVector
import_osm_features_2 = ImportOSMFeatures(OSMPathOrURL=download_openstreetmap_osm.OSMQueryURL, OSMFeatureType="building", Format="xml", ImportAltitude=False)  # -> Points, Metadata, UTMZone, TranslationVector
import_osm_features_3 = ImportOSMFeatures(OSMPathOrURL=download_openstreetmap_osm.OSMQueryURL, OSMFeatureType="street", Format="xml", ImportAltitude=False)  # -> Points, Metadata, UTMZone, TranslationVector

# ----
import_osm_features_4 = ImportOSMFeatures(OSMPathOrURL=download_openstreetmap_osm_2.OSMQueryURL, OSMFeatureType="amenity", Format="xml", ImportAltitude=True)  # -> Points, Metadata, UTMZone, TranslationVector
import_osm_features_5 = ImportOSMFeatures(OSMPathOrURL=download_openstreetmap_osm_2.OSMQueryURL, OSMFeatureType="street", Format="xml", ImportAltitude=True)  # -> Points, Metadata, UTMZone, TranslationVector
# Terrain
download_dem_and_build_terrain_mesh = DownloadDEMAndBuildTerrainMesh(LeftBound=left_bound, RightBound=right_bound, TopBound=top_bound, BottomBound=bottom_bound, XCount=100, YCount=100)  # -> TerrainMesh, UTMZone, TranslationVector

# ---- group: Build Basic Model
# Turn on build toggle
polyline = PolyLine(Vertices=import_osm_features_2.Points, Closed=False)
create_amenity = CreateAmenity(PointLocationOfAmenity=import_osm_features.Points, Metadata=import_osm_features.Metadata)
polyline_2 = PolyLine(Vertices=import_osm_features_3.Points, Closed=False)
create_street_network = CreateStreetNetwork(
    StreetCurves=flatten(polyline_2),
    Metadata=flatten(import_osm_features_3.Metadata),
    SplitStreetCurves=True,
    UTMZone=import_osm_features_3.UTMZone,
    TranslationVector=import_osm_features_3.TranslationVector)  # -> StreetNetwork, StreetSegmentCurves, UTMZone, TranslationVector
arrange_amenities_by_building = ArrangeAmenitiesByBuilding(Amenities=flatten(create_amenity), Buildings=flatten(polyline))  # -> AmenitiesByBuilding, Buildings
create_building = CreateBuilding(
    BuildingCurve=arrange_amenities_by_building.Buildings,
    Metadata=import_osm_features_2.Metadata,
    AmenitiesInBuilding=arrange_amenities_by_building.AmenitiesByBuilding)
build_urbano_model = BuildUrbanoModel(Buildings=flatten(create_building), StreetNetwork=create_street_network.StreetNetwork, BuildToggle=True)  # -> UrbanoModel, BuildingCurves, Activities
inspect_building = InspectBuilding(Building=create_building, DefaultHeight=10)  # -> Geometry, Metadata, Amenity, BuildingMesh

# ----
panel_7 = Panel(import_osm_features_4.Metadata)
# Streets
polyline_3 = PolyLine(Vertices=import_osm_features_5.Points, Closed=False)
create_street_network_2 = CreateStreetNetwork(
    StreetCurves=flatten(polyline_3),
    Metadata=flatten(import_osm_features_5.Metadata),
    SplitStreetCurves=True,
    UTMZone=import_osm_features_5.UTMZone,
    TranslationVector=import_osm_features_5.TranslationVector)  # -> StreetNetwork, StreetSegmentCurves, UTMZone, TranslationVector
demeta = DeconstructMetadata(Metadata=inspect_building.Metadata)  # -> simplify(Keys), simplify(Values)

context_print = ContextPrint(RollingsalesBKTitles=branch)
context_print_2 = ContextPrint(RollingsalesBK=split.Negative)
context_bake = ContextBake(Buildings=inspect_building.BuildingMesh)
context_bake_2 = ContextBake(Geometry=download_dem_and_build_terrain_mesh.TerrainMesh)
context_print_3 = ContextPrint(README=txt_2)
context_bake_3 = ContextBake(Geometry=create_street_network_2.StreetSegmentCurves)
context_print_4 = ContextPrint(Amenity=build_urbano_model.Activities)
context_bake_4 = ContextBake(Geometry=build_urbano_model.BuildingCurves)
context_print_5 = ContextPrint(Text=demeta.Keys)
context_print_6 = ContextPrint(Text=demeta.Values)
