# Grasshopper definition geometry_copies.gh (Grasshopper 1.0.7)

# ---- group: Drop Downs City One
city_district_one = GetInteger(Slider(0, range=0..3), AtLeast=1, AtMost=1, Maximum=2147483647, Minimum=-2147483648, TreeAccess=False)
city_amenities_one = GetInteger(Slider(0, range=0..3), AtLeast=1, AtMost=1, Maximum=2147483647, Minimum=-2147483648, TreeAccess=False)

# ---- group: Drop Downs City Two
city_district_two = GetInteger(Slider(0, range=0..3), AtLeast=1, AtMost=1, Maximum=2147483647, Minimum=-2147483648, TreeAccess=False)
city_amenities_two = GetInteger(Slider(0, range=0..3), AtLeast=1, AtMost=1, Maximum=2147483647, Minimum=-2147483648, TreeAccess=False)

# ---- group: just to test
path = FilePath("C:\Users\ARoncal\OneDrive - Thornton Tomasetti, Inc\__License Resources\Desktop\datamgnt\bimsc24-final-project\src\submissions\andresroncal\assets\Programs massing.3dm")

# ----
python = GhPythonScript(FP=path)  # -> out, geom, layerIndex, layers, layerColor
# ---------- python: Python ----------
import System
import Rhino

#load Rhino file from string, or from local path
try:
    b64 = System.Convert.FromBase64String(data)
    _dmfile = Rhino.FileIO.File3dm.FromByteArray(b64)
except:
    _dmfile = Rhino.FileIO.File3dm.Read(FP)
    print _dmfile



objtable = _dmfile.Objects
geom = []
geomLayerIndexList = []

#get objects from document
for obj in objtable:
    
    if not isinstance(obj.Geometry,Rhino.Geometry.InstanceReferenceGeometry):
        #get user strings from document and assign to geometry
        for k in obj.Attributes.GetUserStrings().AllKeys:
            value =  obj.Attributes.GetUserString(k)
            obj.Geometry.SetUserString(k, value)
       
        geom.append(obj.Geometry)
        geomLayerIndexList.append(obj.Attributes.LayerIndex)
        

geom_= geom
layerIndex_ = geomLayerIndexList

#get layer information
layers = []
layerColor = []
for l in _dmfile.Layers:
    layerColor.append(l.Color)
    layers.append(l)
    
    
layers_ = layers
layerColor_  = layerColor
# ---------- end python ----------

# ---- group: ZoneA
geo = Geometry(simplify(Tree({0;0}: [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], {0;1}: [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], {0;2}: [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], {0;3}: [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], {0;4}: [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])))

# ---- group: ZoneD
geo_2 = Geometry(simplify(Tree({3;0}: [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], {3;1}: [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], {3;2}: [], {3;3}: [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], {3;4}: [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])))

# ---- group: ZoneC
geo_3 = Geometry(simplify(Tree({2;0}: [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], {2;1}: [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], {2;2}: [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], {2;3}: [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], {2;4}: [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])))

# ---- group: ZoneB
geo_4 = Geometry(simplify(Tree({1;0}: [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], {1;1}: [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], {1;2}: [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], {1;3}: [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], {1;4}: [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])))

# ----
panel = Panel(python.layerColor)
cset = CreateSet(List=python.layerIndex)  # -> Set, Map
cset_2 = CreateSet(List=cset.Map)  # -> Set, Map
mindex = MemberIndex(Set=cset.Map, Member=cset_2.Set)  # -> Index, Count
item = ListItem(List=python.geom, Index=mindex.Index, Wrap=True)  # -> simplify(Item)
bang = ExplodeTree(Data=geo)  # -> Branch0, Branch1, Branch2, Branch3, Branch4
bang_2 = ExplodeTree(Data=geo)  # -> Branch0, Branch1, Branch2, Branch3, Branch4
bang_3 = ExplodeTree(Data=geo_4)  # -> Branch0, Branch1, Branch2, Branch3, Branch4
bang_4 = ExplodeTree(Data=geo_4)  # -> Branch0, Branch1, Branch2, Branch3, Branch4
bang_5 = ExplodeTree(Data=geo_3)  # -> Branch0, Branch1, Branch2, Branch3, Branch4
bang_6 = ExplodeTree(Data=geo_3)  # -> Branch0, Branch1, Branch2, Branch3, Branch4
bang_7 = ExplodeTree(Data=geo_2)  # -> Branch0, Branch1, Branch2, Branch3, Branch4
bang_8 = ExplodeTree(Data=geo_2)  # -> Branch0, Branch1, Branch2, Branch3, Branch4
bang_9 = ExplodeTree(Data=geo)  # -> Branch0, Branch1, Branch2, Branch3, Branch4
bang_10 = ExplodeTree(Data=geo_4)  # -> Branch0, Branch1, Branch2, Branch3, Branch4
bang_11 = ExplodeTree(Data=geo_3)  # -> Branch0, Branch1, Branch2, Branch3, Branch4
bang_12 = ExplodeTree(Data=geo_2)  # -> Branch0, Branch1, Branch2, Branch3, Branch4
bang_13 = ExplodeTree(Data=item)  # -> Branch0, Branch1, Branch2, Branch3, Branch4, Branch5, Branch6, Branch7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
stream_filter = StreamFilter(Gate=city_amenities_one, Stream0=bang_6.Branch1, Stream1=bang_6.Branch2, Stream2=bang_6.Branch3, Stream3=bang_6.Branch4)
stream_filter_2 = StreamFilter(Gate=city_amenities_one, Stream0=bang_2.Branch1, Stream1=bang_2.Branch2, Stream2=bang_2.Branch3, Stream3=bang_2.Branch4)
stream_filter_3 = StreamFilter(Gate=city_amenities_one, Stream0=bang_4.Branch1, Stream1=bang_4.Branch2, Stream2=bang_4.Branch3, Stream3=bang_4.Branch4)
stream_filter_4 = StreamFilter(Gate=city_amenities_one, Stream0=bang_8.Branch1, Stream1=bang_8.Branch2, Stream2=bang_8.Branch3, Stream3=bang_8.Branch4)
stream_filter_5 = StreamFilter(
    Gate=city_amenities_two,
    Stream0=bang_11.Branch1,
    Stream1=bang_11.Branch2,
    Stream2=bang_11.Branch3,
    Stream3=bang_11.Branch4)
stream_filter_6 = StreamFilter(Gate=city_amenities_two, Stream0=bang_9.Branch1, Stream1=bang_9.Branch2, Stream2=bang_9.Branch3, Stream3=bang_9.Branch4)
stream_filter_7 = StreamFilter(
    Gate=city_amenities_two,
    Stream0=bang_10.Branch1,
    Stream1=bang_10.Branch2,
    Stream2=bang_10.Branch3,
    Stream3=bang_10.Branch4)
stream_filter_8 = StreamFilter(
    Gate=city_amenities_two,
    Stream0=bang_12.Branch1,
    Stream1=bang_12.Branch2,
    Stream2=bang_12.Branch3,
    Stream3=bang_12.Branch4)
stream_filter_9 = StreamFilter(
    Gate=city_amenities_one,
    Stream0=bang_13.Branch6,
    Stream1=bang_13.Branch7,
    Stream2=bang_13.Branch8,
    Stream3=bang_13.Branch9)
stream_filter_10 = StreamFilter(
    Gate=city_amenities_one,
    Stream0=bang_13.Branch1,
    Stream1=bang_13.Branch2,
    Stream2=bang_13.Branch3,
    Stream3=bang_13.Branch4)
stream_filter_11 = StreamFilter(
    Gate=city_amenities_one,
    Stream0=bang_13.Branch11,
    Stream1=bang_13.Branch12,
    Stream2=bang_13.Branch13,
    Stream3=bang_13.Branch14)
stream_filter_12 = StreamFilter(
    Gate=city_amenities_one,
    Stream0=bang_13.Branch16,
    Stream1=bang_13.Branch18,
    Stream2=bang_13.Branch17,
    Stream3=bang_13.Branch18)
stream_filter_13 = StreamFilter(Gate=city_district_one, Stream0=stream_filter_2, Stream1=stream_filter_3, Stream2=stream_filter, Stream3=stream_filter_4)
stream_filter_14 = StreamFilter(Gate=city_district_one, Stream0=bang_2.Branch0, Stream1=bang_4.Branch0, Stream2=bang_6.Branch0, Stream3=bang_8.Branch0)
stream_filter_15 = StreamFilter(
    Gate=city_district_two,
    Stream0=stream_filter_6,
    Stream1=stream_filter_7,
    Stream2=stream_filter_5,
    Stream3=stream_filter_8)
stream_filter_16 = StreamFilter(
    Gate=city_district_two,
    Stream0=bang_9.Branch0,
    Stream1=bang_10.Branch0,
    Stream2=bang_11.Branch0,
    Stream3=bang_12.Branch0)
stream_filter_17 = StreamFilter(
    Gate=city_district_one,
    Stream0=stream_filter_10,
    Stream1=stream_filter_9,
    Stream2=stream_filter_11,
    Stream3=stream_filter_12)
stream_filter_18 = StreamFilter(
    Gate=city_district_one,
    Stream0=bang_13.Branch0,
    Stream1=bang_13.Branch5,
    Stream2=bang_13.Branch10,
    Stream3=bang_13.Branch15)

bbox = BoundingBox(Content=flatten(geo), Plane=PlaneXY(0, 0, 0), UnionBox=True)  # -> Box, Box_2
debrep = DeconstructBrep(Brep=bbox.Box)  # -> Faces, Edges, Vertices
area = Area(Geometry=debrep.Faces)  # -> Area, Centroid
sort = SortList(Keys=area.Area, ValuesA=debrep.Faces)  # -> Keys, reverse(ValuesA)
item_2 = ListItem(List=sort.ValuesA, Index=0, Wrap=True)
dim = Dimensions(Surface=item_2)  # -> UDimension, VDimension
sqgrid = Square(Plane=PlaneXY(0, 0, 0), Size=dim.VDimension, ExtentX="2", ExtentY="2")  # -> simplify(Cells), simplify(Points)
item_3 = ListItem(List=sqgrid.Cells, Index=0, Wrap=True)  # -> Item, Item1
merge = Merge(Data1=item_3.Item, Data2=item_3.Item1)  # -> flatten(Result)
area_2 = Area(Geometry=item_3.Item)  # -> Area, Centroid
move = Move(Geometry=area_2.Centroid, Motion=Vector(0, 0, 10))  # -> Geometry, Transform
ln = Line(StartPoint=area_2.Centroid, EndPoint=move.Geometry)
midpt = CurveMiddle(Curve=ln)
X = UnitX(Factor=1)
move_2 = Move(Geometry=midpt, Motion=X)  # -> Geometry, Transform
pl_3pt = Plane3Pt(PointA=area_2.Centroid, PointB=move_2.Geometry, PointC=move.Geometry)
item_4 = ListItem(List=flatten(pl_3pt), Index=0, Wrap=True)  # -> Item, Item1

python_2 = GhPythonScript(geo=stream_filter_18)  # -> out, filter_geo, unfiltered; inputs type: Int32, geo: list of GeometryBase
# ---------- python_2: Python ----------
import Rhino.Geometry as rg
import rhinoscriptsyntax as rs

filter_geo= []
unfiltered = []
geo_types = ["Mesh", "Brep", "SubD", "NurbsCurve" ]

for g in geo:
    
    g = rs.coercegeometry(g)
    
    if type(g).__name__ == geo_types[_type]:

        filter_geo.append(g)
    else:
        unfiltered.append(g)
        
filter_geo_ = filter_geo
unfiltered_ = unfiltered
# ---------- end python_2 ----------
python_3 = GhPythonScript(geoms=bang_13.Branch0, user_key="Color")  # -> out, user_values; inputs geoms: list of GeometryBase
# ---------- python_3: Python ----------
user_values = []

for g in geoms:
    user_values.append( g.GetUserString(user_key))


user_values_ = user_values
# ---------- end python_3 ----------

# ---- group: must be a string
uservalue = Text()
userkey = Text("color")

# ----
python_4 = GhPythonScript(geoms=stream_filter_14, user_key="color")  # -> out, user_values; inputs geoms: list of GeometryBase; same code as python_3
c_script = CSharpScript(geometry=stream_filter_14, userKey="color", userValue=python_4.user_values)  # -> out, geoWithUserString; inputs geometry: GeometryBase, userKey: String, userValue: String
# ---------- c_script: C# ----------
    geometry.SetUserString(userKey, userValue);
   geoWithUserString = geometry;
# ---------- end c_script ----------
panel_2 = Panel(python_4.user_values)
userkey_2 = Text("price")
# add price
c_script_2 = CSharpScript(geometry=c_script.geoWithUserString, userKey=userkey_2)  # -> out, geoWithUserString; inputs geometry: GeometryBase, userKey: String, userValue: String; same code as c_script
c_script_3 = CSharpScript()  # -> out, geoWithUserString; inputs geometry: GeometryBase, userKey: String, userValue: String; same code as c_script
orient = Orient(Geometry=stream_filter_15, Source=item_4.Item, Target=item_4.Item1)  # -> Geometry, Transform
orient_2 = Orient(Geometry=stream_filter_16, Source=item_4.Item, Target=item_4.Item1)  # -> Geometry, Transform
orient_3 = Orient(Geometry=stream_filter_14, Source=item_4.Item, Target=item_4.Item)  # -> Geometry, Transform
orient_4 = Orient(Geometry=stream_filter_13, Source=item_4.Item, Target=item_4.Item)  # -> Geometry, Transform
context_bake = ContextBake(Geometry=orient_4.Geometry)
# output metadata
context_bake_2 = ContextBake(Buildings=orient_3.Geometry)
context_bake_3 = ContextBake(Geometry=orient.Geometry)
context_bake_4 = ContextBake(Buildings2=orient_2.Geometry)
