# Grasshopper definition PennState-BowlStadium_20240308_EG.gh (Grasshopper 1.0.7)
# plug-ins: Rhino.Inside for Autodesk Revit, Kangaroo2 Components, treesloth01, Human, Nautilus

# Linked Arch Model
links = QueryRevitLinks()  # -> Links, Documents

# ---- group: RH_Input
# copyright: Thornton Tomasetti, Inc.
# Author: Xxxxxx Xxxxxxxx
# XXxxxxx@ThorntonTomasetti.com
# Date: XX/XX/2014
# Revision: X
# GH: 0.9.0076
# Description:
pt = Point(Point(0, 0, 0))

# balah ekn dkehag shier fjrea; dakehfn kd ka jeaiw akkhae adfga
# dakehfn kd ka jeaiw akkhae agieahaa jjes stwq ajehga alae fgaeefaf
# agieahaa jjes stwq ajehga alae abue jiues naa bnal laep uey afdffa
# abue jiues naa bnal laep uey ier fjrea; dakehfn kd ka jeaiw oguyt rtyh
# PSEUDO CODE: Step 1
# Step 2
# Step 3
# Step 4
pt_2 = Point(Point(0, 0, 0))

# ----
value_picker = ValuePicker(links.Documents)

# ---- group: Input
pt_3 = Point(Point(0, 0, 0))

pt_4 = Point(Point(0, 0, 0))

# ---- group: Operation
pt_5 = Point(Point(0, 0, 0))

pt_6 = Point(Point(0, 0, 0))

# ----
# Active Document
active = ActiveDocument()

# ---- group: Output
pt_7 = Point(Point(0, 0, 0))

pt_8 = Point(Point(0, 0, 0))

# ---- group: Visualization
pt_9 = Point(Point(0, 0, 0))

pt_10 = Point(Point(0, 0, 0))

# ---- group: RIR
# Best Practices: Large grouped elements: Alpha:120.
# Single grouped elements: Alpha: 225.
# Rhino Inputs: Orange. Hue: 30. "RH_"
# Other Inputs: Yellow. Hue: 60
# Operations: Purple. Hue: 265
# Outputs: Red. Hue 0.
# Custom Visualization: Green. Hue: 120.
# All inputs listed on left.
# All outputs listed on right.
# Global Instructions at top left corner on white.
# Local Instructions next to GH code on white.
# Large Header for each "Step" above GH code.
# Frequently label GH components for description.
pt_11 = Point(Point(0, 0, 0))

pt_12 = Point(Point(0, 0, 0))

# ----
# Arch Grids
grids = QueryGrids(Document=value_picker)
split = TextSplit(Text=grids, Separators=" ")
item = ListItem(List=split, Index=3, Wrap=True)  # -> flatten(Item)
python = GhPythonScript(mixed_list=item)  # -> a; inputs mixed_list: list
# ---------- python: Python ----------
import rhinoscriptsyntax as rs

a = [item.isalpha() for item in mixed_list]
# ---------- end python ----------
dispatch = Dispatch(List=grids, DispatchPattern=python)  # -> ListA, ListB
split_2 = TextSplit(Text=dispatch.ListA, Separators=" ")
split_3 = TextSplit(Text=dispatch.ListB, Separators=" ")
item_2 = ListItem(List=split_2, Index=3, Wrap=True)  # -> flatten(Item)
item_3 = ListItem(List=split_3, Index=3, Wrap=True)  # -> flatten(Item)
lng = ListLength(List=item_2)
lng_2 = ListLength(List=item_3)
series = Series(Start=0, Step=1, Count=lng)
series_2 = Series(Start=0, Step=1, Count=lng_2)
sort = SortList(Keys=item_3, ValuesA=series_2)  # -> Keys, ValuesA
tsort = SortText(Keys=item_2, Values=series, Culture=127)  # -> Keys, Values
item_4 = ListItem(List=dispatch.ListA, Index=tsort.Values, Wrap=True)
item_5 = ListItem(List=dispatch.ListB, Index=sort.ValuesA, Wrap=True)

# ---- group: Get Bowl Geometry
# Stadia from Arch model
categories = DirectShapeCategories("autodesk.revit.category.local:floors-1.0.0", SearchPattern="Floor")
catfltr = CategoryFilter(Categories=categories, Inverted=False)
elements = QueryElements(Document=value_picker, Filter=catfltr)  # -> Elements, Count
expression = Expression(x=elements.Elements, y="Component", Expression="Contains(x,y)")
dispatch_2 = Dispatch(List=elements.Elements, DispatchPattern=expression)  # -> ListA, ListB

# ---- group: Get slabs from Revit
# Floor Slabs from Arch Model
categories_2 = DirectShapeCategories("autodesk.revit.category.local:floors-1.0.0", SearchPattern="Floor")
catfltr_2 = CategoryFilter(Categories=categories_2, Inverted=False)
elements_2 = QueryElements(Document=value_picker, Filter=catfltr_2)  # -> Elements, Count
expression_2 = Expression(x=elements_2.Elements, y="Floor", Expression="Contains(x,y)")
dispatch_3 = Dispatch(List=elements_2.Elements, DispatchPattern=expression_2)  # -> ListA, ListB

# ---- group: Filter out small slabs, get top surfaces / Slabs
geometry = ElementGeometry(Elements=dispatch_3.ListA)  # -> simplify(Geometry)

# ----
design_options = QueryDesignOptions(Document=value_picker, Primary=True)

# ---- group: Filter out small slabs, get top surfaces
volume = Volume(Geometry=flatten(geometry))  # -> Volume, Centroid
bnd = Bounds(Numbers=volume.Volume)
dedomain = DeconstructDomain(Domain=bnd)  # -> Start, End
addition = Addition(A=dedomain.Start, B=Slider(7144, range=0..10000))
smaller = SmallerThan(FirstNumber=volume.Volume, SecondNumber=addition)  # -> SmallerThan, OrEqualTo
dispatch_4 = Dispatch(List=flatten(geometry), DispatchPattern=smaller.SmallerThan)  # -> ListA, ListB
debrep = DeconstructBrep(Brep=dispatch_4.ListB)  # -> Faces, Edges, Vertices
area = Area(Geometry=debrep.Faces)  # -> Area, Centroid
pdecon = Deconstruct(Point=area.Centroid)  # -> XComponent, YComponent, ZComponent
bnd_2 = Bounds(Numbers=pdecon.ZComponent)
dedomain_2 = DeconstructDomain(Domain=bnd_2)  # -> Start, End
smaller_2 = SmallerThan(FirstNumber=pdecon.ZComponent, SecondNumber=dedomain_2.End)  # -> SmallerThan, OrEqualTo
dispatch_5 = Dispatch(List=debrep.Faces, DispatchPattern=smaller_2.SmallerThan)  # -> ListA, ListB

# ---- group: Grid intersect and floor plane intersect
location = ElementCurve(Element=item_4)  # -> Element, Curve
location_2 = ElementCurve(Element=item_5)  # -> Element, Curve

# ---- group: NEW BOWL ZONE BREP
crv = Curve(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)
boundary = BoundarySurfaces(Edges=crv)
Z = UnitZ(Factor=Slider(300, range=0..1000))
extr = Extrude(Base=boundary, Direction=Z)

# ----
# Sorting out only the primary design option for arch stadia "floors"
# 
# Need to account for some arch models not containing bowl geometry within design options or for a combination of both
optnfltr = DesignOptionFilter(DesignOption=design_options, Inverted=False)
panel = Panel(location.Element)
elements_3 = QueryElements(Filter=optnfltr, Limit=100)  # -> Elements, Count
filtelem = FilterElements(Elements=dispatch_2.ListA, Filter=optnfltr)
dispatch_6 = Dispatch(List=dispatch_2.ListA, DispatchPattern=filtelem)  # -> ListA, ListB

# ---- group: Clean/Purge Smaller Geomtry
geometry_2 = ElementGeometry(Elements=dispatch_6.ListA)
debrep_2 = DeconstructBrep(Brep=geometry_2)  # -> Faces, Edges, Vertices
join = BrepJoin(Breps=debrep_2.Faces)  # -> Breps, Closed
volume_2 = Volume(Geometry=join.Breps)  # -> Volume, Centroid
smaller_3 = SmallerThan(FirstNumber=volume_2.Volume, SecondNumber="400")  # -> SmallerThan, OrEqualTo
dispatch_7 = Dispatch(List=join.Breps, DispatchPattern=smaller_3.SmallerThan)  # -> ListA, ListB
clean = CleanTree(RemoveNulls=True, RemoveInvalid=True, RemoveEmpty=True, Tree=dispatch_7.ListB)

# ---- group: Floor Slab top surfaces
brep = Brep(dispatch_5.ListB)

brep_2 = Brep(flatten(brep))

# ---- group: Slabs
brep_3 = Brep(brep_2)

# ---- group: Outer edge BREPs for inclusion checks
# Horz Slab Columns
number_slider = Slider(1, range=0..1)
multiplication = Multiplication(A=number_slider, B=2)
multiplication_2 = Multiplication(A=number_slider, B=-1)
Z_2 = UnitZ(Factor=multiplication_2)
Z_3 = UnitZ(Factor=multiplication)
move = Move(Geometry=brep_3, Motion=Z_2)  # -> Geometry, Transform
edges = BrepEdges(Brep=move.Geometry)  # -> Naked, Interior, NonManifold
join_2 = JoinCurves(Curves=edges.Naked, Preserve=False)
len = Length(Curve=join_2)
sort_2 = SortList(Keys=len, ValuesA=join_2)  # -> Keys, reverse(ValuesA)
item_6 = ListItem(List=sort_2.ValuesA, Index=0, Wrap=True)  # -> flatten(Item)
boundary_2 = BoundarySurfaces(Edges=item_6)
extr_2 = Extrude(Base=boundary_2, Direction=Z_3)

# ---- group: bowl-geometry
brep_4 = Brep(clean)

# ---- group: Slabs
brep_5 = Brep(brep_2)

# ----
debrep_3 = DeconstructBrep(Brep=brep_4)  # -> Faces, Edges, Vertices
area_2 = Area(Geometry=debrep_3.Faces)  # -> simplify(Area), Centroid
prox = Proximity3D(Points=area_2.Centroid, Group=1, MaxRadius="0.7")  # -> simplify(Links), Topology
disc = Discontinuity(Curve=prox.Links, Level=1)  # -> Points, Parameters
clean_2 = CleanTree(RemoveNulls=True, RemoveInvalid=True, RemoveEmpty=True, Tree=prox.Links)
prox_2 = Proximity3D(Group=5)  # -> Links, Topology
end = EndPoints(Curve=clean_2)  # -> Start, End
bnd_3 = Bounds(Numbers=area_2.Area)

# ---- group: Get OverallHeight
bbox = BoundingBox(Content=flatten([brep_5, brep_4]), Plane=PlaneXY(0, 0, 0), UnionBox=True)  # -> Box, Box_2
debrep_4 = DeconstructBrep(Brep=bbox.Box)  # -> Faces, Edges, Vertices
area_3 = Area(Geometry=debrep_4.Faces)  # -> Area, Centroid
pdecon_2 = Deconstruct(Point=area_3.Centroid)  # -> XComponent, YComponent, ZComponent
sort_3 = SortList(Keys=pdecon_2.ZComponent, ValuesA=area_3.Centroid)  # -> Keys, reverse(ValuesA)
item_7 = ListItem(List=sort_3.ValuesA, Index=0, Wrap=True)
project = Project(Geometry=item_7, Plane=PlaneXY(0, 0, 0))  # -> Geometry, Transform
ln = Line(StartPoint=item_7, EndPoint=project.Geometry)
len_2 = Length(Curve=ln)

# ----
Z_4 = UnitZ(Factor=len_2)
merge = Merge(Data1=end.Start, Data2=end.End)
pdecon_3 = Deconstruct(Point=merge)  # -> XComponent, YComponent, ZComponent
panel_2 = Panel("2")
panel_3 = Panel("2.5")
dedomain_3 = DeconstructDomain(Domain=bnd_3)  # -> Start, End
int = Integer(pdecon_3.ZComponent)
division = Division(A=dedomain_3.End, B="1.5")
smaller_4 = SmallerThan(FirstNumber=area_2.Area, SecondNumber=division)  # -> SmallerThan, OrEqualTo
bnd_4 = Bounds(Numbers=pdecon_3.ZComponent)
dispatch_8 = Dispatch(List=debrep_3.Faces, DispatchPattern=smaller_4.SmallerThan)  # -> ListA, ListB
dedomain_4 = DeconstructDomain(Domain=bnd_4)  # -> Start, End
panel_4 = Panel(dedomain_4.Start)
geo = Geometry(dispatch_8.ListB)
equals = Equality(FirstNumber=pdecon_3.ZComponent, SecondNumber=dedomain_4.Start)  # -> Equality, Inequality
join_3 = BrepJoin(Breps=dispatch_8.ListB)  # -> Breps, Closed
smaller_5 = SmallerThan(FirstNumber=pdecon_3.ZComponent, SecondNumber=dedomain_4.Start)  # -> SmallerThan, OrEqualTo
dispatch_9 = Dispatch(List=merge, DispatchPattern=equals.Equality)  # -> ListA, ListB
cull = CullPattern(CullPattern=[False, False, True, True])
panel_5 = Panel(dedomain_3.End)
cp = ClosestPoint(Point=area_2.Centroid, Cloud=dispatch_9.ListB)  # -> ClosestPoint, CPIndex, Distance
panel_6 = Panel(cp.Distance)
pt_13 = Point(dispatch_9.ListB)
# I took this part offline.
# Don't think we need this any more. I think intent was to cull the field level, but this is kind of a black box for the general user. Since floor framing bake allows for multi-selection of levels I don't think this is necessary anymore
number_slider_2 = Slider(6, range=0..6)
item_8 = ListItem(List=extr_2, Index=number_slider_2, Wrap=True)

cull_i = CullIndex(List=extr_2, Indices=number_slider_2, Wrap=True)

# ---- group: FLOOR BREPS
brep_6 = Brep(extr_2)

brep_7 = Brep(brep_6)

# ---- group: Extract Levels from Revit
levels = QueryLevels(BuildingStory=True)
location_3 = ElementLocation(Element=levels)  # -> Element, Location, Hand, Facing, WorkPlane
deplane = DeconstructPlane(Plane=location_3.Location)  # -> Origin, XAxis, YAxis, ZAxis
pdecon_4 = Deconstruct(Point=deplane.Origin)  # -> XComponent, YComponent, ZComponent

# ----
sort_4 = SortList(Keys=pdecon_4.ZComponent, ValuesA=location_3.Element)  # -> Keys, ValuesA

phases = QueryPhases()
# PHASE
panel_7 = Panel("Select Revit Phase")
value_picker_2 = ValuePicker(phases)

# ---- group: If true, what's the new workset name?
panel_8 = Panel("TT_CORE stadia")

# ---- group: Choose Existing Workset (False) or Create your own (True)
toggle = BooleanToggle(True)

# ---- group: Raker Offset Under Precast
raker_offset_ft = Slider(-1, range=-3..0)

# ----
num = Number(raker_offset_ft)

# ----
# Minimum # of columns within slab to generate bay framing
how_many_bay_points_to_check_for = Slider(1, range=1..4)

# ---- group: Choose Exisitng Workset for Objects
worksets = QueryWorksets(Kind=4)
value_picker_3 = ValuePicker(worksets)

# ---- group: Slab Thickness
# Slab thickness in inches - Used to find closest level below architectural slab top surface
total_slab_thickness_inches = Panel("7.5")

# ----
division_2 = Division(A=total_slab_thickness_inches, B="12")

# ---- group: Manually Choose Grids (False) or Auto-Select Grids (True)
toggle_2 = BooleanToggle(True)

# ---- group: Create Revit Objects
toggle_3 = BooleanToggle(False)

# ---- group: #2 Create Revit Columns
# #2 Create Revit Objects
toggle_4 = BooleanToggle(True)

# ---- group: Extrtact Levels
levels_2 = QueryLevels(BuildingStory=True)
location_4 = ElementLocation(Element=levels_2)  # -> Element, Location, Hand, Facing, WorkPlane

# ---- group: Bake Columns to Revit
toggle_5 = BooleanToggle(False)

# ---- group: #3 Bake Columns to Revit
# #3 Bake into Revit document
toggle_6 = BooleanToggle(False)

# ----
# WORKSET
filter = StreamFilter(Gate=toggle, Stream0=value_picker_3, Stream1=panel_8)
workset = Workset(filter)

# ---- group: 0 = Top z Justification
int_2 = Integer("0")

int_3 = Integer("0")

# ---- group: OFFSET FROM SELECTED LEVEL (inches)
# Beam and Girder Offset from the selected host level. Typically recommend using a t/steel level with this offset set to 0 inches
start_and_end_level_offset = Panel("0")

# ---- group: Create Revit Objects
# BEAMS TO REVIT
toggle_7 = BooleanToggle(False)

# GIRDERS TO REVIT
toggle_8 = BooleanToggle(False)

# ---- group: Bake Object to Revit
toggle_9 = BooleanToggle(False)

toggle_10 = BooleanToggle(False)

# ----
panel_9 = Panel("W-Wide Flange")

# ---- group: Get Grids
# Structural Grids
worksets_2 = QueryWorksets(Kind=4)

# ----
# SELECT GRID WORKSET(s)
value_picker_4 = ValuePicker(worksets_2)

# ---- group: Get Grids (continued)
wsetfltr = WorksetFilter(Workset=value_picker_4, Inverted=False)
grids_2 = QueryGrids(Document=active, Filter=wsetfltr)
split_4 = TextSplit(Text=grids_2, Separators=" ")
item_9 = ListItem(List=split_4, Index=3, Wrap=True)  # -> flatten(Item)
python_2 = GhPythonScript(mixed_list=item_9)  # -> a; inputs mixed_list: list; same code as python
dispatch_10 = Dispatch(List=grids_2, DispatchPattern=python_2)  # -> ListA, ListB

# ---- group: Grids 1
split_5 = TextSplit(Text=dispatch_10.ListA, Separators=" ")
item_10 = ListItem(List=split_5, Index=3, Wrap=True)  # -> flatten(Item)
lng_3 = ListLength(List=item_10)
series_3 = Series(Start=0, Step=1, Count=lng_3)
tsort_2 = SortText(Keys=item_10, Values=series_3, Culture=127)  # -> Keys, Values
item_11 = ListItem(List=dispatch_10.ListA, Index=tsort_2.Values, Wrap=True)

# ---- group: Grids 2
split_6 = TextSplit(Text=dispatch_10.ListB, Separators=" ")
item_12 = ListItem(List=split_6, Index=3, Wrap=True)  # -> flatten(Item)
lng_4 = ListLength(List=item_12)
series_4 = Series(Start=0, Step=1, Count=lng_4)
sort_5 = SortList(Keys=item_12, ValuesA=series_4)  # -> Keys, ValuesA
item_13 = ListItem(List=dispatch_10.ListB, Index=sort_5.ValuesA, Wrap=True)

# ----
# GRID SELECTION
# Shift+Select or Ctrl+Select to choose multiple grids
# CIRCUMFERENTIAL GRIDS
# RADIAL GRIDS
value_picker_5 = ValuePicker(grids_2)
value_picker_6 = ValuePicker(grids_2)

filter_2 = StreamFilter(Gate=toggle_2, Stream0=value_picker_5, Stream1=item_11)
filter_3 = StreamFilter(Gate=toggle_2, Stream0=value_picker_6, Stream1=item_13)
location_5 = ElementCurve(Element=filter_2)  # -> Element, Curve
location_6 = ElementCurve(Element=filter_3)  # -> Element, Curve
crv_2 = Curve(location_6.Curve)
crv_3 = Curve(location_5.Curve)

# ---- group: Circumfirential Grids
crv_4 = Curve(crv_3)

# ---- group: Radial Grids
crv_5 = Curve(crv_2)

crv_6 = Curve(crv_5)

# ---- group: Circumfirential Grids
crv_7 = Curve(crv_4)

# ----
crv_8 = Curve(crv_6)
crv_9 = Curve(crv_7)

panel_10 = Panel("align start/end")
end_2 = EndPoints(Curve=crv_8)  # -> Start, End
dist = Distance(PointA=end_2.End, PointB="0,0,0")
dist_2 = Distance(PointA=end_2.Start, PointB="0,0,0")
larger = LargerThan(FirstNumber=dist_2, SecondNumber=dist)  # -> LargerThan, OrEqualTo
dispatch_11 = Dispatch(List=crv_8, DispatchPattern=larger.LargerThan)  # -> ListA, ListB
flip = FlipCurve(Curve=dispatch_11.ListA)  # -> Curve, Flag
weave = Weave(Pattern=larger.LargerThan, Stream0=dispatch_11.ListB, Stream1=flip.Curve, NullGaps=False)

# ----
# Grid Intersections
panel_11 = Panel("order circumferential grids")
eval = EvaluateCurve(Curve=reparameterize(crv_9), Parameter="0.5")  # -> Point, Tangent, Angle
sort_pt = SortPoints(Points=eval.Point)  # -> Points, Indices
item_14 = ListItem(List=crv_9, Index=sort_pt.Indices, Wrap=True)

# ---- group: Radial Grids
crv_10 = Curve(crv_5)

# ---- group: Get to Crv from Projected Grid to Bowl
# Raker Parabolics Extraction
project_2 = Project(Curve=crv_10, Brep=graft(clean), Direction=Vector(0, 0, 1))
clean_3 = CleanTree(RemoveNulls=True, RemoveInvalid=True, RemoveEmpty=True, Tree=project_2)  # -> simplify(Tree)
flatten = FlattenTree(Tree=clean_3, Path="{0}")
explode = Explode(Curve=flatten, Recursive=True)  # -> Segments, Vertices
len_3 = Length(Curve=explode.Segments)
smaller_6 = SmallerThan(FirstNumber="0.3", SecondNumber=len_3)  # -> SmallerThan, OrEqualTo
cull_2 = CullPattern(List=explode.Segments, CullPattern=smaller_6.SmallerThan)
midpt = CurveMiddle(Curve=cull_2)
prox_3 = Proximity3D(Points=midpt, Group=1)  # -> simplify(Links), Topology
end_3 = EndPoints(Curve=prox_3.Links)  # -> Start, End
merge_2 = Merge(Data1=end_3.Start, Data2=end_3.End)
pdecon_5 = Deconstruct(Point=merge_2)  # -> XComponent, YComponent, ZComponent
bnd_5 = Bounds(Numbers=pdecon_5.ZComponent)
dedomain_5 = DeconstructDomain(Domain=bnd_5)  # -> Start, End
equals_2 = Equality(FirstNumber=pdecon_5.ZComponent, SecondNumber=dedomain_5.End)  # -> Equality, Inequality
cull_3 = CullPattern(List=merge_2, CullPattern=equals_2.Equality)
shift = ShiftPaths(Data=cull_3, Offset=-1)
cp_2 = ClosestPoint(Point=midpt, Cloud=shift)  # -> ClosestPoint, CPIndex, Distance
equals_3 = Equality(FirstNumber=cp_2.Distance, SecondNumber="0")  # -> Equality, Inequality
cull_4 = CullPattern(List=cull_2, CullPattern=equals_3.Equality)

# ----
crv_11 = Curve(item_14)
end_4 = EndPoints(Curve=crv_11)  # -> Start, End
pdecon_6 = Deconstruct(Point=end_4.End)  # -> XComponent, YComponent, ZComponent
pdecon_7 = Deconstruct(Point=end_4.Start)  # -> XComponent, YComponent, ZComponent
larger_2 = LargerThan(FirstNumber=pdecon_7.XComponent, SecondNumber=pdecon_6.XComponent)  # -> LargerThan, OrEqualTo
dispatch_12 = Dispatch(List=crv_11, DispatchPattern=larger_2.LargerThan)  # -> ListA, ListB
flip_2 = FlipCurve(Curve=dispatch_12.ListA)  # -> Curve, Flag
weave_2 = Weave(Pattern=larger_2.LargerThan, Stream0=dispatch_12.ListB, Stream1=flip_2.Curve, NullGaps=False)

crv_12 = Curve(weave)
end_5 = EndPoints(Curve=crv_12)  # -> Start, End
panel_13 = Panel("order radial grids")
pdecon_8 = Deconstruct(Point=end_5.End)  # -> XComponent, YComponent, ZComponent
sort_6 = SortList(Keys=pdecon_8.XComponent, ValuesA=crv_12)  # -> Keys, ValuesA

# ----
# compute angles for column rotations
xy = XYPlane(Origin=Point(0, 0, 0))
Y = UnitY(Factor=1)
angle = Angle(VectorA=Y, VectorB=sort_6.ValuesA, Plane=xy)  # -> Angle, Reflex

# ----
# radial grids drive the data structure... both for floor framing quads generation, and for columns
ccx = CurveCurve(CurveA=reparameterize(weave_2), CurveB=reparameterize(simplify(graft(sort_6.ValuesA))))  # -> simplify(Points), ParamsA, ParamsB
pshift = ShiftPaths(Data=ccx.Points, Offset=-1)
pshift_2 = ShiftPaths(Data=ccx.ParamsB, Offset=-1)
sort_7 = SortList(Keys=pshift_2, ValuesA=pshift)  # -> Keys, ValuesA
duppt = RemoveDuplicatePts(Points=sort_7.ValuesA, Tolerance=0.01)

# ---- group: Grid Intersection Points
pt_14 = Point(simplify(duppt))

pt_15 = Point(pt_14)

# ---- group: Radial Grid Angles
num_2 = Number(simplify(graft(angle.Reflex)))

# ----
clean_4 = CleanTree(RemoveNulls=True, RemoveInvalid=True, RemoveEmpty=True, Tree=pt_14)

# ----
# tree of all grid / grid / level intersections
area_4 = Area(Geometry=brep_3)  # -> Area, Centroid
pdecon_9 = Deconstruct(Point=area_4.Centroid)  # -> XComponent, YComponent, ZComponent
pdecon_10 = Deconstruct(Point=graft(pt_15))  # -> XComponent, YComponent, ZComponent
merge_3 = Merge(Data1="0", Data2=pdecon_9.ZComponent)
pt_16 = ConstructPoint(XCoordinate=pdecon_10.XComponent, YCoordinate=pdecon_10.YComponent, ZCoordinate=merge_3)

# ---- group: All Top Crvs
len_4 = Length(Curve=cull_4)
smaller_7 = SmallerThan(FirstNumber="0.6", SecondNumber=len_4)  # -> SmallerThan, OrEqualTo
cull_5 = CullPattern(List=cull_4, CullPattern=smaller_7.SmallerThan)
join_4 = JoinCurves(Curves=cull_5, Preserve=False)
len_5 = Length(Curve=join_4)
smaller_8 = SmallerThan(FirstNumber="1.5", SecondNumber=len_5)  # -> SmallerThan, OrEqualTo
cull_6 = CullPattern(List=join_4, CullPattern=smaller_8.SmallerThan)

# ---- group: Grid Intersection Points
pt_17 = Point(pt_14)

# ---- group: level Elevations
num_3 = Number(pdecon_9.ZComponent)

num_4 = Number(num_3)

# ----
move_2 = Move(Geometry=pt_17, Motion=Z_4)  # -> Geometry, Transform
ln_2 = Line(StartPoint=move_2.Geometry, EndPoint=pt_17)

# ---- group: level Elevations
num_5 = Number(num_3)

# ----
bcx = BrepCurve(Brep=brep_4, Curve=graft(ln_2))  # -> Curves, simplify(Points)
bcx_2 = BrepCurve(Brep=brep_5, Curve=graft(ln_2))  # -> Curves, simplify(Points)

# ---- group: Intersection Points
pt_18 = Point(pt_14)

# ----
shift_2 = ShiftPaths(Data=bcx_2.Points, Offset="-2")
subtraction = Subtraction(A=num_5, B=division_2)

# ---- group: Select first & last Pts and Get frame Crv
len_6 = Length(Curve=join_4)
smaller_9 = SmallerThan(FirstNumber="11", SecondNumber=len_6)  # -> SmallerThan, OrEqualTo
cull_7 = CullPattern(List=cull_6, CullPattern=smaller_9.SmallerThan)
disc_2 = Discontinuity(Curve=cull_7, Level=1)  # -> Points, Parameters
sort_8 = SortList(Keys=disc_2.Points, ValuesA=disc_2.Points)  # -> Keys, ValuesA
panel_14 = Panel("""True
False""")
cull_8 = CullPattern(List=sort_8.ValuesA, CullPattern=reverse(panel_14))  # -> simplify(List)

# ----
# Floor Framing
# draw quads representing possible full bays of floor framing
clean_5 = CleanTree(RemoveNulls=True, RemoveInvalid=True, RemoveEmpty=True, Tree=pt_18)
tstat = TreeStatistics(Tree=clean_5)  # -> Paths, Length, Count
series_5 = Series(Start=0, Step=1, Count=tstat.Count)
replace = ReplacePaths(Data=clean_5, Search=tstat.Paths, Replace=series_5)
duppt_2 = RemoveDuplicatePts(Points=replace, Tolerance=0.01)
pline = PolyLine(Vertices=duppt_2, Closed=False)
explode_2 = Explode(Curve=pline, Recursive=True)  # -> simplify(Segments), Vertices
c_script = CSharpScript(crv=explode_2.Segments)  # -> out, A; inputs crv: tree of Curve
# ---------- c_script: C# usings ----------
using System.Linq;
# ---------- c_script: C# ----------
    //output  tree to populate
    DataTree<Curve> outCurves = new DataTree<Curve>();

    //loop over the branches in the tree
    for (int i = 0; i < crv.BranchCount - 1; i++)
    {
      //assemble a list of the next two branches
      List < Curve > searchCurves = crv.Branch(i + 1);
      Print(searchCurves.Count.ToString());
      if (i < crv.BranchCount - 2)
      {
        searchCurves.AddRange(crv.Branch(i + 2));
      }

      //GH path to write to
      GH_Path path = new GH_Path(i);

      //loop over the curves in the branch
      for (int j = 0; j < crv.Branch(i).Count; j++)
      {
        //find the best match in the search list
        Curve match = FindClosestCurve(crv.Branch(i)[j], searchCurves);
        outCurves.Add(match, path);
      }
    }

    A = outCurves;
# ---------- c_script: C# additional code ----------
  public Curve FindClosestCurve(Curve inputCurve, List<Curve> searchCurves, double angleThreshold = 30.0)
  {
    if (inputCurve == null || searchCurves == null || searchCurves.Count == 0)
      return null;

    var sortedCurves = searchCurves
      .Select(curve => new
      {
        Curve = curve,
        Distance = inputCurve.PointAtStart.DistanceTo(curve.PointAtStart) + inputCurve.PointAtEnd.DistanceTo(curve.PointAtEnd)
        })
      .OrderBy(x => x.Distance)
      .ToList();

    foreach (var curveInfo in sortedCurves)
    {
      var curve = curveInfo.Curve;
      if (curve == null) continue;

      Vector3d tangentAtStart = inputCurve.TangentAtStart;
      Point3d startInput = inputCurve.PointAtStart;
      Point3d startSearch = curve.PointAtStart;
      Vector3d directionToCurve = startSearch - startInput;

      double angle = Vector3d.VectorAngle(tangentAtStart, directionToCurve) * (180.0 / Math.PI);

      if (Math.Abs(angle - 90) <= angleThreshold)
      {
        return curve;
      }
    }

    return null; // Or handle the case where no curve meets the criteria
  }
# ---------- end c_script ----------
merge_4 = Merge(Data1=graft(explode_2.Segments), Data2=graft(c_script.A))
clean_6 = CleanTree(RemoveNulls=True, RemoveInvalid=True, RemoveEmpty=False, Tree=merge_4)
loft = Loft(Curves=clean_6, Options={Adjust=False, Closed=False, LoftEnds=0, LoftSimp=0, LoftType=0, Rebuild=10, Refit=0.01})

tstat_2 = TreeStatistics(Tree=clean_6)  # -> Paths, Length, Count
item_15 = ListItem(List=tstat_2.Paths, Index=Slider(8, range=0..25), Wrap=True)
item_16 = ListItem(List=duppt_2, Index=0, Wrap=True)
branch = TreeBranch(Tree=clean_6, Path=item_15, MaintainPaths=True)

duppt_3 = RemoveDuplicatePts(Points=cull_8, Tolerance=0.01)
clean_7 = CleanTree(RemoveNulls=True, RemoveInvalid=True, RemoveEmpty=True, Tree=duppt_3)
intcrv = Interpolate(Vertices=clean_7, Degree=3, Periodic=False, KnotStyle=1)  # -> flatten(Curve), Length, Domain

tag = TextTag3D(Location=item_16, Text=graft(tstat_2.Paths), Size=Slider(3, range=0..25), Justification=7)

# ---- group: Floor Bay Quads
srf = Surface(loft)

# ---- group: Raker Parabolics
crv_13 = Curve(intcrv.Curve)

crv_14 = Curve(crv_13)

# ---- group: Floor Bay Quads
srf_2 = Surface(flatten(srf))

# ---- group: level Elevations
num_6 = Number(num_3)

# ----
# Project bays on levels, test for n corner points included in floors
pt_19 = ConstructPoint(XCoordinate=0, YCoordinate=0, ZCoordinate=num_6)
clean_8 = CleanTree(RemoveNulls=True, RemoveInvalid=True, RemoveEmpty=False, Tree=srf_2)
project_3 = Project(Geometry=graft(clean_8), Plane=pt_19)  # -> Geometry, Transform
debrep_5 = DeconstructBrep(Brep=project_3.Geometry)  # -> Faces, Edges, Vertices
brepsinc = PointInBreps(Brep=brep_7, Point=debrep_5.Vertices, Strict=False)  # -> Inside, Index
ma = MassAddition(Input=brepsinc.Inside)  # -> Result, PartialResults
pshift_3 = ShiftPaths(Data=ma.Result, Offset=-1)
larger_3 = LargerThan(FirstNumber=pshift_3, SecondNumber=how_many_bay_points_to_check_for)  # -> LargerThan, OrEqualTo
dispatch_13 = Dispatch(List=project_3.Geometry, DispatchPattern=larger_3.OrEqualTo)  # -> ListA, ListB
srf_3 = Surface(dispatch_13.ListA)
clean_9 = CleanTree(RemoveNulls=True, RemoveInvalid=True, RemoveEmpty=True, Tree=srf_3)

# ---- group: Raker Parabolics
crv_15 = Curve(crv_13)

# ---- group: Grid Intersection Points
pt_20 = Point(pt_14)

# ----
Z_5 = UnitZ(Factor=num)
# Draw segmented raker beams
Z_6 = UnitZ(Factor=1)
move_3 = Move(Geometry=crv_15, Motion=Z_5)  # -> Geometry, Transform
line = LineSDL(Start=pt_20, Direction=Z_6, Length="1000")
ccx_2 = CurveCurve(CurveA=graft(move_3.Geometry), CurveB=flatten(line))  # -> Points, ParamsA, ParamsB
end_6 = EndPoints(Curve=move_3.Geometry)  # -> graft(Start), graft(End)
ccx_3 = CurveCurve(CurveA=move_3.Geometry, CurveB=graft(line))  # -> simplify(Points), ParamsA, ParamsB
shift_3 = ShiftPaths(Data=ccx_2.ParamsA, Offset=-1)
clean_10 = CleanTree(RemoveNulls=True, RemoveInvalid=True, RemoveEmpty=True, Tree=ccx_3.Points)
sort_9 = SortList(Keys=shift_3)  # -> Keys, ValuesA
shift_4 = ShiftPaths(Data=clean_10, Offset="-2")
eval_2 = EvaluateCurve(Curve=graft(move_3.Geometry), Parameter=sort_9.Keys)  # -> Point, Tangent, Angle
merge_5 = Merge(Data1=end_6.Start, Data2=eval_2.Point, Data3=end_6.End)
pline_2 = PolyLine(Vertices=merge_5, Closed=False)
explode_3 = Explode(Curve=pline_2, Recursive=True)  # -> Segments, Vertices

# ----
# Rakers
renumber = RenumberPaths(Data=shift_4)

# ----
# Raker / Parabolic fit visualization
number_slider_3 = Slider(10, range=1..10)
range = Range(Domain=Domain(0, 1), Steps=number_slider_3)
eval_3 = EvaluateCurve(Curve=reparameterize(graft(explode_3.Segments)), Parameter=range)  # -> Point, Tangent, Angle
shift_5 = ShiftPaths(Data=eval_3.Point, Offset=-1)
pull = PullPoint(Point=shift_5, Geometry=graft(crv_15), ClosestOnly=True)  # -> flatten(ClosestPoint), flatten(Distance)
bnd_6 = Bounds(Numbers=pull.Distance)
remap = RemapNumbers(Value=pull.Distance, Source=bnd_6, Target=Domain(0, 1))  # -> Mapped, Clipped

viewer = ParamViewer(clean_10)
viewer_2 = ParamViewer(shift_4)
branch_2 = TreeBranch(Tree=renumber, Path=Slider(24, range=0..24), MaintainPaths=True)
gradient = Gradient(LowerLimit=0, UpperLimit=1, Parameter=remap.Mapped, stops=[0: RGB(0, 128, 0), 0.5: RGB(255, 255, 0), 1: RGB(255, 0, 0)])
distance_range_ft_from_top_of_raker_to_b = Panel(bnd_6)  # "Distance Range [ft] from Top of Raker to best fit parabolic"

# ---- group: Raker Beams
crv_16 = Curve(simplify(graft(explode_3.Segments)))

# ----
number_slider_4 = Slider(3, range=0..10)  # disabled
swatch = ColourSwatch(SwatchColor=RGB(0, 137, 186))  # disabled
previewlw = CustomPreviewLineweights(Geometry=crv_16, Shader=swatch, Thickness=number_slider_4, Absolute=False)  # disabled

# ---- group: All Radial Grid Angles
num_7 = Number(num_2)

num_8 = Number(num_2)

# ----
# Draw columns, base to top
panel_15 = Panel("0")
cull_i_2 = CullIndex(List=pt_16, Indices=panel_15, Wrap=True)  # -> simplify(List)
brepinc = PointInBrep(Brep=extr_2, Point=cull_i_2, Strict=False)
c_script_2 = CSharpScript(x=brepinc, y=cull_i_2)  # -> out, A; inputs x: list of Boolean, y: list of Point3d
# ---------- c_script_2: C# ----------
    int lastTrue = -1;
    for (int i = 0; i < x.Count; i++)
    {
      if (x[i])
      {
        lastTrue = i;
      }
    }

    List<Point3d> outPts = new List<Point3d>();
    for (int i = 0; i <= lastTrue; i++)
    {
      outPts.Add(y[i]);
    }

    A = outPts;
# ---------- end c_script_2 ----------

match = MatchTree(Tree=c_script_2.A, Guide=cull_i_2)

clean_11 = CleanTree(RemoveNulls=True, RemoveInvalid=True, RemoveEmpty=True, Tree=match)
item_17 = ListItem(List=clean_11, Index=0, Wrap=True)
pdecon_11 = Deconstruct(Point=graft(item_17))  # -> XComponent, YComponent, ZComponent
pt_21 = ConstructPoint(XCoordinate=pdecon_11.XComponent, YCoordinate=pdecon_11.YComponent, ZCoordinate="0")
merge_6 = Merge(Data1=simplify(pt_21), Data2=simplify(clean_11))
pdecon_12 = Deconstruct(Point=merge_6)  # -> XComponent, YComponent, ZComponent
sort_10 = SortList(Keys=pdecon_12.ZComponent, ValuesA=merge_6)  # -> Keys, ValuesA
pline_3 = PolyLine(Vertices=sort_10.ValuesA, Closed=False)

panel_16 = Panel(clean_11)
shift_6 = ShiftPaths(Data=pline_3, Offset=-1)

# ---- group: Column Polylines
crv_17 = Curve(shift_6)

crv_18 = Curve(crv_17)

# ----
panel_17 = Panel(crv_18)
tstat_3 = TreeStatistics(Tree=crv_18)  # -> Paths, Length, Count
branch_3 = TreeBranch(Tree=crv_18, Path=Slider(7, range=0..30), MaintainPaths=True)
branch_4 = TreeBranch(Tree=pt_20, Path=tstat_3.Paths, MaintainPaths=True)
duplines = RemoveDuplicateLines(Lines=flatten(crv_18), Tolerance="0.1")  # -> simplify(graft(Lines))

# ----
# Columns Under Rakers
end_7 = EndPoints(Curve=duplines)  # -> Start, End
graft = GraftTree(Tree=pt_20, IncludeEmptyLists=True, IncludeNullItems=True)
# Draw columns from rakers down to [either top of column below, or to ground level]
shift_7 = ShiftPaths(Data=ccx_3.Points, Offset=-1)
pt_22 = Point(end_7.End)
tstat_4 = TreeStatistics(Tree=shift_7)  # -> Paths, Length, Count
tstat_5 = TreeStatistics(Tree=pt_22)  # -> Paths, Length, Count
txt = Text(tstat_5.Paths)
txt_2 = Text(tstat_4.Paths)
cset = CreateSet(List=txt)  # -> Set, Map
cset_2 = CreateSet(List=txt_2)  # -> Set, Map
difference = SetDifference(SetA=cset_2.Set, SetB=cset.Set)
branch_5 = TreeBranch(Tree=graft, Path=difference, MaintainPaths=True)
merge_7 = Merge(Data1=simplify(pt_22), Data2=simplify(shift_7), Data3=simplify(branch_5))
pline_4 = PolyLine(Vertices=merge_7, Closed=False)

end_8 = EndPoints(Curve=pline_4)  # -> Start, End
pdecon_13 = Deconstruct(Point=end_8.Start)  # -> XComponent, YComponent, ZComponent
pdecon_14 = Deconstruct(Point=end_8.End)  # -> XComponent, YComponent, ZComponent
larger_4 = LargerThan(FirstNumber=pdecon_13.ZComponent, SecondNumber=pdecon_14.ZComponent)  # -> LargerThan, OrEqualTo
dispatch_14 = Dispatch(List=pline_4, DispatchPattern=larger_4.LargerThan)  # -> ListA, ListB
flip_3 = FlipCurve(Curve=dispatch_14.ListA)  # -> Curve, Flag
weave_3 = Weave(Pattern=larger_4.LargerThan, Stream0=dispatch_14.ListB, Stream1=flip_3.Curve, NullGaps=False)

# ---- group: Standard Column Polylines
crv_19 = Curve(crv_17)

# ---- group: Check to see if Raker Column is present/ discard those that have a duplicate
end_9 = EndPoints(Curve=crv_19)  # -> Start, End
pt_23 = Point(graft(end_9.Start))

# ---- group: Columns under Rakers
crv_20 = Curve(weave_3)

# ----
end_10 = EndPoints(Curve=crv_20)  # -> Start, End
pdecon_15 = Deconstruct(Point=end_10.Start)  # -> XComponent, YComponent, ZComponent
pdecon_16 = Deconstruct(Point=end_10.End)  # -> XComponent, YComponent, ZComponent
similar = Similarity(FirstNumber=pdecon_15.ZComponent, SecondNumber=pdecon_16.ZComponent, Threshold=0.1)  # -> flatten(Similarity), AbsoluteDifference
tstat_6 = TreeStatistics(Tree=crv_20)  # -> Paths, Length, Count
panel_19 = Panel(crv_20)
dispatch_15 = Dispatch(List=tstat_6.Paths, DispatchPattern=similar.Similarity)  # -> ListA, ListB
split_7 = SplitTree(Data=crv_20, Masks=flatten(dispatch_15.ListA))  # -> Positive, Negative
crv_21 = Curve(split_7.Negative)

# ---- group: Check to see if Raker Column is present/ discard those that have a duplicate / All Columns 'under rakers'
clean_12 = CleanTree(RemoveNulls=True, RemoveInvalid=True, RemoveEmpty=True, Tree=crv_21)
shift_8 = ShiftPaths(Data=clean_12, Offset=-1)  # -> flatten(Data)
end_11 = EndPoints(Curve=shift_8)  # -> Start, End
pt_24 = Point(end_11.Start)

# ---- group: Check to see if Raker Column is present/ discard those that have a duplicate / Does the Column exist as an under Raker instrance?
cp_3 = ClosestPoint(Point=pt_23, Cloud=pt_24)  # -> ClosestPoint, CPIndex, Distance
smaller_10 = SmallerThan(FirstNumber=cp_3.Distance, SecondNumber=Slider(1, range=0..1))  # -> flatten(SmallerThan), OrEqualTo
tstat_7 = TreeStatistics(Tree=cp_3.Distance)  # -> Paths, Length, Count
dispatch_16 = Dispatch(List=tstat_7.Paths, DispatchPattern=smaller_10.SmallerThan)  # -> ListA, ListB

# ---- group: Check to see if Raker Column is present/ discard those that have a duplicate
crv_22 = Curve(graft(crv_19))
split_8 = SplitTree(Data=crv_22, Masks=flatten(dispatch_16.ListA))  # -> Positive, Negative

# ----
crv_23 = Curve(split_8.Negative)
shift_9 = ShiftPaths(Data=crv_23, Offset=-1)

swatch_2 = ColourSwatch(SwatchColor=RGB(194, 0, 0))  # disabled
previewlw_2 = CustomPreviewLineweights(Geometry=shift_9, Shader=swatch_2, Thickness=number_slider_4, Absolute=False)  # disabled

swatch_3 = ColourSwatch(SwatchColor=RGB(0, 128, 47))  # disabled
previewlw_3 = CustomPreviewLineweights(Geometry=crv_21, Shader=swatch_3, Thickness=number_slider_4, Absolute=False)  # disabled

# ---- group: Column Polylines
# Reinforcing Girders
crv_24 = Curve(crv_17)  # disabled

# ----
# Floor Framing Infill beams
edges_2 = BrepEdges(Brep=clean_9)  # -> Naked, Interior, NonManifold
item_18 = ListItem(List=edges_2.Naked, Index=0, Wrap=True)  # -> Item, Item1, Item2, Item3
flip_4 = FlipCurve(Curve=item_18.Item3)  # -> Curve, Flag
len_7 = Length(Curve=item_18.Item1)
merge_8 = Merge(Data1=item_18.Item1, Data2=flip_4.Curve)

# ---- group: Radial Girders
crv_25 = Curve(merge_8)

# ----
crv_26 = Curve(reparameterize(flatten(crv_25)))
dupln = RemoveDuplicateLines(Lines=crv_26, Tolerance=0.01)
crv_27 = Curve(dupln)

# ---- group: Sort Curves into Levels
midpt_2 = CurveMiddle(Curve=crv_27)  # -> simplify(Midpoint)
sort_11 = SortList(Keys=subtraction)  # -> simplify(graft(Keys)), ValuesA
pdecon_17 = Deconstruct(Point=midpt_2)  # -> XComponent, YComponent, ZComponent
similar_2 = Similarity(FirstNumber=pdecon_17.ZComponent, SecondNumber=sort_11.Keys, Threshold=Slider(5, range=0..10))  # -> Similarity, AbsoluteDifference

# ---- group: Find Closest Revit Level to
similar_3 = Similarity(FirstNumber=sort_11.Keys, SecondNumber=sort_4.Keys, Threshold=0.1)  # -> Similarity, AbsoluteDifference

# ----
sort_12 = SortList(Keys=similar_3.AbsoluteDifference, ValuesA=sort_4.ValuesA)  # -> Keys, ValuesA
item_19 = ListItem(List=sort_12.ValuesA, Index=0, Wrap=True)  # -> simplify(Item)

# ---- group: Sort Curves into Levels
dispatch_17 = Dispatch(List=crv_27, DispatchPattern=similar_2.Similarity)  # -> simplify(ListA), ListB

# ----
clean_13 = CleanTree(RemoveNulls=True, RemoveInvalid=True, RemoveEmpty=True, Tree=dispatch_17.ListA)
crv_28 = Curve(clean_13)

swatch_4 = ColourSwatch(SwatchColor=RGB(0, 67, 148))  # disabled
previewlw_4 = CustomPreviewLineweights(Geometry=crv_25, Shader=swatch_4, Thickness=number_slider_4, Absolute=False)  # disabled

# ---- group: Girders
crv_29 = Curve(flatten(crv_25))  # disabled

# ----
# Draw reinforcing girders where there isn't already a floor framing girder
explode_4 = Explode(Curve=crv_24, Recursive=True)  # -> Segments, graft(Vertices); disabled
item_20 = ListItem(List=explode_4.Vertices, Index=0, Wrap=False)  # -> Item, Item1, Item2, Item3, Item4, Item5, Item6, Item7, Item8; disabled
pshift_4 = ShiftPaths(Data=item_20.Item, Offset=-1)  # disabled
pshift_5 = ShiftPaths(Data=item_20.Item1, Offset=-1)  # disabled
pshift_6 = ShiftPaths(Data=item_20.Item2, Offset=-1)  # disabled
pshift_7 = ShiftPaths(Data=item_20.Item5, Offset=-1)  # disabled
pshift_8 = ShiftPaths(Data=item_20.Item3, Offset=-1)  # disabled
pshift_9 = ShiftPaths(Data=item_20.Item6, Offset=-1)  # disabled
pshift_10 = ShiftPaths(Data=item_20.Item4, Offset=-1)  # disabled
pline_5 = PolyLine(Vertices=pshift_4, Closed=False)  # disabled
pline_6 = PolyLine(Vertices=pshift_5, Closed=False)  # disabled
pline_7 = PolyLine(Vertices=pshift_6, Closed=False)  # disabled
pline_8 = PolyLine(Vertices=pshift_7, Closed=False)  # disabled
pline_9 = PolyLine(Vertices=pshift_8, Closed=False)  # disabled
pline_10 = PolyLine(Vertices=pshift_9, Closed=False)  # disabled
pline_11 = PolyLine(Vertices=pshift_10, Closed=False)  # disabled
explode_5 = Explode(Curve=pline_5, Recursive=True)  # -> Segments, Vertices; disabled
explode_6 = Explode(Curve=pline_7, Recursive=True)  # -> Segments, Vertices; disabled
explode_7 = Explode(Curve=pline_6, Recursive=True)  # -> Segments, Vertices; disabled
explode_8 = Explode(Curve=pline_11, Recursive=True)  # -> Segments, Vertices; disabled
explode_9 = Explode(Curve=pline_9, Recursive=True)  # -> Segments, Vertices; disabled
explode_10 = Explode(Curve=pline_8, Recursive=True)  # -> Segments, Vertices; disabled
explode_11 = Explode(Curve=pline_10, Recursive=True)  # -> Segments, Vertices; disabled
merge_9 = Merge(
    Data2=explode_7.Segments,
    Data3=explode_6.Segments,
    Data4=explode_9.Segments,
    Data5=explode_8.Segments,
    Data6=explode_10.Segments,
    Data7=explode_11.Segments)  # disabled
clean_14 = CleanTree(RemoveNulls=True, RemoveInvalid=True, RemoveEmpty=False, Tree=crv_29)  # disabled
panel_20 = Panel("0.5")  # disabled
eval_4 = EvaluateCurve(Curve=merge_9, Parameter=panel_20)  # -> Point, Tangent, Angle; disabled
pull_2 = PullPoint(Point=eval_4.Point, Geometry=clean_14, ClosestOnly=True)  # -> ClosestPoint, Distance; disabled
panel_21 = Panel("0.25")  # disabled
smaller_11 = SmallerThan(FirstNumber=pull_2.Distance, SecondNumber=panel_21)  # -> SmallerThan, OrEqualTo; disabled
dispatch_18 = Dispatch(List=merge_9, DispatchPattern=smaller_11.SmallerThan)  # -> ListA, ListB; disabled
crv_30 = Curve(dispatch_18.ListB)  # disabled

panel_22 = Panel(explode_4.Vertices)  # disabled

panel_23 = Panel("W-Wide Flange")  # disabled
clean_15 = CleanTree(RemoveNulls=True, RemoveInvalid=True, RemoveEmpty=True, Tree=crv_30)  # -> flatten(Tree); disabled
types = QueryTypes(Kind=3, FamilyName=panel_23)  # disabled
number_slider_5 = Slider(5, range=0..100)  # disabled
item_21 = ListItem(List=types, Index=number_slider_5, Wrap=True)  # disabled
s_beam = AddStructuralBeam(Curve=clean_15, Type=item_21, TrackingMode=2)  # disabled
inspect = InspectElement(Element=s_beam)  # disabled
param = ElementParameter(Element=s_beam, Parameter=inspect, Value=value_picker_2)  # -> Element, Value; disabled

# ---- group: Sort Curves into Levels
sort_13 = SortList(Keys=subtraction)  # -> simplify(graft(Keys)), ValuesA

# ---- group: Find Closest Revit Level to
similar_4 = Similarity(FirstNumber=sort_13.Keys, SecondNumber=sort_4.Keys, Threshold=0.1)  # -> Similarity, AbsoluteDifference

# ----
sort_14 = SortList(Keys=similar_4.AbsoluteDifference, ValuesA=sort_4.ValuesA)  # -> Keys, ValuesA
item_22 = ListItem(List=sort_14.ValuesA, Index=0, Wrap=True)  # -> simplify(Item)

# ---- group: Sort Framing CUrves onto Levels
tstat_8 = TreeStatistics(Tree=crv_28)  # -> Paths, Length, Count
split_9 = SplitTree(Data=item_19, Masks=flatten(tstat_8.Paths))  # -> Positive, Negative
data = Data(split_9.Positive)

# ---- group: Choose Levels to Bake to Revit
value_picker_7 = ValuePicker(data)

# ---- group: Sort Framing CUrves onto Levels (continued)
data_2 = Data(value_picker_7)
clean_16 = CleanTree(RemoveNulls=True, RemoveInvalid=True, RemoveEmpty=True, Tree=data_2)
tstat_9 = TreeStatistics(Tree=clean_16)  # -> Paths, Length, Count
split_10 = SplitTree(Data=data, Masks=flatten(tstat_9.Paths))  # -> Positive, Negative
split_11 = SplitTree(Data=crv_28, Masks=flatten(tstat_9.Paths))  # -> Positive, Negative

# ----
level = Level(split_10.Positive)
crv_31 = Curve(split_11.Positive)

filter_4 = StreamFilter(Gate=toggle_4, Stream1=shift_9)
filter_5 = StreamFilter(Gate=toggle_8, Stream1=crv_31)
filter_6 = StreamFilter(Gate=toggle_3, Stream1=crv_16)
filter_7 = StreamFilter(Gate=toggle_4, Stream1=crv_21)

clean_17 = CleanTree(RemoveNulls=True, RemoveInvalid=True, RemoveEmpty=True, Tree=filter_6)
clean_18 = CleanTree(RemoveNulls=True, RemoveInvalid=True, RemoveEmpty=True, Tree=filter_7)

end_12 = EndPoints(Curve=filter_4)  # -> Start, End
ln_3 = Line(StartPoint=end_12.Start, EndPoint=end_12.End)  # -> graft(Line)

# ---- group: Raker Start Point
end_13 = EndPoints(Curve=clean_17)  # -> Start, End
pdecon_18 = Deconstruct(Point=end_13.Start)  # -> XComponent, YComponent, ZComponent

# ---- group: Sort Framing CUrves onto Levels
data_3 = Data(value_picker_7)
clean_19 = CleanTree(RemoveNulls=True, RemoveInvalid=True, RemoveEmpty=True, Tree=data_3)
tstat_10 = TreeStatistics(Tree=clean_19)  # -> Paths, Length, Count

# ----
swatch_5 = ColourSwatch(SwatchColor=RGB(0, 115, 255))  # disabled

# ----
# FLOOR FRAMING
# Used to find the Revit level to
# host the framing elements on
categories_3 = BuiltInCategories("autodesk.revit.category.family:structuralFraming-1.0.0", SearchPattern="Framing")
max_infill_beam_spacing_feet = Panel("11")

division_3 = Division(A=len_7, B=max_infill_beam_spacing_feet)
round = Round(Number=division_3)  # -> Nearest, Floor, Ceiling
divide = DivideCurve(Curve=flip_4.Curve, Count=round.Ceiling, Kinks=False)  # -> Points, Tangents, Parameters
divide_2 = DivideCurve(Curve=item_18.Item1, Count=round.Ceiling, Kinks=False)  # -> Points, Tangents, Parameters
ln_4 = Line(StartPoint=divide_2.Points, EndPoint=divide.Points)  # -> simplify(Line)

# ---- group: Infill beams
crv_32 = Curve(ln_4)

# ----
crv_33 = Curve(reparameterize(flatten(crv_32)))
dupln_2 = RemoveDuplicateLines(Lines=crv_33, Tolerance=0.01)
crv_34 = Curve(dupln_2)

# ---- group: Sort Curves into Levels (continued)
midpt_3 = CurveMiddle(Curve=crv_34)  # -> simplify(Midpoint)
pdecon_19 = Deconstruct(Point=midpt_3)  # -> XComponent, YComponent, ZComponent
similar_5 = Similarity(FirstNumber=pdecon_19.ZComponent, SecondNumber=sort_13.Keys, Threshold=Slider(5, range=0..10))  # -> Similarity, AbsoluteDifference

dispatch_19 = Dispatch(List=crv_34, DispatchPattern=similar_5.Similarity)  # -> simplify(ListA), ListB

# ----
clean_20 = CleanTree(RemoveNulls=True, RemoveInvalid=True, RemoveEmpty=True, Tree=dispatch_19.ListA)
crv_35 = Curve(clean_20)

# ---- group: Sort Framing CUrves onto Levels (continued)
tstat_11 = TreeStatistics(Tree=crv_35)  # -> Paths, Length, Count
split_12 = SplitTree(Data=item_22, Masks=flatten(tstat_11.Paths))  # -> Positive, Negative
data_4 = Data(split_12.Positive)
split_13 = SplitTree(Data=data_4, Masks=flatten(tstat_10.Paths))  # -> Positive, Negative
split_14 = SplitTree(Data=crv_35, Masks=flatten(tstat_10.Paths))  # -> Positive, Negative

# ----
previewlw_5 = CustomPreviewLineweights(Geometry=crv_32, Shader=swatch_5, Thickness=expr("x/2", number_slider_4), Absolute=False)  # disabled

level_2 = Level(split_13.Positive)
crv_36 = Curve(split_14.Positive)
filter_8 = StreamFilter(Gate=toggle_7, Stream1=crv_36)

types_2 = QueryTypes(Kind=3, Category=categories_3)
tsort_3 = SortText(Keys=types_2, Values=types_2, Culture=127)  # -> Keys, Values

# ---- group: Choose Girder Family
value_picker_8 = ValuePicker(tsort_3.Values)

# ---- group: Choose Infill Beam Family
value_picker_9 = ValuePicker(tsort_3.Values)

# ----
type = Type(value_picker_9)

type_2 = Type(type)
level_3 = Level(level_2)
s_beam_2 = AddStructuralBeam(Curve=filter_8, Type=type_2, ReferenceLevel=level_3, TrackingMode=2)

inspect_2 = InspectElement(Element=s_beam_2)
param_2 = ElementParameter(Element=s_beam_2, Parameter=inspect_2, Value=value_picker_2)  # -> Element, Value

type_3 = Type(value_picker_8)

type_4 = Type(type_3)
level_4 = Level(level)
s_beam_3 = AddStructuralBeam(Curve=filter_5, Type=type_4, ReferenceLevel=level_4, TrackingMode=2)

inspect_3 = InspectElement(Element=s_beam_3)
param_3 = ElementParameter(Element=s_beam_3, Parameter=inspect_3, Value=value_picker_2)  # -> Element, Value

# ----
# COLUMNS
panel_24 = Panel("W-Wide Flange-Column")

# ---- group: Querry Types from the Revit Model
types_3 = QueryTypes(Kind=3, FamilyName=panel_24)

# ----
# RAKERS
# Used to move the found raker slope
# underneth the precast.
panel_25 = Panel("W-Wide Flange")

types_4 = QueryTypes(Kind=3, FamilyName=panel_25)

tsort_4 = SortText(Keys=types_4, Values=types_4, Culture=127)  # -> Keys, Values

# ---- group: Choose Floor Framing Family
value_picker_10 = ValuePicker(tsort_4.Values)

# ----
type_5 = Type(value_picker_10)

tsort_5 = SortText(Keys=types_3, Values=types_3, Culture=127)  # -> Keys, Values

# ---- group: Choose Column Framing Family
value_picker_11 = ValuePicker(tsort_5.Values)

# ----
# #1 Choose Family Type
type_6 = Type(value_picker_11)

# ----
# Bake Columns under Rakers in Revit
type_7 = Type(type_6)

# ---- group: Create Strucutral Column
s_column = AddStructuralColumn(Curve=clean_18, Type=type_7, TrackingMode=2)

# ----
match_2 = MatchTree(Tree=s_column, Guide=clean_18)  # -> flatten(Tree)

# ----
# Bake Standard Columns in Revit
type_8 = Type(type_6)
crv_37 = Curve(filter_4)
s_column_2 = AddStructuralColumn(Curve=ln_3, Type=type_8, TrackingMode=2)

# ---- group: Build data tree of rotation angles
tstat_12 = TreeStatistics(Tree=crv_37)  # -> Paths, Length, Count
lng_5 = ListLength(List=crv_37)
split_15 = SplitTree(Data=num_8, Masks=flatten(tstat_12.Paths))  # -> Positive, Negative
dup = DuplicateData(Data=split_15.Positive, Number=lng_5, Order=True)  # -> simplify(graft(Data))

# ---- group: Necesary Radial Grid Angles
num_9 = Number(dup)

# ----
parameters = QueryElementParameters(Element=s_column_2, Name="Cross-Section Rotation")  # -> simplify(Parameters)
param_4 = ElementParameter(Element=s_column_2, Parameter=parameters, Value=num_9)  # -> Element, Value

inspect_4 = InspectElement(Element=param_4.Element)
param_5 = ElementParameter(Element=param_4.Element, Parameter=inspect_4, Value=value_picker_2)  # -> Element, Value

# ---- group: Set Column Style
inspect_5 = InspectElement(Element=param_5.Element)
int_4 = Integer("0")
param_6 = ElementParameter(Element=param_5.Element, Parameter=inspect_5, Value=int_4)  # -> Element, Value

# ---- group: Set Workset
workset_2 = Workset(workset)
workset_3 = ElementWorkset(Element=param_6.Element, Workset=workset_2)  # -> Element, Workset, Status

# ----
release = ReleaseElement(Elements=workset_3.Element, Released=toggle_6)  # -> Elements, Released

shift_10 = ShiftPaths(Data=match_2, Offset=-1)
crv_38 = Curve(shift_10)

# ---- group: Build data tree of rotation angles
lng_6 = ListLength(List=crv_38)
tstat_13 = TreeStatistics(Tree=crv_38)  # -> Paths, Length, Count
split_16 = SplitTree(Data=num_7, Masks=flatten(tstat_13.Paths))  # -> Positive, Negative
dup_2 = DuplicateData(Data=split_16.Positive, Number=lng_6, Order=True)  # -> simplify(graft(Data))

# ----
# Bake Girder Floor Framing in Revit
inspect_6 = InspectElement(Element=s_beam_3)
param_7 = ElementParameter(Element=param_3.Element, Parameter=inspect_6, Value=int_2)  # -> Element, Value
inspect_7 = InspectElement(Element=param_7.Element)
inspect_8 = InspectElement(Element=param_7.Element)
param_8 = ElementParameter(Element=param_7.Element, Parameter=inspect_7, Value=start_and_end_level_offset)  # -> Element, Value
param_9 = ElementParameter(Element=param_8.Element, Parameter=inspect_8, Value=start_and_end_level_offset)  # -> Element, Value

# ---- group: Set Workset
workset_4 = Workset(workset)
workset_5 = ElementWorkset(Element=param_9.Element, Workset=workset_4)  # -> Element, Workset, Status

# ----
release_2 = ReleaseElement(Elements=workset_5.Element, Released=toggle_10)  # -> Elements, Released

# ----
# Bake Infill Floor Framing in Revit
inspect_9 = InspectElement(Element=s_beam_2)
param_10 = ElementParameter(Element=param_2.Element, Parameter=inspect_9, Value=int_3)  # -> Element, Value
inspect_10 = InspectElement(Element=param_10.Element)
inspect_11 = InspectElement(Element=s_beam_2)
param_11 = ElementParameter(Element=param_10.Element, Parameter=inspect_10, Value=start_and_end_level_offset)  # -> Element, Value
param_12 = ElementParameter(Element=param_11.Element, Parameter=inspect_11, Value=start_and_end_level_offset)  # -> Element, Value

# ---- group: Set Workset
workset_6 = Workset(workset)
workset_7 = ElementWorkset(Element=param_12.Element, Workset=workset_6)  # -> Element, Workset, Status

# ----
release_3 = ReleaseElement(Elements=workset_7.Element, Released=toggle_9)  # -> Elements, Released

# ---- group: Filter Out some Levels
deplane_2 = DeconstructPlane(Plane=location_4.Location)  # -> Origin, XAxis, YAxis, ZAxis
pdecon_20 = Deconstruct(Point=deplane_2.Origin)  # -> XComponent, YComponent, ZComponent

# ----
# Bake Rakers in Revit
panel_26 = Panel("1999")
type_9 = Type(type_5)

# ---- group: Filter Out some Levels (continued)
tmatch = MatchText(Text=location_4.Element, RegEx=panel_26, Case=True)
dispatch_20 = Dispatch(List=pdecon_20.ZComponent, DispatchPattern=tmatch)  # -> ListA, ListB
dispatch_21 = Dispatch(List=location_4.Element, DispatchPattern=tmatch)  # -> ListA, ListB

# ---- group: Find Closest Revit Level to Raker Start Point
similar_6 = Similarity(FirstNumber=pdecon_18.ZComponent, SecondNumber=dispatch_20.ListB, Threshold=0.1)  # -> Similarity, AbsoluteDifference
sort_15 = SortList(Keys=similar_6.AbsoluteDifference, ValuesA=dispatch_21.ListB)  # -> Keys, ValuesA
item_23 = ListItem(List=sort_15.ValuesA, Index=0, Wrap=False)

# ---- group: Add Column Rotation
parameters_2 = QueryElementParameters(Element=match_2, Name="Cross-Section Rotation")
shift_11 = ShiftPaths(Data=parameters_2, Offset=-1)

# ----
match_3 = MatchTree(Tree=dup_2, Guide=clean_18)

# ---- group: Necesary Radial Grid Angles
num_10 = Number(match_3)

# ---- group: Add Column Rotation (continued)
param_13 = ElementParameter(Element=match_2, Parameter=shift_11, Value=num_10)  # -> Element, Value

# ---- group: Set Phase
inspect_12 = InspectElement(Element=param_13.Element)
param_14 = ElementParameter(Element=param_13.Element, Parameter=inspect_12, Value=value_picker_2)  # -> Element, Value

# ---- group: Set Column Style
inspect_13 = InspectElement(Element=param_14.Element)
int_5 = Integer("0")
param_15 = ElementParameter(Element=param_14.Element, Parameter=inspect_13, Value=int_5)  # -> Element, Value

# ---- group: Set Workset
workset_8 = Workset(workset)
workset_9 = ElementWorkset(Element=param_15.Element, Workset=workset_8)  # -> Element, Workset, Status

# ----
release_4 = ReleaseElement(Elements=workset_9.Element, Released=toggle_6)  # -> Elements, Released

s_beam_4 = AddStructuralBeam(Curve=clean_17, Type=type_9, ReferenceLevel=item_23, TrackingMode=2)

inspect_14 = InspectElement(Element=s_beam_4)
param_16 = ElementParameter(Element=s_beam_4, Parameter=inspect_14, Value=value_picker_2)  # -> Element, Value

# ---- group: 0 = Top z Justification
inspect_15 = InspectElement(Element=param_16.Element)
int_6 = Integer("0")
param_17 = ElementParameter(Element=param_16.Element, Parameter=inspect_15, Value=int_6)  # -> Element, Value

# ---- group: Set Workset
workset_10 = Workset(workset)
workset_11 = ElementWorkset(Element=param_17.Element, Workset=workset_10)  # -> Element, Workset, Status

# ----
release_5 = ReleaseElement(Elements=workset_11.Element, Released=toggle_5)  # -> Elements, Released
