# Grasshopper definition webSp.gh (Grasshopper 1.0.7)
# plug-ins: Parakeet, ShapeDiverForGrasshopper

sddp = ShapeDiverDocumentPayload({AbsoluteTolerance=0, AngleTolerance=0, DistanceDisplayPrecision=0, GltfVersion="Gltf2", GrasshopperVersion="1.0.0007", InputGroups="{}", OutputGroups="{}", RelativeTolerance=0, RhinoVersion="7.29.23107.3001", UnitSystem=0, VersionCreated="1.14.0.0", VersionSaved="1.14.0.0"})

ringn = GetInteger(Slider(11, range=0..30), AtLeast=1, AtMost=1, Maximum=2147483647, Minimum=-2147483648, TreeAccess=False)
scale = GetInteger(Slider(2, range=1..10), AtLeast=1, AtMost=1, Maximum=2147483647, Minimum=-2147483648, TreeAccess=False)
thickness = GetNumber(
    Slider(0.01, range=0.01..0.25),
    AtLeast=1,
    AtMost=1,
    Maximum=1.797693135e+308,
    Minimum=-1.797693135e+308,
    TreeAccess=False)
attractor = GetNumber(Slider(0.78, range=0.52..1), AtLeast=1, AtMost=1, Maximum=1.797693135e+308, Minimum=-1.797693135e+308, TreeAccess=False)

# ---- group: single curve in plan
crv = Curve(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)

# ----
line = Line(crv)
midpt = CurveMiddle(Curve=line)
end = EndPoints(Curve=line)  # -> Start, End
num = Number(line)
expression = Expression(m=num, Expression="(2/(-1+Sqrt(5)))*m")
vec2pt = Vector2Pt(PointA=end.Start, PointB=end.End, Unitize=False)  # -> Vector, Length
xy = XYPlane(Origin=midpt)
align = AlignPlane(Plane=xy, Direction=vec2pt.Vector)  # -> Plane, Angle
division = Division(A=expression, B=scale)
neg = Negative(Value=division)
dom = ConstructDomain(DomainStart=neg, DomainEnd=division)
planesrf = PlaneSurface(Plane=align.Plane, XSize=dom, YSize=dom)
boxrec = BoxRectangle(Rectangle=planesrf, Height=expression)

volume = Volume(Geometry=boxrec)  # -> Volume, Centroid
popgeo = PopulateGeometry(Geometry=boxrec, Count=ringn, Seed=1)
scale_2 = Scale(Geometry=boxrec, Center=volume.Centroid, Factor=attractor)  # -> Geometry, Transform
voronoi³ = Voronoi3D(Points=popgeo, Box=boxrec)  # -> Cells, Boundary
debrep = DeconstructBrep(Brep=voronoi³.Cells)  # -> Faces, Edges, Vertices
volume_2 = Volume(Geometry=voronoi³.Cells)  # -> Volume, Centroid
area = Area(Geometry=debrep.Faces)  # -> Area, Centroid
vec2pt_2 = Vector2Pt(PointA=volume.Centroid, PointB=volume_2.Centroid, Unitize=False)  # -> Vector, Length
brepinc = PointInBrep(Brep=scale_2.Geometry, Point=area.Centroid, Strict=False)
cull = CullPattern(List=debrep.Faces, CullPattern=brepinc)
join = BrepJoin(Breps=cull)  # -> flatten(Breps), Closed
amp = Amplitude(Vector=vec2pt_2.Vector, Amplitude=thickness)
move = Move(Geometry=join.Breps, Motion=amp)  # -> Geometry, Transform
debrep_2 = DeconstructBrep(Brep=move.Geometry)  # -> Faces, Edges, Vertices
disc = Discontinuity(Curve=debrep_2.Faces, Level=1)  # -> Points, Parameters
pline = PolyLine(Vertices=disc.Points, Closed=True)  # -> flatten(Polyline)

tiling_f_sr = TruncatedTrihexagonal(Plane=PlaneXY(0, 0, 0), Size=1, ExtendX=<missing>, ExtendY=<missing>)
klein_surface = KleinSurface(UDivision=100, Radius1=<missing>, Radius2=<missing>)  # -> KleinSurface, KleinSurfacePoints, KleinSurfaceMesh
tiling_f_sr_2 = TruncatedTrihexagonal(Plane=PlaneXY(0, 0, 0), Size=1, ExtendX=<missing>, ExtendY=<missing>)
klein_surface_2 = KleinSurface(UDivision=100, Radius1=<missing>, Radius2=<missing>)  # -> KleinSurface, KleinSurfacePoints, KleinSurfaceMesh
_2tilinga = _2UniformTilingA(Plane=PlaneXY(0, 0, 0), Size=1, ExtendX=<missing>, ExtendY=<missing>)
starpatterni = StarPatternI(BaseGrid=tiling_f_sr, Angle=<missing>, Distance=<missing>, ShiftSize=0, BulgeFactor=0)
patterngenl_pt = PatternGenotypeLPT(BasePolylines=tiling_f_sr_2, RotationFactor=<missing>, ScaleFactor=<missing>)
quadsubm = MirroredSubdivideQuad(BasePolylineS=<missing>, Mirror=True)
starpatterni_2 = StarPatternI(BaseGrid=_2tilinga, Angle=<missing>, Distance=<missing>, ShiftSize=0, BulgeFactor=0)
patterngene = PatternGenotypeE(BasePolylines=quadsubm, Factor=<missing>)

area_2 = Area(Geometry=pline)  # -> Area, Centroid
panel = Panel("""True
False""")
sort = SortList(Keys=area_2.Area, ValuesA=pline)  # -> Keys, ValuesA
dispatch = Dispatch(List=sort.ValuesA, DispatchPattern=panel)  # -> ListA, ListB
area_3 = Area(Geometry=dispatch.ListB)  # -> Area, Centroid
area_4 = Area(Geometry=dispatch.ListA)  # -> Area, Centroid
vec2pt_3 = Vector2Pt(PointA=area_4.Centroid, PointB=area_3.Centroid, Unitize=False)  # -> Vector, Length
move_2 = Move(Geometry=dispatch.ListA, Motion=vec2pt_3.Vector)  # -> graft(Geometry), Transform
merge = Merge(Data1=graft(dispatch.ListA), Data2=move_2.Geometry)
loft = Loft(Curves=merge, Options={Adjust=False, Closed=False, LoftEnds=0, LoftSimp=0, LoftType=0, Rebuild=10, Refit=0.01})
cap = CapHoles(Brep=loft)
debrep_3 = DeconstructBrep(Brep=cap)  # -> Faces, Edges, Vertices
mesh_uv = MeshSurface(Surface=debrep_3.Faces, UCount="1", VCount="1", Overhang=True, Equalize=False)  # -> flatten(Mesh)
mjoin = MeshJoin(Meshes=mesh_uv)
subdmesh = SubDFromMesh(Mesh=mjoin, Creases=1, Corners=1, Interpolate=False)

subd = SubD(subdmesh)
context_bake = ContextBake(Geometry=subd)
